# Grasshopper definition Forming.gh (Grasshopper 1.0.7)
# plug-ins: MetaHopper, Human

dim_y = Slider(6, range=1..10, expression="x*2")
slab_thickness = Slider(0.3, range=0.15..1)
# Inputs
# November 2, 2021
# Author: Fawzi Bata
# Course: Earthy 4.0
# TU Delft - Building Technology
dim_x = Slider(6, range=1..10, expression="x*2")
double_story = BooleanToggle(False)
freestanding_roof = BooleanToggle(False)
wall_height = Slider(2.7, range=0..10)
door_position = Slider(0, range=0..23)
closed_wall_position = Slider(0, range=0..23)
door_positions_multiple_connect_to_door = Panel("""3
4
5""")  # "Door Positions (Multiple) - Connect to Door Position & Disconnect Slider"
closed_wall_position_multiple_connect_to = Panel("""0
1
2
3
4
5
6
7""")  # "Closed Wall Position (Multiple) - Connect to Closed Wall Position & Disconnect Slider"
dim_y_2 = Number(dim_y)
double_story_bool = Boolean(double_story)
freestanding_bool = Boolean(freestanding_roof)
wall_height_2 = Number(wall_height)
door_position_2 = Number(door_position)
closed_wall_position_2 = Number(closed_wall_position)
dim_x_2 = Number(dim_x)
slab_thickness_2 = Number(slab_thickness)

# ---- group: Alt input for X &Y Dims By Rhino Surface (Connect U & V to Dim X & Dim Y))
srf_index = Slider(51, range=0..52)
srf = Surface([<surface referenced from the Rhino model> x40])
item = ListItem(List=srf, Index=srf_index, Wrap=True)
dim = Dimensions(Surface=item)  # -> UDimension, VDimension

# ----
cluster = Cluster_5(B=item)
dim_x_3 = Number(dim_x_2)
dim_y_3 = Number(dim_y_2)
planesrf = PlaneSurface(Plane=PlaneXY(0, 0, 0), XSize=dim_x_3, YSize=dim_y_3)
base_plane = Surface(planesrf)

createatts = CreateAttributes(LayerName="baked", enableFullPath=False)

# ---- group: If both spans are equal and smaller than 8m
# Dimension Rule Checks
dim_x_4 = Number(dim_x_2)
dim_y_4 = Number(dim_y_2)
smaller = SmallerThan(FirstNumber=dim_x_4, SecondNumber="8")  # -> SmallerThan, OrEqualTo
equals = Equality(FirstNumber=dim_x_4, SecondNumber=dim_y_4)  # -> Equality, Inequality
and = GateAnd(A=smaller.SmallerThan, B=equals.Equality)

# ---- group: If one span is smaller than 8m and both spans are not equal
dim_x_5 = Number(dim_x_2)
dim_y_5 = Number(dim_y_2)
min = Minimum(A=dim_x_5, B=dim_y_5)
equals_2 = Equality(FirstNumber=dim_x_5, SecondNumber=dim_y_5)  # -> Equality, Inequality
smaller_2 = SmallerThan(FirstNumber=min, SecondNumber="8")  # -> SmallerThan, OrEqualTo
and_2 = GateAnd(A=smaller_2.SmallerThan, B=equals_2.Inequality)

# ---- group: If both spans are larger than or equal to 8m
dim_x_6 = Number(dim_x_2)
dim_y_6 = Number(dim_y_2)
larger = LargerThan(FirstNumber=dim_x_6, SecondNumber="8")  # -> LargerThan, OrEqualTo
larger_2 = LargerThan(FirstNumber=dim_y_6, SecondNumber="8")  # -> LargerThan, OrEqualTo
and_3 = GateAnd(A=larger.OrEqualTo, B=larger_2.OrEqualTo)
freestanding_bool_2 = Boolean(freestanding_roof)
dispatch = Dispatch(List=and_3, DispatchPattern=freestanding_bool_2)  # -> ListA, ListB

# ---- group: Square <=6
mesh = Mesh(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)

# ---- group: Rect Short Side <8
mesh_2 = Mesh(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)

# ---- group: Centers
mesh_3 = Mesh(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)

# ---- group: Freestanding Roof
mesh_4 = Mesh(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)

# ----
freestanding_bool_3 = Boolean(freestanding_roof)
dispatch_2 = Dispatch(List=mesh_4, DispatchPattern=freestanding_bool_3)  # -> ListA, ListB
dim_x_7 = Number(dim_x_2)
dim_y_7 = Number(dim_y_2)
scale_nu = ScaleNU(Geometry=dispatch_2.ListA, Plane=PlaneXY(0, 0, 0), ScaleX=expr("x/2", dim_x_7), ScaleY=expr("x/2", dim_y_7), ScaleZ=1)  # -> Geometry, Transform
base_plane_2 = Surface(planesrf)
cluster_2 = Cluster_4(M=scale_nu.Geometry)
cluster_3 = Cluster_5(B=base_plane_2)
vec2pt = Vector2Pt(PointA=cluster_2, PointB=cluster_3, Unitize=False)  # -> Vector, Length
move = Move(Geometry=scale_nu.Geometry, Motion=vec2pt.Vector)  # -> Geometry, Transform

# ---- group: Corners
mesh_5 = Mesh(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)

# ---- group: Sides
mesh_6 = Mesh(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)

# ----
freestanding_bool_4 = Boolean(freestanding_roof)
dispatch_3 = Dispatch(List=mesh_2, DispatchPattern=freestanding_bool_4)  # -> ListA, ListB
dispatch_4 = Dispatch(List=dispatch_3.ListB, DispatchPattern=and_2)  # -> ListA, ListB
dim_x_8 = Number(dim_x_2)
dim_y_8 = Number(dim_y_2)
scale_nu_2 = ScaleNU(Geometry=dispatch_4.ListA, Plane=PlaneXY(0, 0, 0), ScaleX=expr("x/8", dim_x_8), ScaleY=expr("x/4", dim_y_8), ScaleZ=1)  # -> Geometry, Transform
base_plane_3 = Surface(planesrf)
cluster_4 = Cluster_4(M=scale_nu_2.Geometry)
cluster_5 = Cluster_5(B=base_plane_3)
vec2pt_2 = Vector2Pt(PointA=cluster_4, PointB=cluster_5, Unitize=False)  # -> Vector, Length
move_2 = Move(Geometry=scale_nu_2.Geometry, Motion=vec2pt_2.Vector)  # -> Geometry, Transform

freestanding_bool_5 = Boolean(freestanding_roof)
# Roof Meshes
dispatch_5 = Dispatch(List=mesh, DispatchPattern=freestanding_bool_5)  # -> ListA, ListB
dispatch_6 = Dispatch(List=dispatch_5.ListB, DispatchPattern=and)  # -> ListA, ListB
dim_x_9 = Number(dim_x_2)
dim_y_9 = Number(dim_y_2)
scale_nu_3 = ScaleNU(Geometry=dispatch_6.ListA, Plane=PlaneXY(0, 0, 0), ScaleX=expr("x/6", dim_x_9), ScaleY=expr("x/6", dim_y_9), ScaleZ=1)  # -> Geometry, Transform
base_plane_4 = Surface(planesrf)
cluster_6 = Cluster_4(M=scale_nu_3.Geometry)
cluster_7 = Cluster_5(B=base_plane_4)
vec2pt_3 = Vector2Pt(PointA=cluster_6, PointB=cluster_7, Unitize=False)  # -> Vector, Length
move_3 = Move(Geometry=scale_nu_3.Geometry, Motion=vec2pt_3.Vector)  # -> Geometry, Transform

base_plane_5 = Surface(planesrf)

# ---- group: Door
crv = Curve(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)

# ---- group: Large Window
crv_2 = Curve(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)

# ---- group: Small Windows
crv_3 = Curve([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])

# ----
freestanding_bool_6 = Boolean(freestanding_roof)

# ----
# Bake Final Geometry
button = Button()

dispatch_7 = Dispatch(List=mesh_3, DispatchPattern=dispatch.ListB)  # -> ListA, ListB
dispatch_8 = Dispatch(List=mesh_6, DispatchPattern=dispatch.ListB)  # -> ListA, ListB
dispatch_9 = Dispatch(List=mesh_5, DispatchPattern=dispatch.ListB)  # -> ListA, ListB
dim_x_10 = Number(dim_x_2)
dim_y_10 = Number(dim_y_2)
cluster_8 = Cluster(M=base_plane_5)  # -> center_top, center_left, center_bottom, center_right, top_left, bottom_left, bottom_right, top_right, center
rotate = Rotate(Geometry=dispatch_8.ListA, Angle=3.141592654, Plane=PlaneXY(0, 0, 0))  # -> Geometry, Transform
rotate_2 = Rotate(Geometry=dispatch_8.ListA, Angle=4.71238898, Plane=PlaneXY(0, 0, 0))  # -> Geometry, Transform
rotate_3 = Rotate(Geometry=dispatch_8.ListA, Angle=1.570796327, Plane=PlaneXY(0, 0, 0))  # -> Geometry, Transform
subtraction = Subtraction(A=dim_y_10, B=8)
rotate_4 = Rotate(Geometry=dispatch_9.ListA, Angle=4.71238898, Plane=PlaneXY(0, 0, 0))  # -> Geometry, Transform
rotate_5 = Rotate(Geometry=dispatch_9.ListA, Angle=3.141592654, Plane=PlaneXY(0, 0, 0))  # -> Geometry, Transform
rotate_6 = Rotate(Geometry=dispatch_9.ListA, Angle=1.570796327, Plane=PlaneXY(0, 0, 0))  # -> Geometry, Transform
subtraction_2 = Subtraction(A=dim_x_10, B=8)
division = Division(A=subtraction, B=4)
division_2 = Division(A=subtraction_2, B=4)
dim_x_11 = Number(dim_x_2)
dim_x_12 = Number(dim_x_2)
dim_y_11 = Number(dim_y_2)
dim_y_12 = Number(dim_y_2)
vec2pt_4 = Vector2Pt(PointA=Point(0, 0, 0), PointB=cluster_8.bottom_left, Unitize=False)  # -> Vector, Length
vec2pt_5 = Vector2Pt(PointA=Point(0, 0, 0), PointB=cluster_8.bottom_right, Unitize=False)  # -> Vector, Length
vec2pt_6 = Vector2Pt(PointA=Point(0, 0, 0), PointB=cluster_8.top_left, Unitize=False)  # -> Vector, Length
vec2pt_7 = Vector2Pt(PointA=Point(0, 0, 0), PointB=cluster_8.top_right, Unitize=False)  # -> Vector, Length
int = Integer(division)
int_2 = Integer(division_2)
subtraction_3 = Subtraction(A=dim_x_11, B=8)
subtraction_4 = Subtraction(A=dim_y_12, B=8)
subtraction_5 = Subtraction(A=dim_x_12, B=8)
subtraction_6 = Subtraction(A=dim_y_11, B=8)
move_4 = Move(Geometry=dispatch_9.ListA, Motion=vec2pt_4.Vector)  # -> Geometry, Transform
move_5 = Move(Geometry=rotate_4.Geometry, Motion=vec2pt_6.Vector)  # -> Geometry, Transform
move_6 = Move(Geometry=rotate_5.Geometry, Motion=vec2pt_7.Vector)  # -> Geometry, Transform
move_7 = Move(Geometry=rotate_6.Geometry, Motion=vec2pt_5.Vector)  # -> Geometry, Transform
series = Series(Start=0, Step=4, Count=int)
series_2 = Series(Start=0, Step=4, Count=int_2)
division_3 = Division(A=subtraction_3, B=4)
division_4 = Division(A=subtraction_4, B=4)
division_5 = Division(A=subtraction_5, B=4)
division_6 = Division(A=subtraction_6, B=4)
Y = UnitY(Factor=series)
X = UnitX(Factor=series_2)
int_3 = Integer(division_3)
int_4 = Integer(division_5)
int_5 = Integer(division_6)
int_6 = Integer(division_4)
series_3 = Series(Start=0, Step=4, Count=int_3)
series_4 = Series(Start=0, Step=4, Count=int_6)
series_5 = Series(Start=0, Step=4, Count=int_4)
series_6 = Series(Start=0, Step=4, Count=int_5)
move_8 = Move(Geometry=dispatch_7.ListA, Motion=X)  # -> Geometry, Transform
X_2 = UnitX(Factor=series_3)
Y_2 = UnitY(Factor=series_4)
X_3 = UnitX(Factor=series_5)
Y_3 = UnitY(Factor=series_6)
mjoin = MeshJoin(Meshes=move_8.Geometry)
move_9 = Move(Geometry=dispatch_8.ListA, Motion=X_2)  # -> Geometry, Transform
move_10 = Move(Geometry=rotate_3.Geometry, Motion=Y_2)  # -> Geometry, Transform
move_11 = Move(Geometry=rotate.Geometry, Motion=X_3)  # -> Geometry, Transform
move_12 = Move(Geometry=rotate_2.Geometry, Motion=Y_3)  # -> Geometry, Transform
move_13 = Move(Geometry=mjoin, Motion=Y)  # -> Geometry, Transform
mjoin_2 = MeshJoin(Meshes=move_9.Geometry)
mjoin_3 = MeshJoin(Meshes=move_10.Geometry)
mjoin_4 = MeshJoin(Meshes=move_11.Geometry)
mjoin_5 = MeshJoin(Meshes=move_12.Geometry)
mjoin_6 = MeshJoin(Meshes=move_13.Geometry)
cluster_9 = Cluster_2(M=mjoin_2)  # -> center_top, center_left, center_bottom, center_right, top_left, bottom_left, bottom_right, top_right, center
cluster_10 = Cluster_2(M=mjoin_3)  # -> center_top, center_left, center_bottom, center_right, top_left, bottom_left, bottom_right, top_right, center
cluster_11 = Cluster_2(M=mjoin_4)  # -> center_top, center_left, center_bottom, center_right, top_left, bottom_left, bottom_right, top_right, center
cluster_12 = Cluster_2(M=mjoin_5)  # -> center_top, center_left, center_bottom, center_right, top_left, bottom_left, bottom_right, top_right, center
cluster_13 = Cluster_3(M=mjoin_6)
vec2pt_8 = Vector2Pt(PointA=cluster_9.center_bottom, PointB=cluster_8.center_bottom, Unitize=False)  # -> Vector, Length
dist = Distance(PointA=cluster_9.bottom_left, PointB=cluster_9.bottom_right)
vec2pt_9 = Vector2Pt(PointA=cluster_10.center_right, PointB=cluster_8.center_right, Unitize=False)  # -> Vector, Length
vec2pt_10 = Vector2Pt(PointA=cluster_11.center_top, PointB=cluster_8.center_top, Unitize=False)  # -> Vector, Length
vec2pt_11 = Vector2Pt(PointA=cluster_12.center_left, PointB=cluster_8.center_left, Unitize=False)  # -> Vector, Length
dist_2 = Distance(PointA=cluster_10.top_right, PointB=cluster_10.bottom_right)
dist_3 = Distance(PointA=cluster_11.top_left, PointB=cluster_11.top_right)
dist_4 = Distance(PointA=cluster_12.top_left, PointB=cluster_12.bottom_left)
vec2pt_12 = Vector2Pt(PointA=cluster_13, PointB=cluster_8.center, Unitize=False)  # -> Vector, Length
move_14 = Move(Geometry=mjoin_2, Motion=vec2pt_8.Vector)  # -> Geometry, Transform
move_15 = Move(Geometry=mjoin_3, Motion=vec2pt_9.Vector)  # -> Geometry, Transform
move_16 = Move(Geometry=mjoin_4, Motion=vec2pt_10.Vector)  # -> Geometry, Transform
move_17 = Move(Geometry=mjoin_5, Motion=vec2pt_11.Vector)  # -> Geometry, Transform
division_7 = Division(A=subtraction_3, B=dist)
division_8 = Division(A=subtraction_4, B=dist_2)
division_9 = Division(A=subtraction_5, B=dist_3)
division_10 = Division(A=subtraction_6, B=dist_4)
move_18 = Move(Geometry=mjoin_6, Motion=vec2pt_12.Vector)  # -> Geometry, Transform
scale_nu_4 = ScaleNU(Geometry=move_14.Geometry, Plane=cluster_8.center_bottom, ScaleX=division_7, ScaleY=1, ScaleZ=1)  # -> Geometry, Transform
scale_nu_5 = ScaleNU(Geometry=move_15.Geometry, Plane=cluster_8.center_right, ScaleX=1, ScaleY=division_8, ScaleZ=1)  # -> Geometry, Transform
scale_nu_6 = ScaleNU(Geometry=move_16.Geometry, Plane=cluster_8.center_top, ScaleX=division_9, ScaleY=1, ScaleZ=1)  # -> Geometry, Transform
scale_nu_7 = ScaleNU(Geometry=move_17.Geometry, Plane=cluster_8.center_left, ScaleX=1, ScaleY=division_10, ScaleZ=1)  # -> Geometry, Transform
scale_nu_8 = ScaleNU(Geometry=move_18.Geometry, Plane=cluster_8.center, ScaleX=division_9, ScaleY=division_8, ScaleZ=1)  # -> Geometry, Transform

bottom_left_pt = Point(cluster_8.bottom_left)

# ---- group: Corners
mesh_7 = Mesh([move_4.Geometry, move_5.Geometry, move_6.Geometry, move_7.Geometry])

# ---- group: Sides
mesh_8 = Mesh([scale_nu_4.Geometry, scale_nu_6.Geometry, scale_nu_7.Geometry, scale_nu_5.Geometry])

# ---- group: Centers
mesh_9 = Mesh(scale_nu_8.Geometry)

# ----
mjoin_7 = MeshJoin(Meshes=flatten([mesh_7, mesh_8, mesh_9]))

# ---- group: Output Roof Mesh
mesh_10 = Mesh(flatten([move_3.Geometry, move_2.Geometry, mjoin_7, move.Geometry]))

# ----
# Move Roofs to Correct Position
clean = CleanTree(RemoveNulls=True, RemoveInvalid=True, RemoveEmpty=False, Tree=mesh_10)
freestanding_bool_7 = Boolean(freestanding_roof)
wall_height_3 = Number(wall_height)
dispatch_10 = Dispatch(List=clean, DispatchPattern=freestanding_bool_7)  # -> ListA, ListB
Z = UnitZ(Factor=wall_height_3)
move_19 = Move(Geometry=dispatch_10.ListB, Motion=Z)  # -> Geometry, Transform

double_story_bool_2 = Boolean(double_story)
dispatch_11 = Dispatch(List=[dispatch_10.ListA, move_19.Geometry], DispatchPattern=double_story_bool_2)  # -> ListA, ListB
clean_2 = CleanTree(RemoveNulls=True, RemoveInvalid=True, RemoveEmpty=False, Tree=dispatch_11.ListA)
bbox = BoundingBox(Content=clean_2, Plane=PlaneXY(0, 0, 0))  # -> Box, Box_2
medges = MeshEdges(Mesh=dispatch_11.ListA)  # -> flatten(NakedEdges), InteriorEdges, NonManifoldEdges
join = JoinCurves(Curves=medges.NakedEdges, Preserve=False)
debrep = DeconstructBrep(Brep=bbox.Box)  # -> Faces, Edges, Vertices
freestanding_bool_8 = Boolean(freestanding_roof)
slab_thickness_3 = Number(slab_thickness)
# Create Roofs for Double Story
panel = Panel("4")
dispatch_12 = Dispatch(List=join, DispatchPattern=freestanding_bool_8)  # -> ListA, ListB
item_2 = ListItem(List=debrep.Faces, Index=panel, Wrap=True)
item_3 = ListItem(List=debrep.Faces, Index="5", Wrap=True)
dispatch_13 = Dispatch(List=slab_thickness_3, DispatchPattern=freestanding_bool_8)  # -> ListA, ListB
edges = BrepEdges(Brep=item_2)  # -> Naked, Interior, NonManifold
addition = Addition(A=dispatch_13.ListA, B="1.5")
dispatch_14 = Dispatch(List=item_3, DispatchPattern=freestanding_bool_8)  # -> ListA, ListB
Z_2 = UnitZ(Factor=dispatch_13.ListB)
Z_3 = UnitZ(Factor=addition)
join_2 = JoinCurves(Curves=edges.Naked, Preserve=False)
move_20 = Move(Geometry=dispatch_14.ListB, Motion=Z_2)  # -> Geometry, Transform
move_21 = Move(Geometry=dispatch_14.ListA, Motion=Z_3)  # -> Geometry, Transform
freestanding_bool_9 = Boolean(freestanding_roof)
clean_3 = CleanTree(RemoveNulls=True, RemoveInvalid=True, RemoveEmpty=False, Tree=[move_21.Geometry, move_20.Geometry])
dispatch_15 = Dispatch(List=join_2, DispatchPattern=freestanding_bool_9)  # -> ListA, ListB
edges_2 = BrepEdges(Brep=clean_3)  # -> Naked, Interior, NonManifold
loft_opt = LoftOptions(Closed=False, Adjust=Toggle(True), Rebuild=0, Refit=0, Type=0)
join_3 = JoinCurves(Curves=edges_2.Naked, Preserve=False)
loft = Loft(Curves=flatten([dispatch_12.ListA, join_3]), Options=loft_opt)
loft_2 = Loft(
    Curves=[join_3, dispatch_15.ListB],
    Options={Adjust=False, Closed=False, LoftEnds=0, LoftSimp=0, LoftType=0, Rebuild=10, Refit=0.01})
clean_4 = CleanTree(
    RemoveNulls=True,
    RemoveInvalid=True,
    RemoveEmpty=False,
    Tree=[loft, clean_3, dispatch_11.ListB, loft_2, dispatch_11.ListA])  # -> flatten(Tree)

geo = Geometry(clean_4)

wall_height_4 = Number(wall_height)
planesrf_2 = PlaneSurface(Plane=Plane(origin=(0, 0, 0), x=(0, 0, 1), y=(1, 0, 0)), XSize=wall_height_4, YSize="2")
# Create Wall Library
debrep_2 = DeconstructBrep(Brep=planesrf_2)  # -> Faces, Edges, Vertices
bottom_left_pt_2 = Point(cluster_8.bottom_left)
item_4 = ListItem(List=debrep_2.Vertices, Index="0", Wrap=True)
vec2pt_13 = Vector2Pt(PointA=item_4, PointB=bottom_left_pt_2, Unitize=False)  # -> Vector, Length
move_22 = Move(Geometry=planesrf_2, Motion=vec2pt_13.Vector)  # -> Geometry, Transform
wall_panel = Surface(move_22.Geometry)
area = Area(Geometry=move_22.Geometry)  # -> Area, Centroid
panel_center = Point(area.Centroid)

bbox_2 = BoundingBox(Content=crv, Plane=PlaneXY(0, 0, 0))  # -> Box, Box_2
panel_center_2 = Point(area.Centroid)
area_2 = Area(Geometry=crv)  # -> Area, Centroid
dim_2 = Dimensions(Surface=bbox_2.Box)  # -> UDimension, VDimension
vec2pt_14 = Vector2Pt(PointA=area_2.Centroid, PointB=panel_center_2, Unitize=False)  # -> Vector, Length
door_height = Number(dim_2.VDimension)
devec = DeconstructVector(Vector=vec2pt_14.Vector)  # -> XComponent, YComponent, ZComponent
vec = VectorXYZ(XComponent=devec.XComponent, YComponent=devec.YComponent, ZComponent=0)  # -> Vector, Length
move_23 = Move(Geometry=crv, Motion=vec.Vector)  # -> Geometry, Transform
wall_panel_2 = Surface(move_22.Geometry)
rdiff = RegionDifference(CurvesA=wall_panel_2, CurvesB=move_23.Geometry)
boundary = BoundarySurfaces(Edges=rdiff)
door_panel = Surface(boundary)

bbox_3 = BoundingBox(Content=crv_3, Plane=PlaneXY(0, 0, 0), UnionBox=True)  # -> Box, Box_2
panel_center_3 = Point(area.Centroid)
area_3 = Area(Geometry=bbox_3.Box)  # -> Area, Centroid
vec2pt_15 = Vector2Pt(PointA=area_3.Centroid, PointB=panel_center_3, Unitize=False)  # -> Vector, Length
door_height_2 = Number(dim_2.VDimension)
dim_3 = Dimensions(Surface=bbox_3.Box)  # -> UDimension, VDimension
devec_2 = DeconstructVector(Vector=vec2pt_15.Vector)  # -> XComponent, YComponent, ZComponent
subtraction_7 = Subtraction(A=door_height_2, B=dim_3.VDimension)
vec_2 = VectorXYZ(XComponent=devec_2.XComponent, YComponent=devec_2.YComponent, ZComponent=subtraction_7)  # -> Vector, Length
move_24 = Move(Geometry=crv_3, Motion=vec_2.Vector)  # -> Geometry, Transform
wall_panel_3 = Surface(move_22.Geometry)
dim_x_13 = Number(dim_x_2)
series_7 = Series(Start=0, Step=2, Count=expr("x/2", dim_x_13))
rdiff_2 = RegionDifference(CurvesA=wall_panel_3, CurvesB=move_24.Geometry)
boundary_2 = BoundarySurfaces(Edges=rdiff_2)
X_4 = UnitX(Factor=series_7)
move_25 = Move(Geometry=boundary_2, Motion=X_4)  # -> Geometry, Transform

area_4 = Area(Geometry=crv_2)  # -> Area, Centroid
panel_center_4 = Point(area.Centroid)
bbox_4 = BoundingBox(Content=crv_2, Plane=PlaneXY(0, 0, 0))  # -> Box, Box_2
vec2pt_16 = Vector2Pt(PointA=area_4.Centroid, PointB=panel_center_4, Unitize=False)  # -> Vector, Length
dim_4 = Dimensions(Surface=bbox_4.Box)  # -> UDimension, VDimension
door_height_3 = Number(dim_2.VDimension)
devec_3 = DeconstructVector(Vector=vec2pt_16.Vector)  # -> XComponent, YComponent, ZComponent
subtraction_8 = Subtraction(A=door_height_3, B=dim_4.VDimension)
vec_3 = VectorXYZ(XComponent=devec_3.XComponent, YComponent=devec_3.YComponent, ZComponent=subtraction_8)  # -> Vector, Length
move_26 = Move(Geometry=crv_2, Motion=vec_3.Vector)  # -> Geometry, Transform
wall_panel_4 = Surface(move_22.Geometry)
dim_x_14 = Number(dim_x_2)
rdiff_3 = RegionDifference(CurvesA=wall_panel_4, CurvesB=move_26.Geometry)
series_8 = Series(Start=0, Step=2, Count=expr("x/2", dim_x_14))
boundary_3 = BoundarySurfaces(Edges=rdiff_3)
bottom_left_pt_3 = Point(cluster_8.bottom_left)
X_5 = UnitX(Factor=series_8)
dim_y_13 = Number(dim_y_2)
rotate_7 = Rotate(Geometry=boundary_3, Angle=1.570796327, Plane=bottom_left_pt_3)  # -> Geometry, Transform
move_27 = Move(Geometry=boundary_3, Motion=X_5)  # -> Geometry, Transform
Y_4 = UnitY(Factor=dim_y_13)
dim_y_14 = Number(dim_y_2)
move_28 = Move(Geometry=move_27.Geometry, Motion=Y_4)  # -> Geometry, Transform
series_9 = Series(Start=0, Step=2, Count=expr("x/2", dim_y_14))
Y_5 = UnitY(Factor=series_9)
move_29 = Move(Geometry=rotate_7.Geometry, Motion=Y_5)  # -> Geometry, Transform
dim_x_15 = Number(dim_x_2)
X_6 = UnitX(Factor=dim_x_15)
move_30 = Move(Geometry=move_29.Geometry, Motion=X_6)  # -> Geometry, Transform

# ---- group: All Windows
geo_2 = Geometry([move_25.Geometry, move_30.Geometry, move_29.Geometry, move_28.Geometry])

# ----
dispatch_16 = Dispatch(List=geo_2, DispatchPattern=freestanding_bool_6)  # -> ListA, ListB

door_position_3 = Number(door_position_2)
item_5 = ListItem(List=dispatch_16.ListB, Index=door_position_3, Wrap=True)
bbox_5 = BoundingBox(Content=item_5, Plane=PlaneXY(0, 0, 0))  # -> Box, Box_2
debrep_3 = DeconstructBrep(Brep=bbox_5.Box)  # -> Faces, Edges, Vertices
box_corners = BoxCorners(Box=bbox_5.Box)  # -> CornerA, CornerB, CornerC, CornerD, CornerE, CornerF, CornerG, CornerH
door_panel_2 = Surface(boundary)
debrep_4 = DeconstructBrep(Brep=door_panel_2)  # -> Faces, Edges, Vertices
vec2pt_17 = Vector2Pt(PointA=box_corners.CornerA, PointB=box_corners.CornerC, Unitize=False)  # -> Vector, Length
item_6 = ListItem(List=debrep_4.Vertices, Index="3", Wrap=True)
item_7 = ListItem(List=debrep_4.Vertices, Index=0, Wrap=True)
vec2pt_18 = Vector2Pt(PointA=item_6, PointB=item_7, Unitize=False)  # -> Vector, Length
door_position_4 = Number(door_position_2)
orient = OrientDirection(
    Geometry=door_panel_2,
    PointA=item_6,
    DirectionA=vec2pt_18.Vector,
    PointB=box_corners.CornerA,
    DirectionB=vec2pt_17.Vector)  # -> flatten(Geometry), Transform
replace = ReplaceItems(List=dispatch_16.ListB, Item=orient.Geometry, Indices=door_position_4, Wrap=False)

closed_wall_position_3 = Number(closed_wall_position_2)
item_8 = ListItem(List=dispatch_16.ListB, Index=closed_wall_position_3, Wrap=True)
bbox_6 = BoundingBox(Content=item_8, Plane=PlaneXY(0, 0, 0))  # -> Box, Box_2
box_corners_2 = BoxCorners(Box=bbox_6.Box)  # -> CornerA, CornerB, CornerC, CornerD, CornerE, CornerF, CornerG, CornerH
wall_panel_5 = Surface(move_22.Geometry)
debrep_5 = DeconstructBrep(Brep=wall_panel_5)  # -> Faces, Edges, Vertices
vec2pt_19 = Vector2Pt(PointA=box_corners_2.CornerA, PointB=box_corners_2.CornerC, Unitize=False)  # -> Vector, Length
pdecon = Deconstruct(Point=box_corners_2.CornerA)  # -> XComponent, YComponent, ZComponent
pdecon_2 = Deconstruct(Point=box_corners_2.CornerC)  # -> XComponent, YComponent, ZComponent
item_9 = ListItem(List=debrep_5.Vertices, Index="3", Wrap=True)
item_10 = ListItem(List=debrep_5.Vertices, Index=0, Wrap=True)
subtraction_9 = Subtraction(A=pdecon.YComponent, B=pdecon_2.YComponent)
equals_3 = Equality(FirstNumber=subtraction_9, SecondNumber="0")  # -> Equality, Inequality
dispatch_17 = Dispatch(List=item_9, DispatchPattern=equals_3.Equality)  # -> ListA, ListB
dispatch_18 = Dispatch(List=item_10, DispatchPattern=equals_3.Equality)  # -> ListA, ListB
vec2pt_20 = Vector2Pt(PointA=[dispatch_17.ListA, dispatch_18.ListB], PointB=[dispatch_17.ListB, dispatch_18.ListA], Unitize=False)  # -> Vector, Length
closed_wall_position_4 = Number(closed_wall_position_2)
orient_2 = OrientDirection(
    Geometry=wall_panel_5,
    PointA=item_10,
    DirectionA=vec2pt_20.Vector,
    PointB=box_corners_2.CornerA,
    DirectionB=vec2pt_19.Vector)  # -> flatten(Geometry), Transform
replace_2 = ReplaceItems(List=replace, Item=orient_2.Geometry, Indices=closed_wall_position_4, Wrap=False)

# ---- group: Adjust Input Sliders for Door Position
lng = ListLength(List=dispatch_16.ListB)  # -> expr("x-1", Length)
selobj = GetSelectedObjects(AllObjects_Object=[door_position, closed_wall_position])  # -> ComponentObjects, ParamObjects, OtherObjects
# Position Doors/Walls
set_slider = SetSliderProperties(Slider=selobj.ParamObjects, Range=lng)

# ----
clean_5 = CleanTree(RemoveNulls=True, RemoveInvalid=True, RemoveEmpty=False, Tree=[replace_2, geo])

# ---- group: Output Geometries
# Outputs
geo_3 = Geometry(clean_5)

# ----
bake = BakeGeometry(Bake=button, Geometry=geo_3, Attributes=createatts, DeleteOldBakes=False, PreserveTrees=False)

# ==== cluster Cluster
M = ClusterInput()
demesh = DeconstructMesh(Mesh=M)  # -> Vertices, Faces, Colours, Normals
pt = ConstructPoint(XCoordinate="-1000", YCoordinate="-1000", ZCoordinate=0)
pt_2 = ConstructPoint(XCoordinate="1000", YCoordinate="-1000", ZCoordinate=0)
pt_3 = ConstructPoint(XCoordinate="-1000", YCoordinate="1000", ZCoordinate=0)
pt_4 = ConstructPoint(XCoordinate="1000", YCoordinate="1000", ZCoordinate=0)
cp = ClosestPoint(Point=pt, Cloud=demesh.Vertices)  # -> ClosestPoint, CPIndex, Distance
cp_2 = ClosestPoint(Point=pt_2, Cloud=demesh.Vertices)  # -> ClosestPoint, CPIndex, Distance
cp_3 = ClosestPoint(Point=pt_3, Cloud=demesh.Vertices)  # -> ClosestPoint, CPIndex, Distance
cp_4 = ClosestPoint(Point=pt_4, Cloud=demesh.Vertices)  # -> ClosestPoint, CPIndex, Distance
bottom_right = ClusterOutput(cp_2.ClosestPoint)
top_left = ClusterOutput(cp_3.ClosestPoint)
top_right = ClusterOutput(cp_4.ClosestPoint)
bottom_left = ClusterOutput(cp.ClosestPoint)
addition = Addition(A=cp_4.ClosestPoint, B=cp_2.ClosestPoint)
addition_2 = Addition(A=cp_2.ClosestPoint, B=cp.ClosestPoint)
addition_3 = Addition(A=cp_3.ClosestPoint, B=cp_4.ClosestPoint)
addition_4 = Addition(A=cp.ClosestPoint, B=cp_3.ClosestPoint)
division = Division(A=addition, B=2)
division_2 = Division(A=addition_2, B=2)
division_3 = Division(A=addition_3, B=2)
division_4 = Division(A=addition_4, B=2)
addition_5 = Addition(A=division_3, B=division_2)
center_right = ClusterOutput(division)
center_bottom = ClusterOutput(division_2)
center_top = ClusterOutput(division_3)
center_left = ClusterOutput(division_4)
division_5 = Division(A=addition_5, B=2)
center = ClusterOutput(division_5)

# ==== cluster Cluster_2
M = ClusterInput()
demesh = DeconstructMesh(Mesh=M)  # -> Vertices, Faces, Colours, Normals
pt = ConstructPoint(XCoordinate="-1000", YCoordinate="-1000", ZCoordinate=0)
pt_2 = ConstructPoint(XCoordinate="1000", YCoordinate="-1000", ZCoordinate=0)
pt_3 = ConstructPoint(XCoordinate="-1000", YCoordinate="1000", ZCoordinate=0)
pt_4 = ConstructPoint(XCoordinate="1000", YCoordinate="1000", ZCoordinate=0)
cp = ClosestPoint(Point=pt, Cloud=demesh.Vertices)  # -> ClosestPoint, CPIndex, Distance
cp_2 = ClosestPoint(Point=pt_2, Cloud=demesh.Vertices)  # -> ClosestPoint, CPIndex, Distance
cp_3 = ClosestPoint(Point=pt_3, Cloud=demesh.Vertices)  # -> ClosestPoint, CPIndex, Distance
cp_4 = ClosestPoint(Point=pt_4, Cloud=demesh.Vertices)  # -> ClosestPoint, CPIndex, Distance
bottom_right = ClusterOutput(cp_2.ClosestPoint)
top_left = ClusterOutput(cp_3.ClosestPoint)
top_right = ClusterOutput(cp_4.ClosestPoint)
bottom_left = ClusterOutput(cp.ClosestPoint)
addition = Addition(A=cp_4.ClosestPoint, B=cp_2.ClosestPoint)
addition_2 = Addition(A=cp_2.ClosestPoint, B=cp.ClosestPoint)
addition_3 = Addition(A=cp_3.ClosestPoint, B=cp_4.ClosestPoint)
addition_4 = Addition(A=cp.ClosestPoint, B=cp_3.ClosestPoint)
division = Division(A=addition, B=2)
division_2 = Division(A=addition_2, B=2)
division_3 = Division(A=addition_3, B=2)
addition_5 = Addition(A=division_3, B=division_2)
division_4 = Division(A=addition_4, B=2)
division_5 = Division(A=addition_5, B=2)
center_right = ClusterOutput(division)
center_bottom = ClusterOutput(division_2)
center_top = ClusterOutput(division_3)
center_left = ClusterOutput(division_4)
center = ClusterOutput(division_5)

# ==== cluster Cluster_3
M = ClusterInput()
demesh = DeconstructMesh(Mesh=M)  # -> Vertices, Faces, Colours, Normals
pt = ConstructPoint(XCoordinate="-1000", YCoordinate="-1000", ZCoordinate=0)
pt_2 = ConstructPoint(XCoordinate="1000", YCoordinate="1000", ZCoordinate=0)
cp = ClosestPoint(Point=pt, Cloud=demesh.Vertices)  # -> ClosestPoint, CPIndex, Distance
cp_2 = ClosestPoint(Point=pt_2, Cloud=demesh.Vertices)  # -> ClosestPoint, CPIndex, Distance
addition = Addition(A=cp.ClosestPoint, B=cp_2.ClosestPoint)
division = Division(A=addition, B=2)
center = ClusterOutput(division)

# ==== cluster Cluster_4
M = ClusterInput()
pt = ConstructPoint(XCoordinate="-1000", YCoordinate="-1000", ZCoordinate=0)
demesh = DeconstructMesh(Mesh=M)  # -> Vertices, Faces, Colours, Normals
cp = ClosestPoint(Point=pt, Cloud=demesh.Vertices)  # -> ClosestPoint, CPIndex, Distance
bottom_left = ClusterOutput(cp.ClosestPoint)

# ==== cluster Cluster_5
B = ClusterInput()
debrep = DeconstructBrep(Brep=B)  # -> Faces, Edges, Vertices
pt = ConstructPoint(XCoordinate="-1000", YCoordinate="-1000", ZCoordinate=0)
cp = ClosestPoint(Point=pt, Cloud=debrep.Vertices)  # -> ClosestPoint, CPIndex, Distance
bottom_left = ClusterOutput(cp.ClosestPoint)
