# Grasshopper definition Roof iterations.gh (Grasshopper 1.0.7)
# plug-ins: Weaverbird, Kangaroo2 Components, karambaGH, Pufferfish, Wallacei

# ----
# VERSION
# OPEN SIDES
# RESET
number_slider = Slider(0, range=0..3)
# Loads
number_slider_2 = Slider(0.725, range=0.05..2)
# Edge length
number_slider_3 = Slider(0.31, range=0..1)

# ---- group: inputs
# Version
# SIDES CLOSED
# RESET
# Load
# edge length
edge_length = Slider(1, range=0..1)
number_slider_4 = Slider(1, range=0..6)
number_slider_5 = Slider(0, range=0..4)
button = Button()
number_slider_6 = Slider(3.037, range=0..5)
spring_strength = Slider(15, range=0..100)

# ---- group: Mesh creation
mesh = Mesh(<mesh referenced from the Rhino model>)
mesh_2 = Mesh(<mesh referenced from the Rhino model>)
mesh_3 = Mesh(<mesh referenced from the Rhino model>)
mesh_4 = Mesh(<mesh referenced from the Rhino model>)
weaverbird_s_catmull_clark_subdivision = WeaverbirdsCatmullClarkSubdivision(MeshCurves=mesh, Level=Slider(3, range=0..10), SmoothNakedEdges="0")
weaverbird_s_catmull_clark_subdivision_2 = WeaverbirdsCatmullClarkSubdivision(MeshCurves=mesh_2, Level=Slider(3, range=0..10), SmoothNakedEdges="0")
weaverbird_s_catmull_clark_subdivision_3 = WeaverbirdsCatmullClarkSubdivision(MeshCurves=mesh_4, Level=Slider(3, range=0..10), SmoothNakedEdges="0")
weaverbird_s_catmull_clark_subdivision_4 = WeaverbirdsCatmullClarkSubdivision(MeshCurves=mesh_3, Level=Slider(3, range=0..10), SmoothNakedEdges="0")

mesh_5 = Mesh(<mesh referenced from the Rhino model>)
mesh_6 = Mesh(<mesh referenced from the Rhino model>)
mesh_7 = Mesh(<mesh referenced from the Rhino model>)
mesh_8 = Mesh(<mesh referenced from the Rhino model>)
mesh_9 = Mesh(<mesh referenced from the Rhino model>)
mesh_10 = Mesh(<mesh referenced from the Rhino model>)
weaverbird_s_catmull_clark_subdivision_5 = WeaverbirdsCatmullClarkSubdivision(MeshCurves=mesh_6, Level=Slider(2, range=0..10), SmoothNakedEdges="0")
weaverbird_s_catmull_clark_subdivision_6 = WeaverbirdsCatmullClarkSubdivision(MeshCurves=mesh_7, Level=Slider(2, range=0..10), SmoothNakedEdges="0")
weaverbird_s_catmull_clark_subdivision_7 = WeaverbirdsCatmullClarkSubdivision(MeshCurves=mesh_8, Level=Slider(2, range=0..10), SmoothNakedEdges="0")
weaverbird_s_catmull_clark_subdivision_8 = WeaverbirdsCatmullClarkSubdivision(MeshCurves=mesh_5, Level=Slider(2, range=0..10), SmoothNakedEdges="0")
weaverbird_s_catmull_clark_subdivision_9 = WeaverbirdsCatmullClarkSubdivision(MeshCurves=mesh_9, Level=Slider(3, range=0..10), SmoothNakedEdges="0")
weaverbird_s_catmull_clark_subdivision_10 = WeaverbirdsCatmullClarkSubdivision(MeshCurves=mesh_10, Level=Slider(3, range=0..10), SmoothNakedEdges="0")

# ---- group: Stream gates
anchor_side = Curve(<curve referenced from the Rhino model>)
anchor_sides = Curve(<curve referenced from the Rhino model>)
anchor_sides_2 = Curve(<curve referenced from the Rhino model>)
anchor_side_2 = Curve(<curve referenced from the Rhino model>)
anchor_sides_2_2 = Curve(<curve referenced from the Rhino model>)
anchor_sides_2_3 = Curve(<curve referenced from the Rhino model>)
anchor_side_3 = Curve(<curve referenced from the Rhino model>)
anchor_side_2_2 = Curve(<curve referenced from the Rhino model>)
stream_gate = StreamGate(Stream=weaverbird_s_catmull_clark_subdivision_3, Gate=number_slider)  # -> Target0, Target1, Target2
stream_gate_2 = StreamGate(Stream=weaverbird_s_catmull_clark_subdivision_2, Gate=number_slider)  # -> Target0, Target1, Target2
stream_gate_3 = StreamGate(Stream=anchor_sides, Gate=number_slider)  # -> Target0, Target1, Target2
stream_gate_4 = StreamGate(Stream=anchor_sides_2, Gate=number_slider)  # -> Target0, Target1, Target2
stream_gate_5 = StreamGate(Stream=anchor_sides_2_2, Gate=number_slider)  # -> Target0, Target1, Target2
stream_gate_6 = StreamGate(Stream=anchor_sides_2_3, Gate=number_slider)  # -> Target0, Target1, Target2
stream_gate_7 = StreamGate(Stream=weaverbird_s_catmull_clark_subdivision_4, Gate=number_slider)  # -> Target0, Target1, Target2
stream_gate_8 = StreamGate(Stream=anchor_side, Gate=number_slider)  # -> Target0, Target1, Target2
stream_gate_9 = StreamGate(Stream=anchor_side_2, Gate=number_slider)  # -> Target0, Target1, Target2
stream_gate_10 = StreamGate(Stream=weaverbird_s_catmull_clark_subdivision, Gate=number_slider)  # -> Target0, Target1, Target2, Target3
stream_gate_11 = StreamGate(Stream=anchor_side_3, Gate=number_slider)  # -> Target0, Target1, Target2, Target3
stream_gate_12 = StreamGate(Stream=anchor_side_2_2, Gate=number_slider)  # -> Target0, Target1, Target2, Target3

stream_gate_13 = StreamGate(Stream=weaverbird_s_catmull_clark_subdivision_5, Gate=number_slider_4)  # -> Target0, Target1, Target2, Target3, Target4, Target5
stream_gate_14 = StreamGate(Stream=weaverbird_s_catmull_clark_subdivision_9, Gate=number_slider_4)  # -> Target0, Target1, Target2, Target3, Target4, Target5
stream_gate_15 = StreamGate(Stream=weaverbird_s_catmull_clark_subdivision_10, Gate=number_slider_4)  # -> Target0, Target1, Target2, Target3, Target4, Target5
stream_gate_16 = StreamGate(Stream=weaverbird_s_catmull_clark_subdivision_8, Gate=number_slider_4)  # -> Target0, Target1, Target2, Target3, Target4, Target5
stream_gate_17 = StreamGate(Stream=weaverbird_s_catmull_clark_subdivision_7, Gate=number_slider_4)  # -> Target0, Target1, Target2, Target3, Target4, Target5
stream_gate_18 = StreamGate(Stream=weaverbird_s_catmull_clark_subdivision_6, Gate=number_slider_4)  # -> Target0, Target1, Target2, Target3, Target4, Target5
anchor_curve1 = Curve(<curve referenced from the Rhino model>)
anchor_curve4 = Curve(<curve referenced from the Rhino model>)
anchor_curve1_2 = Curve(<curve referenced from the Rhino model>)
anchor_curve4_2 = Curve(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)
anchor_curve2 = Curve(<curve referenced from the Rhino model>)
anchor_curve3 = Curve(<curve referenced from the Rhino model>)
anchor_curve2_2 = Curve(<curve referenced from the Rhino model>)
anchor_curve3_2 = Curve(<curve referenced from the Rhino model>)
anchor_curve1_3 = Curve(<curve referenced from the Rhino model>)
anchor_curve3_3 = Curve(<curve referenced from the Rhino model>)
anchor_curve4_3 = Curve(<curve referenced from the Rhino model>)
anchor_curve2_3 = Curve(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)
anchor_curve1_4 = Curve(<curve referenced from the Rhino model>)
anchor_curve1_5 = Curve(<curve referenced from the Rhino model>)
anchor_curve3_4 = Curve(<curve referenced from the Rhino model>)
anchor_curve4_4 = Curve(<curve referenced from the Rhino model>)
anchor_curve1_6 = Curve(<curve referenced from the Rhino model>)
anchor_curve3_5 = Curve(<curve referenced from the Rhino model>)
anchor_curve4_5 = Curve(<curve referenced from the Rhino model>)
anchor_curve2_4 = Curve(<curve referenced from the Rhino model>)
anchor_curve2_5 = Curve(<curve referenced from the Rhino model>)
anchor_curve4_6 = Curve(<curve referenced from the Rhino model>)
anchor_curve2_6 = Curve(<curve referenced from the Rhino model>)
anchor_curve3_6 = Curve(<curve referenced from the Rhino model>)
stream_filter = StreamFilter(
    Gate=number_slider_5,
    Stream1=anchor_curve1,
    Stream2=[anchor_curve2, anchor_curve1],
    Stream3=[anchor_curve3, anchor_curve1, anchor_curve2],
    Stream4=[anchor_curve4, anchor_curve1, anchor_curve2, anchor_curve3])  # -> reverse(Stream)
stream_filter_2 = StreamFilter(
    Gate=number_slider_5,
    Stream1=anchor_curve1_2,
    Stream2=[anchor_curve2_2, anchor_curve1_2],
    Stream3=[anchor_curve3_2, anchor_curve1_2, anchor_curve2_2],
    Stream4=[anchor_curve4_2, anchor_curve1_2, anchor_curve2_2, anchor_curve3_2])
stream_filter_3 = StreamFilter(
    Gate=number_slider_5,
    Stream1=anchor_curve1_3,
    Stream2=[anchor_curve2_3, anchor_curve1_3],
    Stream3=[anchor_curve3_3, anchor_curve1_3, anchor_curve2_3],
    Stream4=[anchor_curve4_3, anchor_curve1_3, anchor_curve2_3, anchor_curve3_3])
stream_filter_4 = StreamFilter(
    Gate=number_slider_5,
    Stream1=anchor_curve1_5,
    Stream2=[anchor_curve2_4, anchor_curve1_5],
    Stream3=[anchor_curve3_4, anchor_curve1_5, anchor_curve2_4],
    Stream4=[anchor_curve4_4, anchor_curve1_5, anchor_curve2_4, anchor_curve3_4])  # -> reverse(Stream)
stream_filter_5 = StreamFilter(
    Gate=number_slider_5,
    Stream1=anchor_curve1_6,
    Stream2=[anchor_curve2_5, anchor_curve1_6],
    Stream3=[anchor_curve3_5, anchor_curve1_6, anchor_curve2_5],
    Stream4=[anchor_curve4_5, anchor_curve1_6, anchor_curve2_5, anchor_curve3_5])  # -> reverse(Stream)
stream_filter_6 = StreamFilter(
    Gate=number_slider_5,
    Stream1=anchor_curve1_4,
    Stream2=[anchor_curve2_6, anchor_curve1_4],
    Stream3=[anchor_curve3_6, anchor_curve1_4, anchor_curve2_6],
    Stream4=[anchor_curve4_6, anchor_curve1_4, anchor_curve2_6, anchor_curve3_6])
stream_gate_19 = StreamGate(Stream=stream_filter_2, Gate=number_slider_4)  # -> Target0, Target1, Target2, Target3, Target4, Target5
stream_gate_20 = StreamGate(Stream=stream_filter_3, Gate=number_slider_4)  # -> Target0, Target1, Target2, Target3, Target4, Target5
stream_gate_21 = StreamGate(Stream=stream_filter_4, Gate=number_slider_4)  # -> Target0, Target1, Target2, Target3, Target4, Target5
stream_gate_22 = StreamGate(Stream=stream_filter, Gate=number_slider_4)  # -> Target0, Target1, Target2, Target3, Target4, Target5
stream_gate_23 = StreamGate(Stream=stream_filter_6, Gate=number_slider_4)  # -> Target0, Target1, Target2, Target3, Target4, Target5
stream_gate_24 = StreamGate(Stream=stream_filter_5, Gate=number_slider_4)  # -> Target0, Target1, Target2, Target3, Target4, Target5

# ----
inputmesh = Mesh([stream_gate.Target1, stream_gate_2.Target0, stream_gate_7.Target2, stream_gate_10.Target3])

# ---- group: Walls
height_wall = Slider(2, range=0..10)  # disabled
anchor_curves = Curve([stream_gate_3.Target0, stream_gate_4.Target0])  # disabled
unit_z = UnitZ(Factor=-1)  # disabled
end_points = EndPoints(Curve=graft(anchor_curves))  # -> Start, End; disabled
line_sdl = LineSDL(Start=[end_points.Start, end_points.End], Direction=unit_z, Length=height_wall)  # disabled
end_points_2 = EndPoints(Curve=line_sdl)  # -> Start, End; disabled
flip_matrix = FlipMatrix(Data=end_points_2.End)  # disabled
flip_matrix_2 = FlipMatrix(Data=line_sdl)  # disabled
explode_tree = ExplodeTree(Data=flip_matrix)  # -> Branch0, Branch1; disabled
number_slider_7 = Slider(10, range=0..20)  # disabled
line = Line(StartPoint=explode_tree.Branch0, EndPoint=explode_tree.Branch1)  # disabled
explode_tree_2 = ExplodeTree(Data=flip_matrix_2)  # -> Branch0, Branch1; disabled
edge_surface = EdgeSurface(CurveA=anchor_curves, CurveB=explode_tree_2.Branch0, CurveC=explode_tree_2.Branch1, CurveD=line)  # disabled
divide_curve = DivideCurve(Curve=line, Count=number_slider_7, Kinks=False)  # -> Points, Tangents, Parameters; disabled
mesh_surface = MeshSurface(Surface=edge_surface, UCount=number_slider_7, VCount=number_slider_7, Overhang=True, Equalize=False)  # disabled

# ---- group: Butresses
point = Point(divide_curve.Points)  # disabled
panel = Panel("""true
false""")  # disabled
cull_pattern = CullPattern(List=point, CullPattern=panel)  # -> simplify(List); disabled
number_slider_8 = Slider(0.49, range=0..1)  # disabled
explode_tree_3 = ExplodeTree(Data=cull_pattern)  # -> Branch0, Branch1; disabled
yz_plane = YZPlane(Origin=explode_tree_3.Branch0)  # disabled
yz_plane_2 = YZPlane(Origin=explode_tree_3.Branch1)  # disabled
multiplication = Multiplication(A=number_slider_8, B=-1)  # disabled
rectangle = Rectangle(Plane=yz_plane_2, XSize=number_slider_8, YSize=height_wall, Radius=0)  # -> Rectangle, Length; disabled
rectangle_2 = Rectangle(Plane=yz_plane, XSize=multiplication, YSize=height_wall, Radius=0)  # -> Rectangle, Length; disabled
boundary_surfaces = BoundarySurfaces(Edges=rectangle_2.Rectangle)  # disabled
boundary_surfaces_2 = BoundarySurfaces(Edges=rectangle.Rectangle)  # disabled
mesh_surface_2 = MeshSurface(Surface=boundary_surfaces, UCount=5, VCount=number_slider_7, Overhang=True, Equalize=False)  # -> flatten(Mesh); disabled
mesh_surface_3 = MeshSurface(Surface=boundary_surfaces_2, UCount=5, VCount=number_slider_7, Overhang=True, Equalize=False)  # -> flatten(Mesh); disabled
meshcorners = MeshCorners(Mesh=graft(mesh_surface_3), Angle=2.35619449)  # disabled
meshcorners_2 = MeshCorners(Mesh=graft(mesh_surface_2), Angle=2.35619449)  # disabled
panel_2 = Panel("1")  # disabled
list_item = ListItem(List=meshcorners_2, Index=panel_2, Wrap=True)  # disabled
list_item_2 = ListItem(List=meshcorners, Index=0, Wrap=True)  # disabled

# ---- group: Anchor points
nakedvertices = NakedVertices(Mesh=inputmesh)  # -> ClothedIndex, NakedIndex, ClothedPts, NakedPts
point_2 = Point(nakedvertices.NakedPts)
curve_closest_point = CurveClosestPoint(Point=point_2, Curve=[stream_gate_5.Target1, stream_gate_3.Target0, stream_gate_8.Target2, stream_gate_11.Target3])  # -> Point, Parameter, Distance
curve_closest_point_2 = CurveClosestPoint(Point=point_2, Curve=[stream_gate_6.Target1, stream_gate_4.Target0, stream_gate_9.Target2, stream_gate_12.Target3])  # -> Point, Parameter, Distance
smaller_than = SmallerThan(FirstNumber=curve_closest_point.Distance, SecondNumber=Slider(0.5, range=0..1))  # -> SmallerThan, OrEqualTo
smaller_than_2 = SmallerThan(FirstNumber=curve_closest_point_2.Distance, SecondNumber=Slider(0.3, range=0..1))  # -> SmallerThan, OrEqualTo
dispatch = Dispatch(List=point_2, DispatchPattern=smaller_than.SmallerThan)  # -> ListA, ListB
dispatch_2 = Dispatch(List=point_2, DispatchPattern=smaller_than_2.SmallerThan)  # -> ListA, ListB
point_3 = Point([dispatch.ListA, dispatch_2.ListA])
member_index = MemberIndex(Set=point_2, Member=point_3)  # -> flatten(Index), Count
cull_index = CullIndex(List=point_2, Indices=member_index.Index, Wrap=True)
stream_gate_25 = StreamGate(Stream=cull_index, Gate=Toggle(True))  # -> Target0, Target1

# ----
meshcorners_3 = MeshCorners(Mesh=inputmesh, Angle=2.35619449)
vertexloads = VertexLoads(Mesh=inputmesh, Strength=number_slider_2)
edgelengths = EdgeLengths(Mesh=inputmesh, LengthFactor=number_slider_3, Strength=Slider(1.929, range=0..5))

# ---- group: Anchor point selection
join_curves = JoinCurves(
    Curves=[stream_gate_24.Target3, stream_gate_21.Target2, stream_gate_23.Target1, stream_gate_20.Target0, stream_gate_22.Target4, stream_gate_19.Target5],
    Preserve=False)
inputmesh_2 = Mesh([stream_gate_15.Target0, stream_gate_16.Target1, stream_gate_17.Target2, stream_gate_18.Target3, stream_gate_13.Target4, stream_gate_14.Target5])
meshcorners_4 = MeshCorners(Mesh=inputmesh_2, Angle=2.35619449)
nakedvertices_2 = NakedVertices(Mesh=inputmesh_2)  # -> ClothedIndex, NakedIndex, ClothedPts, NakedPts
point_4 = Point(nakedvertices_2.NakedPts)
curve_closest_point_3 = CurveClosestPoint(Point=point_4, Curve=join_curves)  # -> Point, Parameter, Distance
smaller_than_3 = SmallerThan(FirstNumber=curve_closest_point_3.Distance, SecondNumber=Slider(0.5, range=0..1))  # -> SmallerThan, OrEqualTo
dispatch_3 = Dispatch(List=point_4, DispatchPattern=smaller_than_3.SmallerThan)  # -> ListA, ListB
point_5 = Point([meshcorners_4, dispatch_3.ListA])
point_6 = Point(dispatch_3.ListB)
clean_tree = CleanTree(RemoveNulls=True, RemoveInvalid=True, RemoveEmpty=True, Tree=point_6)

# ----
point_7 = Point(flatten([cull_index, meshcorners_3]))
deconstruct = Deconstruct(Point=point_7)  # -> XComponent, YComponent, ZComponent

# ---- group: Loads and springs
vertexloads_2 = VertexLoads(Mesh=inputmesh_2, Strength=number_slider_6)
edgelengths_2 = EdgeLengths(Mesh=inputmesh_2, LengthFactor=edge_length, Strength=spring_strength)

# ----
sort_list = SortList(Keys=deconstruct.XComponent, ValuesValuesA=point_7)  # -> Keys, ValuesValuesA

# ---- group: Z Anchor
anchorxyz = AnchorXYZ(Point=clean_tree, X=False, Y=False, Z=Toggle(True), Strength=Slider(4, range=0..10))
clean_tree_2 = CleanTree(RemoveNulls=True, RemoveInvalid=True, RemoveEmpty=True, Tree=anchorxyz)

# ---- group: Anchors
boolean_toggle = BooleanToggle(True)
anchor = Anchor(Point=[stream_gate_25.Target0, meshcorners_3], Strength=10000)
anchorxyz_2 = AnchorXYZ(Point=sort_list.ValuesValuesA, X=boolean_toggle, Y=boolean_toggle, Z=False, Strength=1000)

# ---- group: Anchor
closest_points = ClosestPoints(Point=point_5, Cloud=point_4, Count=Slider(3, range=0..10))  # -> ClosestPoint, CPIndex, Distance
anchor_2 = Anchor(Point=[point_5, closest_points.ClosestPoint], Strength=10000)

# ----
split_list = SplitList(List=sort_list.ValuesValuesA, Index="9")  # -> ListA, ListB

# ---- group: XY Anchor
boolean_toggle_2 = BooleanToggle(True)
stream_gate_26 = StreamGate(Stream=point_4, Gate=number_slider_5)  # -> Target0, Target1, Target2, Target3, Target4
anchorxyz_3 = AnchorXYZ(Point=[clean_tree, stream_gate_26.Target0], X=boolean_toggle_2, Y=boolean_toggle_2, Z=False, Strength=1000)
clean_tree_3 = CleanTree(RemoveNulls=True, RemoveInvalid=True, RemoveEmpty=True, Tree=anchorxyz_3)

# ---- group: Solver
show = Show(G=inputmesh_2)
merge = Merge(Data1=show, Data2=anchor_2, Data3=vertexloads_2, Data4=edgelengths_2, Data5=clean_tree_3, Data6=clean_tree_2)
solver = Solver(GoalObjects=merge, Reset=button, Threshold=1e-15, Tolerance=0.01, On=True)  # -> I, V, O
tree_item = TreeItem(Tree=solver.O, Path="0;0", Index=0, Wrap=True)

# ----
anchorxyz_4 = AnchorXYZ(Point=point_3, X=boolean_toggle, Y=boolean_toggle, Z=False, Strength=Slider(75, range=0..1000))
anchorxyz_5 = AnchorXYZ(Point=sort_list.ValuesValuesA, X=False, Y=False, Z=Toggle(True), Strength=Slider(1, range=0..10))

# ---- group: Solver\
show_2 = Show(G=inputmesh)
merge_2 = Merge(
    Data1=show_2,
    Data2=anchor,
    Data3=vertexloads,
    Data4=edgelengths,
    Data5=anchorxyz_2,
    Data6=anchorxyz_4,
    Data7=anchorxyz_5)
solver_2 = Solver(GoalObjects=merge_2, Reset=Button(), Threshold=1e-15, Tolerance=0.01, On=True)  # -> I, V, O
tree_item_2 = TreeItem(Tree=solver_2.O, Path="0;0", Index=0, Wrap=True)

# ----
point_8 = Point(split_list.ListA)
point_9 = Point(stream_gate_26.Target0)

# ---- group: Failed optimisation with wallicei / Material selection
panel_3 = Panel("32")  # disabled
panel_4 = Panel("earth")  # disabled
panel_5 = Panel("adobe")  # disabled
panel_6 = Panel("80")  # disabled
panel_7 = Panel("19")  # disabled
panel_8 = Panel("40")  # disabled
material_properties_karamba3d = MaterialPropertiesKaramba3D(
    FamilyOfMaterial=panel_4,
    Name=panel_5,
    YoungsModulus_kN_cm2=panel_6,
    InPlaneShearModulus_kN_cm2=panel_3,
    TransverseShearModulus_kN_cm2=panel_3,
    SpecificWeight_kN_m3=panel_7,
    CoefficientOfThermalExpansion_1_C=1e-05,
    YieldStrength_kN_cm2=panel_8,
    mode="Isotrop")  # disabled

# ---- group: Failed optimisation with wallicei
mesh_11 = Mesh(tree_item)  # disabled
deconstruct_mesh = DeconstructMesh(Mesh=mesh_11)  # -> Vertices, Faces, Colours, Normals; disabled
number_slider_9 = Slider(100, range=10..100)  # disabled
panel_9 = Panel("S")  # disabled
mesh_to_shell_karamba3d = MeshToShellKaramba3D(Mesh=mesh_11, Identifier=panel_9, LimitDistance_m=0.005)  # -> Element, Points, Info; disabled

# ---- group: Failed optimisation with wallicei / Loads
panel_10 = Panel("10")  # disabled
mesh_naked_edges = MeshNakedEdges(Mesh=mesh_11)  # -> Naked, ResultBoolean; disabled
unit_z_2 = UnitZ(Factor=panel_10)  # disabled
unit_y = UnitY(Factor=1)  # disabled
extrude = Extrude(Base=mesh_naked_edges.Naked, Direction=unit_z_2)  # disabled
weaverbird_s_mesh_edges = WeaverbirdsMeshEdges(MeshOrPolylines=mesh_11)  # disabled
face_boundaries = FaceBoundaries(Mesh=mesh_11)  # -> graft(Boundaries); disabled
line_sdl_2 = LineSDL(Start=deconstruct_mesh.Vertices, Direction=unit_y, Length=100)  # disabled
cap_holes_ex = CapHolesEx(Brep=extrude)  # -> Brep, Caps, Solid; disabled
boundary_surfaces_3 = BoundarySurfaces(Edges=weaverbird_s_mesh_edges)  # disabled
brep_join = BrepJoin(Breps=boundary_surfaces_3)  # -> Breps, Closed; disabled
brep_curve = BrepCurve(Brep=brep_join.Breps, Curve=line_sdl_2)  # -> Curves, Points; disabled
list_length = ListLength(List=brep_curve.Points)  # disabled
panel_11 = Panel(list_length)  # disabled
smaller_than_4 = SmallerThan(FirstNumber=list_length, SecondNumber=1)  # -> flatten(SmallerThan), OrEqualTo; disabled
number_slider_10 = Slider(3.5, range=0..10)  # disabled
number_slider_11 = Slider(1.02, range=0..10)  # disabled
number_slider_12 = Slider(0, range=0..10)  # disabled
unit_z_3 = UnitZ(Factor=number_slider_10)  # disabled
cull_pattern_2 = CullPattern(List=deconstruct_mesh.Vertices, CullPattern=flatten(smaller_than_4.SmallerThan))  # disabled
unit_z_4 = UnitZ(Factor=number_slider_11)  # disabled
panel_12 = Panel(smaller_than_4.SmallerThan)  # disabled
unit_y_2 = UnitY(Factor=number_slider_12)  # disabled
loads_karamba3d = LoadsKaramba3D(
    Vector=expr("x*-1", unit_z_3),
    Mesh=mesh_11,
    LCase=0,
    mode="MeshLoad -Const.",
    menu=[buttons(off, on, off), buttons(on, on)])  # disabled
loads_karamba3d_2 = LoadsKaramba3D(Vector=expr("x*-1", unit_z_4), LCase=0, mode="Gravity")  # disabled
loads_karamba3d_3 = LoadsKaramba3D(ForceVector=unit_y_2, Local=False, PosInd=cull_pattern_2, LCase=0, mode="Point")  # disabled
load_karamba3d = LoadKaramba3D([loads_karamba3d_2, loads_karamba3d_3, loads_karamba3d])  # disabled

# ---- group: Failed optimisation with wallicei / Cross section
panel_13 = Panel("Shell 1")  # disabled
panel_14 = Panel("40")  # disabled
cross_section_karamba3d = CrossSectionKaramba3D(
    FamilyNameOfCrossSection=panel_13,
    NameOfCrossSection=graft(""),
    Material=material_properties_karamba3d,
    Height_cm=graft(number_slider_9),
    mode="Shell - Const")  # -> flatten(CrossSection); disabled
panel_15 = Panel("S")  # disabled

# ---- group: Failed optimisation with wallicei / Supports
nakedvertices_3 = NakedVertices(Mesh=mesh_11)  # -> ClothedIndex, NakedIndex, ClothedPts, NakedPts; disabled
point_10 = Point(nakedvertices_3.NakedPts)  # disabled
meshcorners_5 = MeshCorners(Mesh=mesh_11, Angle=2.35619449)  # disabled
deconstruct_2 = Deconstruct(Point=point_10)  # -> XComponent, YComponent, ZComponent; disabled
support_karamba3d = SupportKaramba3D(PosInd=meshcorners_5, menu=[buttons(on, on, on, off, off, off)])  # disabled
sort_list_2 = SortList(Keys=deconstruct_2.ZComponent, ValuesValuesA=point_10)  # -> Keys, ValuesValuesA; disabled
panel_16 = Panel("38")  # disabled
split_list_2 = SplitList(List=sort_list_2.ValuesValuesA, Index=panel_16)  # -> ListA, ListB; disabled
cull_duplicates = CullDuplicates(Points=point_10, Tolerance=0.1, CullMode=3)  # -> Points, Indices, Valence; disabled
support_karamba3d_2 = SupportKaramba3D(PosInd=cull_duplicates.Points, menu=[buttons(on, on, on, off, off, off)])  # disabled
support_karamba3d_3 = SupportKaramba3D(support_karamba3d_2)  # disabled

# ---- group: Failed optimisation with wallicei (continued)
assemble_model_karamba3d = AssembleModelKaramba3D(
    Elem=flatten(mesh_to_shell_karamba3d.Element),
    Support=flatten(support_karamba3d_3),
    Load=flatten(load_karamba3d),
    CrossSection=cross_section_karamba3d,
    LimitDistance_m=0.005)  # -> Model, Info, Mass_kg, CenterOfGravity; disabled
analyze_karamba3d = AnalyzeKaramba3D(Model=assemble_model_karamba3d.Model)  # -> CalculatedModel, MaximumDisplacement_cm, ResultingForceOfGravity_kN, ElasticEnergy_kNm; disabled

# ---- group: Failed optimisation with wallicei / Optimisation
panel_17 = Panel("1")  # disabled
optimize_cross_section_karamba3d = OptimizeCrossSectionKaramba3D(
    Model=assemble_model_karamba3d.Model,
    MaximumUtilization=1,
    MaximumDisplacement_cm=panel_17,
    UltimateLimitStateIterations=5,
    DisplacementIterations=5,
    NumberOfSamplePoints=3,
    ElasticDesign=True,
    GammaM0=1,
    GammaM1=1)  # -> ModelWithOptimizedCrossSections, Info, Mass_kg, MaximumDisplacement_cm, ElasticEnergy_kNm; disabled
panel_18 = Panel(optimize_cross_section_karamba3d.MaximumDisplacement_cm)  # disabled

# ---- group: Failed optimisation with wallicei / Visualisation
model_view_karamba3d = ModelViewKaramba3D(Model=analyze_karamba3d.CalculatedModel, ResultFactors=1, ResultCase=-1)  # -> Model, DeformedMesh, DeformedAxes, DeformedModel; disabled
shell_view_karamba3d = ShellViewKaramba3D(Model=model_view_karamba3d.Model, IndexOfLayer=0)  # -> Model, MeshesOfRenderedShells, LegendColors, LegendTags; disabled
legend = Legend(Colour=shell_view_karamba3d.LegendColors, Tags=shell_view_karamba3d.LegendTags, LegendType=1)  # disabled

# ---- group: Failed optimisation with wallicei (continued)
wlc_minimize_mass = Number(optimize_cross_section_karamba3d.Mass_kg)  # disabled
wlc_minimize_displacement = Number(optimize_cross_section_karamba3d.MaximumDisplacement_cm)  # disabled
panel_19 = Panel(optimize_cross_section_karamba3d.Info)  # disabled
panel_20 = Panel(optimize_cross_section_karamba3d.ModelWithOptimizedCrossSections)  # disabled
shell_view_karamba3d_2 = ShellViewKaramba3D(Model=model_view_karamba3d.Model, IndexOfLayer=0)  # -> Model, MeshesOfRenderedShells, LegendColors, LegendTags; disabled
shell_forces_karamba3d = ShellForcesKaramba3D(AnalyzedModel=shell_view_karamba3d.Model, LCase=0, mode="Principal")  # -> AnalyzedModel, FirstPrincipalNormalForce_kN_m, SecondPrincipalNormalForce_kN_m, FirstPrincipalMoment_kNm_m, SecondPrincipalMoment_kNm_m, ShearForceInLocalXDirection_kN_m, ShearForceInLocalYDirection_kN_m; disabled
beso_for_shells_karamba3d = BESOForShellsKaramba3D(
    Model=shell_view_karamba3d.Model,
    LCases=0,
    MaxIter=10,
    ER=-1,
    ARmax=0.05,
    Nhist=3,
    Conv=0.01,
    Rmin=-1,
    Rexp=1,
    KillThick=1e-05)  # -> BSEOModel, ModelHistory, CHistory, VHistory, Info; disabled
utilization_of_elements_karamba3d = UtilizationOfElementsKaramba3D(AnalyzedModel=shell_view_karamba3d.Model, ResultCase=-1, mode="Shells")  # -> AnalyzedModel, Utilization; disabled
sort_list_3 = SortList(Keys=shell_forces_karamba3d.FirstPrincipalNormalForce_kN_m)  # -> reverse(Keys), ValuesValuesA; disabled
sort_list_4 = SortList(Keys=shell_forces_karamba3d.SecondPrincipalNormalForce_kN_m)  # -> reverse(Keys), ValuesValuesA; disabled
sort_list_5 = SortList(Keys=shell_forces_karamba3d.FirstPrincipalMoment_kNm_m)  # -> reverse(Keys), ValuesValuesA; disabled
sort_list_6 = SortList(Keys=shell_forces_karamba3d.SecondPrincipalMoment_kNm_m)  # -> Keys, ValuesValuesA; disabled
sort_list_7 = SortList(Keys=shell_forces_karamba3d.ShearForceInLocalXDirection_kN_m)  # -> Keys, ValuesValuesA; disabled
sort_list_8 = SortList(Keys=shell_forces_karamba3d.ShearForceInLocalYDirection_kN_m)  # -> reverse(Keys), ValuesValuesA; disabled
list_item_3 = ListItem(List=sort_list_3.Keys, Index=0, Wrap=True)  # disabled
list_item_4 = ListItem(List=sort_list_4.Keys, Index=0, Wrap=True)  # -> flatten(Item); disabled
list_item_5 = ListItem(List=sort_list_5.Keys, Index=0, Wrap=True)  # disabled
list_item_6 = ListItem(List=sort_list_6.Keys, Index=0, Wrap=True)  # disabled
list_item_7 = ListItem(List=sort_list_7.Keys, Index=0, Wrap=True)  # disabled
list_item_8 = ListItem(List=sort_list_8.Keys, Index=0, Wrap=True)  # disabled
panel_21 = Panel(list_item_5)  # disabled
panel_22 = Panel(list_item_6)  # disabled
panel_23 = Panel(list_item_8)  # disabled
panel_24 = Panel(list_item_3)  # disabled
max_tension = Panel(list_item_4)  # disabled
panel_25 = Panel(list_item_7)  # disabled
multiplication_2 = Multiplication(A=max_tension, B=-1)  # disabled
wlc_minimize_tension = Number(multiplication_2)  # disabled
wallacei_x = WallaceiX(
    Objectives=[wlc_minimize_tension, wlc_minimize_mass, wlc_minimize_displacement],
    allFitness="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",
    allFrontIdx="0|5;0|34;0|35;0|45;1|4;1|5;1|6;1|7;1|8;1|9",
    allGenomes="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",
    curFrontIdx="2|0;2|1;2|2;2|3;2|4;2|5;2|6;2|7;2|8;2|9",
    curFrontIdxSave="0|3;0|5;0|20;0|34;0|35;0|45;1|0;1|1;1|2;1|3;1|4;1|5;1|6;1|7;1|8;1|9;2|0;2|1;2|2;2|3;2|4;2|5;2|6;2|7;2|8;2|9",
    popGen="50,100",
    total="133891",
    wlcDone=True)  # -> WallaceiGenomes, FitnessValues, Data, Phenotypes; disabled
