# Grasshopper definition KARAMBA calculations.gh (Grasshopper 1.0.7)
# plug-ins: karambaGH, Pufferfish, Kangaroo2 Components, MetaHopper, Weaverbird

# ---- group: theatre roof with nubian vaults and walls
mesh = Mesh([<mesh referenced from the Rhino model> x6])
group_toggle = GroupToggle(ToggleActive=True, ToggleVisible=False)  # disabled
mesh_2 = Mesh([<mesh referenced from the Rhino model> x7])
brep = Brep([<brep referenced from the Rhino model> x38])
brep_2 = Brep([<brep referenced from the Rhino model> x16])
meshcorners = MeshCorners(Mesh=mesh, Angle=2.35619449)
meshcorners_2 = MeshCorners(Mesh=mesh_2, Angle=2.35619449)
weighted_catmull_clark_subdivision = WeightedCatmullClarkSubdivision(M=brep, L="0", E="0", DF=0, TE=1, TV=1)  # -> out, A; inputs M: Mesh, DF: list, TE: list, TV: list
# ---------- weighted_catmull_clark_subdivision: VB ----------
    Component.Params.Input(0).Name = "Mesh"
    Component.Params.Input(0).Description = "An open or closed mesh composed of either triangle or quad based faces"
    Component.Params.Input(1).Name = "Loops"
    Component.Params.Input(1).Description = "The number of iterations applied to each face"
    Component.Params.Input(2).Name = "Edge Type"
    Component.Params.Input(2).Description = "0=Fixed, 1=Smooth, 2=Fixed Corners"
    Component.Params.Input(3).Name = "Face Distance [Vertex]"
    Component.Params.Input(3).Description = "An optional list of double values which overides the distance the new faced based vertex will be offset along the face normal (0=Default)"
    Component.Params.Input(4).Name = "Edge Weight [Vertex]"
    Component.Params.Input(4).Description = "An optional list of double values which overides the percent between the existing edge midpoint and the new smoothed vertex (1=Default)"
    Component.Params.Input(5).Name = "Vertex Weight [Vertex]"
    Component.Params.Input(5).Description = "An optional list of double values which overides the percent between the existing vertex and the new smoothed vertex (1=Default)"

    Component.Params.Output(1).Name = "Mesh"
    Component.Params.Output(1).Description = "If successful, a valid mesh"

    If m IsNot Nothing Then
      Dim ma As New mesh
      Dim i,lp As Integer
      Dim txV,txE,txF As New list(Of Double)
      Dim xV(),xE(),xF() As Double
      Dim bn As Boolean
      Dim cb As Boolean

      'input mesh to the looped mesh
      m.weld(math.pi)
      ma = m

      ' match multiplier and color values to vertex count
      xV = TV.toarray()
      xE = TE.toarray()
      xF = DF.toarray()
      For i = 0 To m.Vertices.count() - 1 Step 1
        txV.add(xV(bC(xV, i)))
        txE.add(xE(bC(xE, i)))
        txF.add(xF(bC(xF, i)))
      Next
      xV = txV.toarray()
      xE = txE.toarray()
      xF = txF.toarray()

      bn = m.IsClosed() = False

      For lp = 0 To L - 1 Step 1

        Dim mv As Rhino.Geometry.Collections.MeshVertexList
        Dim mf As Rhino.Geometry.Collections.MeshFaceList
        Dim mfn As Rhino.Geometry.Collections.MeshFaceNormalList
        Dim mc As Rhino.Geometry.Collections.MeshVertexColorList
        Dim mte As Rhino.Geometry.Collections.MeshTopologyEdgeList
        Dim mtv As Rhino.Geometry.Collections.MeshTopologyVertexList
        Dim mnv() As Boolean
        Dim nes As New list(Of Boolean)

        If ma.VertexColors.Count() > 0 Then
          cb = True
        Else
          cb = False
          ma.VertexColors.CreateMonotoneMesh(color.LightBlue)
        End If

        mv = ma.Vertices
        mf = ma.Faces
        mfn = ma.FaceNormals
        mc = ma.VertexColors
        mte = ma.TopologyEdges
        mtv = ma.TopologyVertices

        mnv = ma.GetNakedEdgePointStatus

        Dim vo As New list(Of point3d)
        Dim fo As New list(Of MeshFace)
        Dim j,k,u,v,cf,ce,cv As Integer
        Dim fi() As Integer
        Dim p(4) As point3d
        Dim mvi(3) As Integer
        Dim nrm As vector3d
        Dim av,ae,af As Double
        Dim rv,re,rf As New list(Of Double)
        Dim tc As color
        Dim oc As New list(Of color)

        cv = mv.count()
        ce = mte.count()
        cf = mf.count()

        'Faces
        For i = 0 To cf - 1 Step 1
          fi = mtv.IndicesFromFace(i)
          mvi(0) = mtv.MeshVertexIndices(fi(0))(0)
          mvi(1) = mtv.MeshVertexIndices(fi(1))(0)
          mvi(2) = mtv.MeshVertexIndices(fi(2))(0)
          If mf(i).IsQuad() Then mvi(3) = mtv.MeshVertexIndices(fi(3))(0)

          If mf(i).IsQuad() Then
            fo.add(New meshface(i, cF + mte.GetEdgeIndex(fi(0), fi(1)), cE + cF + mvi(1), cF + mte.GetEdgeIndex(fi(1), fi(2))))
            fo.add(New meshface(cF + mte.GetEdgeIndex(fi(1), fi(2)), cE + cF + mvi(2), cF + mte.GetEdgeIndex(fi(2), fi(3)), i))
            fo.add(New meshface(cE + cF + mvi(3), cF + mte.GetEdgeIndex(fi(3), fi(0)), i, cF + mte.GetEdgeIndex(fi(2), fi(3))))
            fo.add(New meshface(cF + mte.GetEdgeIndex(fi(0), fi(1)), i, cF + mte.GetEdgeIndex(fi(3), fi(0)), cE + cF + mvi(0)))
            av = (xV(mvi(0)) + xV(mvi(1)) + xV(mvi(2)) + xV(mvi(3))) / 4
            ae = (xE(mvi(0)) + xE(mvi(1)) + xE(mvi(2)) + xE(mvi(3))) / 4
            af = (xF(mvi(0)) + xF(mvi(1)) + xF(mvi(2)) + xF(mvi(3))) / 4
            tc = avgC4(mc(mvi(0)), mc(mvi(1)), mc(mvi(2)), mc(mvi(3)))
          Else
            fo.add(New meshface(i, cF + mte.GetEdgeIndex(fi(0), fi(1)), cE + cF + mvi(1), cF + mte.GetEdgeIndex(fi(1), fi(2))))
            fo.add(New meshface(cF + mte.GetEdgeIndex(fi(1), fi(2)), cE + cF + mvi(2), cF + mte.GetEdgeIndex(fi(2), fi(0)), i))
            fo.add(New meshface(cE + cF + mvi(0), cF + mte.GetEdgeIndex(fi(0), fi(1)), i, cF + mte.GetEdgeIndex(fi(2), fi(0))))
            av = (xV(mvi(0)) + xV(mvi(1)) + xV(mvi(2))) / 3
            ae = (xE(mvi(0)) + xE(mvi(1)) + xE(mvi(2))) / 3
            af = (xF(mvi(0)) + xF(mvi(1)) + xF(mvi(2))) / 3
            tc = avgC3(mc(mvi(0)), mc(mvi(1)), mc(mvi(2)))
          End If
          nrm = mfn(i)
          nrm.Unitize()
          vo.add(mf.getfacecenter(i) + nrm * af)
          rv.add(av)
          re.add(ae)
          rf.add(af)
          oc.add(tc)
        Next

        'Edges
        For i = 0 To ce - 1 Step 1

          u = mtv.MeshVertexIndices(mte.GetTopologyVertices(i).I)(0)
          v = mtv.MeshVertexIndices(mte.GetTopologyVertices(i).J)(0)
          p(0) = mv.item(u)
          p(1) = mv.item(v)

          If mte.GetConnectedFaces(i).Count() > 1 Then
            p(2) = mf.GetFaceCenter(mte.GetConnectedFaces(i)(0))
            p(3) = mf.GetFaceCenter(mte.GetConnectedFaces(i)(1))
            p(4) = evalP((p(0) + p(1)) / 2, ( p(2) + p(3)) / 2, (xE(u) / 2 + xE(v) / 2) / 2)
            nes.add(False)
          Else
            p(4) = (p(0) + p(1)) / 2
            nes.add(True)
          End If

          vo.add(p(4))
          rv.add((xV(u) + xV(v)) / 2)
          re.add((xE(u) + xE(v)) / 2)
          rf.add((xF(u) + xF(v)) / 2)
          oc.add(avgC2(mc(u), mc(v)))
        Next

        'Vertices
        For i = 0 To cv - 1 Step 1
          Dim zf,zn As Integer
          Dim cvi As New list(Of Integer)
          Dim q(6) As point3d
          Dim bne As Boolean = False
          q(4) = New point3d(mv(i))

          zf = mv.GetVertexFaces(i).count()
          For j = 0 To zf - 1 Step 1
            q(0) += mF.GetFaceCenter(mV.GetVertexFaces(i)(j))
          Next
          q(0) /= zf

          cvi = mv.GetConnectedVertices(i).ToList()
          cvi.remove(i)
          k = cvi.count()
          zn = 0
          For j = 0 To k - 1 Step 1
            u = mte.GetEdgeIndex(mtv.TopologyVertexIndex(cvi.item((j))), mtv.TopologyVertexIndex(i))
            q(1) = mv.item(mtv.MeshVertexIndices(mte.GetTopologyVertices(u).I)(0))
            q(2) = mv.item(mtv.MeshVertexIndices(mte.GetTopologyVertices(u).J)(0))
            q(3) += (q(1) + q(2)) / 2

            If nes(u) Then
              bne = True
              q(5) += (q(1) + q(2)) / 2
              zn += 1
            End If
          Next
          q(3) /= k

          If bne Then
            If e = 1 Then
              q(6) = (q(4) + q(5) / zn) / 2
            ElseIf e = 2 Then
              If k = 2 Then
                q(6) = q(4)
              Else
                q(6) = evalP(q(4), (q(4) + q(5) / zn) / 2, xV(i))
              End If
            Else
              q(6) = q(4)
            End If
          Else
            q(6) = evalP(q(4), (q(4) * ((zf - 3) / zf)) + (q(3) * (2 / zf)) + (q(0) * (1 / zf)), xV(i))
          End If

          vo.add(q(6))
          rv.add(xV(i))
          re.add(xE(i))
          rf.add(xF(i))
          oc.add(mc(i))

        Next

        Dim mo As New mesh
        mo.Vertices.AddVertices(vo)
        mo.Faces.AddFaces(fo)
        If cb Then mo.VertexColors.AppendColors(oc.toarray())
        mo.FaceNormals.ComputeFaceNormals()
        mo.Normals.ComputeNormals()

        ma = mo
        xV = rv.toarray()
        xE = re.toarray()
        xF = rf.toarray()

        'Loop
      Next
      
      A = ma
    End If
# ---------- weighted_catmull_clark_subdivision: VB additional code ----------
  Private Function bC(ByVal arrObj() As Double, ByVal t As Integer)
    Dim intOut As Integer
    If t > uBound(arrObj) Then intOut = uBound(arrObj) Else intOut = t
    Return intOut
  End Function

  Private Function evalP(ByVal op As point3d, ByVal tp As Point3d, ByVal t As Double)
    Return New point3d(op + (tp - op) * t)
  End Function

  Private Function avgC2(ByVal c0 As color, ByVal c1 As color)
    Dim r,g,b As Integer
    r = CInt(((CInt(c0.R) + CInt(c1.R)) / 2))
    g = CInt(((CInt(c0.G) + CInt(c1.G)) / 2))
    b = CInt(((CInt(c0.B) + CInt(c1.B)) / 2))

    If R < 0 Then r = 0 Else If r > 255 Then r = 255
    If G < 0 Then g = 0 Else If r > 255 Then g = 255
    If B < 0 Then b = 0 Else If r > 255 Then b = 255

    Return color.FromArgb(r, g, b)
  End Function

  Private Function avgC3(ByVal c0 As color, ByVal c1 As color, ByVal c2 As color)
    Dim r,g,b As Integer
    r = CInt((CInt(c0.R) + CInt(c1.R) + CInt(c2.R)) / 3)
    g = CInt((CInt(c0.G) + CInt(c1.G) + CInt(c2.G)) / 3)
    b = CInt((CInt(c0.B) + CInt(c1.B) + CInt(c2.B)) / 3)

    If R < 0 Then r = 0 Else If r > 255 Then r = 255
    If G < 0 Then g = 0 Else If r > 255 Then g = 255
    If B < 0 Then b = 0 Else If r > 255 Then b = 255

    Return color.FromArgb(r, g, b)
  End Function

  Private Function avgC4(ByVal c0 As color, ByVal c1 As color, ByVal c2 As color, ByVal c3 As color)
    Dim r,g,b As Integer
    r = CInt((CInt(c0.R) + CInt(c1.R) + CInt(c2.R) + CInt(c3.R)) / 4)
    g = CInt((CInt(c0.G) + CInt(c1.G) + CInt(c2.G) + CInt(c3.G)) / 4)
    b = CInt((CInt(c0.B) + CInt(c1.B) + CInt(c2.B) + CInt(c3.B)) / 4)

    If R < 0 Then r = 0 Else If r > 255 Then r = 255
    If G < 0 Then g = 0 Else If r > 255 Then g = 255
    If B < 0 Then b = 0 Else If r > 255 Then b = 255

    Return color.FromArgb(r, g, b)
  End Function
# ---------- end weighted_catmull_clark_subdivision ----------
weighted_catmull_clark_subdivision_2 = WeightedCatmullClarkSubdivision(M=brep_2, L="0", E="0", DF=0, TE=1, TV=1)  # -> out, A; inputs M: Mesh, DF: list, TE: list, TV: list; same code as weighted_catmull_clark_subdivision
meshcorners_3 = MeshCorners(Mesh=weighted_catmull_clark_subdivision.A, Angle=2.35619449)  # -> flatten(Corners)
mesh_3 = Mesh(weighted_catmull_clark_subdivision.A)
meshcorners_4 = MeshCorners(Mesh=weighted_catmull_clark_subdivision_2.A, Angle=2.35619449)  # -> flatten(Corners)
mesh_4 = Mesh(weighted_catmull_clark_subdivision_2.A)
deconstruct = Deconstruct(Point=meshcorners_3)  # -> XComponent, YComponent, ZComponent
deconstruct_2 = Deconstruct(Point=meshcorners_4)  # -> XComponent, YComponent, ZComponent
sort_list = SortList(Keys=deconstruct.ZComponent, ValuesA=meshcorners_3)  # -> Keys, ValuesA
sort_list_2 = SortList(Keys=deconstruct_2.ZComponent, ValuesValuesA=meshcorners_4)  # -> Keys, ValuesValuesA
split_list = SplitList(List=sort_list.ValuesA, Index=Slider(146, range=0..150))  # -> ListA, ListB
split_list_2 = SplitList(List=sort_list_2.ValuesValuesA, Index=Slider(68, range=0..150))  # -> ListA, ListB
point = Point(split_list.ListA)
point_2 = Point(split_list_2.ListB)
cull_duplicates = CullDuplicates(Points=flatten([point, meshcorners, meshcorners_2]), Tolerance=0.1, CullMode=3)  # -> Points, Indices, Valence
cull_duplicates_2 = CullDuplicates(Points=point_2, Tolerance=0.1, CullMode=3)  # -> Points, Indices, Valence

# ----
# mesh roof
group_toggle_2 = GroupToggle(ToggleActive=True, ToggleVisible=False)  # disabled
mesh_5 = Mesh([<mesh referenced from the Rhino model> x8])  # disabled
rebuild_mesh = RebuildMesh(
    Mesh=mesh_5,
    RebuildNormals=True,
    CullUnused=False,
    UnifyNormals=True,
    FlipNormals=False,
    IdenticalCombine=False,
    WeldVertices=0)  # disabled

# ---- group: theatre roof with nubian vaults
# mesh roof
group_toggle_3 = GroupToggle(ToggleActive=True, ToggleVisible=False)  # disabled
mesh_6 = Mesh([<mesh referenced from the Rhino model> x8])  # disabled
rebuild_mesh_2 = RebuildMesh(
    Mesh=mesh_6,
    RebuildNormals=True,
    CullUnused=False,
    UnifyNormals=True,
    FlipNormals=False,
    IdenticalCombine=False,
    WeldVertices=0)  # disabled

# ---- group: make walls
mesh_7 = Mesh([<mesh referenced from the Rhino model> x3])  # disabled
mesh_naked_edges = MeshNakedEdges(Mesh=mesh_7)  # -> Naked, ResultBoolean; disabled
meshcorners_5 = MeshCorners(Mesh=mesh_7, Angle=2.35619449)  # disabled
panel = Panel("1")  # disabled
panel_2 = Panel("2")  # disabled
curve_closest_point = CurveClosestPoint(Point=meshcorners_5, Curve=mesh_naked_edges.Naked)  # -> Point, Parameter, Distance; disabled
list_item = ListItem(List=meshcorners_5, Index=panel, Wrap=True)  # disabled
list_item_2 = ListItem(List=meshcorners_5, Index=panel_2, Wrap=True)  # disabled
shatter = Shatter(Curve=mesh_naked_edges.Naked, Parameters=curve_closest_point.Parameter)  # disabled
number_slider = Slider(1, range=0..3)  # disabled
line = Line(StartPoint=list_item, EndPoint=list_item_2)  # -> simplify(Line); disabled
list_item_3 = ListItem(List=shatter, Index=number_slider, Wrap=True)  # -> simplify(Item); disabled
join_curves = JoinCurves(Curves=[list_item_3, line], Preserve=False)  # disabled
boundary_surfaces = BoundarySurfaces(Edges=join_curves)  # disabled
mesh_brep = MeshBrep(
    Brep=boundary_surfaces,
    Settings={GridMaxCount=0, GridMinCount=16, JaggedSeams=False, MaxEdgeLength=0, MinEdgeLength=0.0001, MinTolerance=0, Refine=True, RefineAngle=0, RelativeTolerance=0.65, SimplePlanes=True, Tolerance=0})  # disabled
panel_3 = Panel("0")  # disabled
panel_4 = Panel("2")  # disabled
weaverbird_s_catmull_clark_subdivision = WeaverbirdsCatmullClarkSubdivision(MeshCurves=mesh_brep, Level=panel_4, SmoothNakedEdges=panel_3)  # disabled

# ---- group: theatre roof with nubian vaults / make walls
mesh_8 = Mesh([<mesh referenced from the Rhino model> x3])  # disabled
mesh_naked_edges_2 = MeshNakedEdges(Mesh=mesh_8)  # -> Naked, ResultBoolean; disabled
meshcorners_6 = MeshCorners(Mesh=mesh_8, Angle=2.35619449)  # disabled
panel_5 = Panel("1")  # disabled
panel_6 = Panel("2")  # disabled
curve_closest_point_2 = CurveClosestPoint(Point=meshcorners_6, Curve=mesh_naked_edges_2.Naked)  # -> Point, Parameter, Distance; disabled
list_item_4 = ListItem(List=meshcorners_6, Index=panel_5, Wrap=True)  # disabled
list_item_5 = ListItem(List=meshcorners_6, Index=panel_6, Wrap=True)  # disabled
shatter_2 = Shatter(Curve=mesh_naked_edges_2.Naked, Parameters=curve_closest_point_2.Parameter)  # disabled
number_slider_2 = Slider(1, range=0..3)  # disabled
line_2 = Line(StartPoint=list_item_4, EndPoint=list_item_5)  # -> simplify(Line); disabled
list_item_6 = ListItem(List=shatter_2, Index=number_slider_2, Wrap=True)  # -> simplify(Item); disabled
join_curves_2 = JoinCurves(Curves=[list_item_6, line_2], Preserve=False)  # disabled
boundary_surfaces_2 = BoundarySurfaces(Edges=join_curves_2)  # disabled
mesh_brep_2 = MeshBrep(
    Brep=boundary_surfaces_2,
    Settings={GridMaxCount=0, GridMinCount=16, JaggedSeams=False, MaxEdgeLength=0, MinEdgeLength=0.0001, MinTolerance=0, Refine=True, RefineAngle=0, RelativeTolerance=0.65, SimplePlanes=True, Tolerance=0})  # disabled
panel_7 = Panel("2")  # disabled
panel_8 = Panel("0")  # disabled
weaverbird_s_catmull_clark_subdivision_2 = WeaverbirdsCatmullClarkSubdivision(MeshCurves=mesh_brep_2, Level=panel_7, SmoothNakedEdges=panel_8)  # disabled

# ---- group: theatre roof with nubian vaults and walls / Theatre roof
# mesh roof
mesh_9 = Mesh([<mesh referenced from the Rhino model> x24])
rebuild_mesh_3 = RebuildMesh(
    Mesh=mesh_9,
    RebuildNormals=True,
    CullUnused=False,
    UnifyNormals=True,
    FlipNormals=False,
    IdenticalCombine=False,
    WeldVertices=0)

# ---- group: 8x4 with walls
# shell
# ribs
# walls
# Buttresses
mesh_10 = Mesh([<mesh referenced from the Rhino model> x16])  # disabled
mesh_11 = Mesh([<mesh referenced from the Rhino model> x12])  # disabled
mesh_12 = Mesh(<mesh referenced from the Rhino model>)  # disabled
mesh_13 = Mesh([<mesh referenced from the Rhino model> x2])  # disabled
group_toggle_4 = GroupToggle(ToggleActive=True, ToggleVisible=False)  # disabled

# ---- group: theatre roof with nubian vaults / Supports
mesh_14 = Mesh([<mesh referenced from the Rhino model> x16])  # disabled
rebuild_mesh_4 = RebuildMesh(
    Mesh=mesh_14,
    RebuildNormals=True,
    CullUnused=False,
    UnifyNormals=True,
    FlipNormals=False,
    IdenticalCombine=False,
    WeldVertices=0)  # disabled
nakedvertices = NakedVertices(Mesh=rebuild_mesh_2)  # -> ClothedIndex, NakedIndex, ClothedPts, NakedPts; disabled
nakedvertices_2 = NakedVertices(Mesh=rebuild_mesh_4)  # -> ClothedIndex, NakedIndex, ClothedPts, NakedPts; disabled
deconstruct_3 = Deconstruct(Point=nakedvertices.NakedPts)  # -> XComponent, YComponent, ZComponent; disabled
deconstruct_4 = Deconstruct(Point=nakedvertices_2.NakedPts)  # -> XComponent, YComponent, ZComponent; disabled
number_slider_3 = Slider(18, range=0..100)  # disabled
sort_list_3 = SortList(Keys=deconstruct_4.ZComponent, ValuesValuesA=nakedvertices_2.NakedPts)  # -> Keys, ValuesValuesA; disabled
number_slider_4 = Slider(18, range=0..100)  # disabled
sort_list_4 = SortList(Keys=deconstruct_3.ZComponent, ValuesValuesA=nakedvertices.NakedPts)  # -> Keys, ValuesValuesA; disabled
split_list_3 = SplitList(List=sort_list_3.ValuesValuesA, Index=number_slider_3)  # -> ListA, ListB; disabled
split_list_4 = SplitList(List=sort_list_4.ValuesValuesA, Index=number_slider_4)  # -> ListA, ListB; disabled
point_3 = Point(split_list_3.ListA)  # disabled
point_4 = Point(split_list_4.ListA)  # disabled
cull_duplicates_3 = CullDuplicates(Points=flatten([point_4, point_3]), Tolerance=0.1, CullMode=3)  # -> flatten(Points), Indices, Valence; disabled

# ---- group: transportation cells
# shell
# ribs
mesh_15 = Mesh(<mesh referenced from the Rhino model>)  # disabled
mesh_16 = Mesh([<mesh referenced from the Rhino model> x7])  # disabled
group_toggle_5 = GroupToggle(ToggleActive=True, ToggleVisible=False)  # disabled

# ---- group: 6x6 Dome
# shell
# ribs
mesh_17 = Mesh(<mesh referenced from the Rhino model>)  # disabled
mesh_18 = Mesh([<mesh referenced from the Rhino model> x2])  # disabled
group_toggle_6 = GroupToggle(ToggleActive=True, ToggleVisible=False)  # disabled

# ---- group: 8x4 vault
# shell
# ribs
mesh_19 = Mesh(<mesh referenced from the Rhino model>)  # disabled
mesh_20 = Mesh([<mesh referenced from the Rhino model> x2])  # disabled
group_toggle_7 = GroupToggle(ToggleActive=True, ToggleVisible=False)  # disabled

# ---- group: transportation cells / supports
meshcorners_7 = MeshCorners(Mesh=mesh_16, Angle=2.35619449)  # -> flatten(Corners); disabled
deconstruct_5 = Deconstruct(Point=meshcorners_7)  # -> XComponent, YComponent, ZComponent; disabled
number_slider_5 = Slider(22, range=0..26)  # disabled
sort_list_5 = SortList(Keys=deconstruct_5.ZComponent, ValuesValuesA=meshcorners_7)  # -> Keys, ValuesValuesA; disabled
split_list_5 = SplitList(List=sort_list_5.ValuesValuesA, Index=number_slider_5)  # -> ListA, ListB; disabled
point_5 = Point(split_list_5.ListA)  # disabled
cull_duplicates_4 = CullDuplicates(Points=point_5, Tolerance=0.1, CullMode=3)  # -> Points, Indices, Valence; disabled

# ---- group: 6x6 Dome / supports
meshcorners_8 = MeshCorners(Mesh=mesh_18, Angle=2.8)  # -> flatten(Corners); disabled
nakedvertices_3 = NakedVertices(Mesh=mesh_17)  # -> ClothedIndex, NakedIndex, ClothedPts, NakedPts; disabled
meshcorners_9 = MeshCorners(Mesh=mesh_17, Angle=2.35619449)  # disabled
deconstruct_6 = Deconstruct(Point=meshcorners_8)  # -> XComponent, YComponent, ZComponent; disabled
point_6 = Point(nakedvertices_3.NakedPts)  # disabled
number_slider_6 = Slider(22, range=0..26)  # disabled
sort_list_6 = SortList(Keys=deconstruct_6.ZComponent, ValuesValuesA=meshcorners_8)  # -> Keys, ValuesValuesA; disabled
find_similar_member = FindSimilarMember(Data=meshcorners_9, Set=point_6)  # -> Hit, Index; disabled
cull_index = CullIndex(List=point_6, Indices=find_similar_member.Index, Wrap=True)  # disabled
split_list_6 = SplitList(List=sort_list_6.ValuesValuesA, Index=number_slider_6)  # -> ListA, ListB; disabled
point_7 = Point(split_list_6.ListA)  # disabled
cull_duplicates_5 = CullDuplicates(Points=flatten([point_7, cull_index]), Tolerance=0.1, CullMode=3)  # -> Points, Indices, Valence; disabled

# ---- group: 8x4 vault / supports
meshcorners_10 = MeshCorners(Mesh=mesh_20, Angle=3)  # -> flatten(Corners); disabled
nakedvertices_4 = NakedVertices(Mesh=mesh_19)  # -> ClothedIndex, NakedIndex, ClothedPts, NakedPts; disabled
meshcorners_11 = MeshCorners(Mesh=mesh_19, Angle=2.35619449)  # disabled
deconstruct_7 = Deconstruct(Point=meshcorners_10)  # -> XComponent, YComponent, ZComponent; disabled
point_8 = Point(nakedvertices_4.NakedPts)  # disabled
number_slider_7 = Slider(22, range=0..26)  # disabled
sort_list_7 = SortList(Keys=deconstruct_7.ZComponent, ValuesValuesA=meshcorners_10)  # -> Keys, ValuesValuesA; disabled
find_similar_member_2 = FindSimilarMember(Data=meshcorners_11, Set=point_8)  # -> Hit, Index; disabled
cull_index_2 = CullIndex(List=point_8, Indices=find_similar_member_2.Index, Wrap=True)  # disabled
split_list_7 = SplitList(List=sort_list_7.ValuesValuesA, Index=number_slider_7)  # -> ListA, ListB; disabled
point_9 = Point(split_list_7.ListA)  # disabled
cull_duplicates_6 = CullDuplicates(Points=flatten([point_9, cull_index_2]), Tolerance=0.1, CullMode=3)  # -> Points, Indices, Valence; disabled

# ---- group: 8x4 with walls / support
nakedvertices_5 = NakedVertices(Mesh=mesh_10)  # -> ClothedIndex, NakedIndex, ClothedPts, NakedPts; disabled
meshcorners_12 = MeshCorners(Mesh=mesh_11, Angle=2.35619449)  # disabled
deconstruct_8 = Deconstruct(Point=meshcorners_12)  # -> XComponent, YComponent, ZComponent; disabled
deconstruct_9 = Deconstruct(Point=nakedvertices_5.NakedPts)  # -> XComponent, YComponent, ZComponent; disabled
number_slider_8 = Slider(4, range=0..10)  # disabled
number_slider_9 = Slider(5, range=0..10)  # disabled
sort_list_8 = SortList(Keys=deconstruct_8.ZComponent, ValuesValuesA=meshcorners_12)  # -> Keys, ValuesValuesA; disabled
sort_list_9 = SortList(Keys=deconstruct_9.ZComponent, ValuesValuesA=nakedvertices_5.NakedPts)  # -> Keys, ValuesValuesA; disabled
split_list_8 = SplitList(List=sort_list_8.ValuesValuesA, Index=number_slider_8)  # -> ListA, ListB; disabled
split_list_9 = SplitList(List=sort_list_9.ValuesValuesA, Index=number_slider_9)  # -> ListA, ListB; disabled
point_10 = Point(split_list_8.ListA)  # disabled
point_11 = Point(split_list_9.ListA)  # disabled
cull_duplicates_7 = CullDuplicates(Points=flatten([point_11, point_10]), Tolerance=0.1, CullMode=3)  # -> Points, Indices, Valence; disabled

# ---- group: support walls
nakedvertices_6 = NakedVertices(Mesh=weaverbird_s_catmull_clark_subdivision)  # -> ClothedIndex, NakedIndex, ClothedPts, NakedPts; disabled
deconstruct_10 = Deconstruct(Point=nakedvertices_6.NakedPts)  # -> XComponent, YComponent, ZComponent; disabled
number_slider_10 = Slider(5, range=0..100)  # disabled
sort_list_10 = SortList(Keys=deconstruct_10.ZComponent, ValuesValuesA=nakedvertices_6.NakedPts)  # -> Keys, ValuesValuesA; disabled
split_list_10 = SplitList(List=sort_list_10.ValuesValuesA, Index=number_slider_10)  # -> ListA, ListB; disabled
point_12 = Point(split_list_10.ListA)  # disabled
cull_duplicates_8 = CullDuplicates(Points=flatten(point_12), Tolerance=0.1, CullMode=3)  # -> Points, Indices, Valence; disabled

# ---- group: Supports
mesh_21 = Mesh([<mesh referenced from the Rhino model> x16])  # disabled
rebuild_mesh_5 = RebuildMesh(
    Mesh=mesh_21,
    RebuildNormals=True,
    CullUnused=False,
    UnifyNormals=True,
    FlipNormals=False,
    IdenticalCombine=False,
    WeldVertices=0)  # disabled
nakedvertices_7 = NakedVertices(Mesh=rebuild_mesh)  # -> ClothedIndex, NakedIndex, ClothedPts, NakedPts; disabled
nakedvertices_8 = NakedVertices(Mesh=rebuild_mesh_5)  # -> ClothedIndex, NakedIndex, ClothedPts, NakedPts; disabled
deconstruct_11 = Deconstruct(Point=nakedvertices_7.NakedPts)  # -> XComponent, YComponent, ZComponent; disabled
deconstruct_12 = Deconstruct(Point=nakedvertices_8.NakedPts)  # -> XComponent, YComponent, ZComponent; disabled
number_slider_11 = Slider(18, range=0..100)  # disabled
sort_list_11 = SortList(Keys=deconstruct_12.ZComponent, ValuesValuesA=nakedvertices_8.NakedPts)  # -> Keys, ValuesValuesA; disabled
number_slider_12 = Slider(18, range=0..100)  # disabled
sort_list_12 = SortList(Keys=deconstruct_11.ZComponent, ValuesValuesA=nakedvertices_7.NakedPts)  # -> Keys, ValuesValuesA; disabled
split_list_11 = SplitList(List=sort_list_11.ValuesValuesA, Index=number_slider_11)  # -> ListA, ListB; disabled
split_list_12 = SplitList(List=sort_list_12.ValuesValuesA, Index=number_slider_12)  # -> ListA, ListB; disabled
point_13 = Point(split_list_11.ListA)  # disabled
point_14 = Point(split_list_12.ListA)  # disabled
cull_duplicates_9 = CullDuplicates(Points=flatten([point_14, point_13, point_12]), Tolerance=0.1, CullMode=3)  # -> Points, Indices, Valence; disabled

# ---- group: theatre roof with nubian vaults / support walls
nakedvertices_9 = NakedVertices(Mesh=weaverbird_s_catmull_clark_subdivision_2)  # -> ClothedIndex, NakedIndex, ClothedPts, NakedPts; disabled
deconstruct_13 = Deconstruct(Point=nakedvertices_9.NakedPts)  # -> XComponent, YComponent, ZComponent; disabled
number_slider_13 = Slider(5, range=0..100)  # disabled
sort_list_13 = SortList(Keys=deconstruct_13.ZComponent, ValuesValuesA=nakedvertices_9.NakedPts)  # -> Keys, ValuesValuesA; disabled
split_list_13 = SplitList(List=sort_list_13.ValuesValuesA, Index=number_slider_13)  # -> ListA, ListB; disabled
point_15 = Point(split_list_13.ListA)  # disabled
cull_duplicates_10 = CullDuplicates(Points=flatten(point_15), Tolerance=0.1, CullMode=3)  # -> Points, Indices, Valence; disabled

# ----
# material properties
adobe_density_kg_m3 = Panel("1500")
youngs_module_mpa = Panel("150")
expression = Expression(d=adobe_density_kg_m3, Expression="d*0.01")
expression_2 = Expression(E=youngs_module_mpa, Expression="E/10")
panel_9 = Panel(expression)
material_properties_karamba3d = MaterialPropertiesKaramba3D(
    FamilyOfMaterial="Adobe",
    Name="Adobe",
    YoungsModulus_kN_cm2=expression_2,
    InPlaneShearModulus_kN_cm2=expr("x/2.5", expression_2),
    TransverseShearModulus_kN_cm2=8076,
    SpecificWeight_kN_m3=panel_9,
    CoefficientOfThermalExpansion_1_C=1e-05,
    YieldStrength_kN_cm2="0.030",
    mode="Isotrop")

# ----
# Butresses
number_slider_14 = Slider(64, range=0..100)
mesh_wall = Mesh(mesh_10)
cross_section_karamba3d = CrossSectionKaramba3D(
    FamilyNameOfCrossSection="DefaultCroSec",
    ElementIdentifier="Butresses",
    Material=material_properties_karamba3d,
    Height_cm=number_slider_14,
    mode="Shell - Const")
mesh_to_shell_karamba3d = MeshToShellKaramba3D(Mesh=mesh_wall, Identifier="Butresses", CrossSection=cross_section_karamba3d, LimitDistance_m=0.005)  # -> Element, Points, Info

panel_10 = Panel("0")  # disabled

# ---- group: Gravity
loads = LoadsKaramba3D(Vector=Vector(0, 0, -1), LCase="0", mode="Gravity")

# ---- group: 12x12 ceiling
# simplyfied mesh shell
# simplyfied mesh ribs
group_toggle_8 = GroupToggle(ToggleActive=True, ToggleVisible=False)  # disabled
brep_3 = Brep([<brep referenced from the Rhino model> x20])  # disabled
brep_4 = Brep([<brep referenced from the Rhino model> x30])  # disabled

# ---- group: 12x12 ceiling / remeshing shell
mesh_brep_3 = MeshBrep(
    Brep=brep_3,
    Settings={GridMaxCount=0, GridMinCount=16, JaggedSeams=False, MaxEdgeLength=0, MinEdgeLength=0.0001, MinTolerance=0, Refine=True, RefineAngle=0, RelativeTolerance=0.65, SimplePlanes=True, Tolerance=0})  # disabled
panel_11 = Panel("2")  # disabled
panel_12 = Panel("0")  # disabled
weighted_catmull_clark_subdivision_3 = WeightedCatmullClarkSubdivision(M=mesh_brep_3, L=panel_11, E=panel_12, DF=0, TE=1, TV=1)  # -> out, A; inputs M: Mesh, DF: list, TE: list, TV: list; disabled; same code as weighted_catmull_clark_subdivision

# ---- group: 12x12 ceiling / Support rib
mesh_brep_4 = MeshBrep(
    Brep=brep_4,
    Settings={GridMaxCount=0, GridMinCount=16, JaggedSeams=False, MaxEdgeLength=0, MinEdgeLength=0.0001, MinTolerance=0, Refine=True, RefineAngle=0, RelativeTolerance=0.65, SimplePlanes=True, Tolerance=0})  # disabled
meshcorners_13 = MeshCorners(Mesh=mesh_brep_4, Angle=2.35619449)  # disabled

# ---- group: 12x12 ceiling / support shell
mesh_join = MeshJoin(Meshes=weighted_catmull_clark_subdivision_3.A)  # disabled
nakedvertices_10 = NakedVertices(Mesh=mesh_join)  # -> ClothedIndex, NakedIndex, ClothedPts, NakedPts; disabled
point_16 = Point(nakedvertices_10.NakedPts)  # disabled
deconstruct_14 = Deconstruct(Point=point_16)  # -> XComponent, YComponent, ZComponent; disabled
number_slider_15 = Slider(62, range=0..100)  # disabled
sort_list_14 = SortList(Keys=deconstruct_14.ZComponent, ValuesValuesA=point_16)  # -> Keys, ValuesValuesA; disabled
split_list_14 = SplitList(List=sort_list_14.ValuesValuesA, Index=number_slider_15)  # -> ListA, ListB; disabled
point_17 = Point(split_list_14.ListA)  # disabled

# ---- group: 12x12 ceiling (continued)
cull_duplicates_11 = CullDuplicates(Points=flatten([meshcorners_13, point_17]), Tolerance=0.1, CullMode=3)  # -> Points, Indices, Valence; disabled

# ----
# Ribs
# Mesh ribs
mesh_wall_2 = Mesh([mesh_16, mesh_18, mesh_20, mesh_13, mesh_brep_4, mesh, mesh_2])
cross_section_karamba3d_2 = CrossSectionKaramba3D(
    FamilyNameOfCrossSection="DefaultCroSec",
    ElementIdentifier="exterior walls",
    Material=material_properties_karamba3d,
    Height_cm=Slider(32, range=0..100),
    mode="Shell - Const")
mesh_to_shell_karamba3d_2 = MeshToShellKaramba3D(Mesh=mesh_wall_2, Identifier="exterior walls", CrossSection=cross_section_karamba3d_2, LimitDistance_m=0.005)  # -> Element, Points, Info

# ---- group: Theatre roof
# mesh roof
# mesh walls
group_toggle_9 = GroupToggle(ToggleActive=True, ToggleVisible=False)  # disabled
mesh_22 = Mesh([<mesh referenced from the Rhino model> x24])  # disabled
rebuild_mesh_6 = RebuildMesh(
    Mesh=mesh_22,
    RebuildNormals=False,
    CullUnused=False,
    UnifyNormals=False,
    FlipNormals=False,
    IdenticalCombine=False,
    WeldVertices=0)  # disabled
meshcorners_14 = MeshCorners(Mesh=rebuild_mesh_6, Angle=2.35619449)  # -> flatten(Corners); disabled
point_18 = Point(meshcorners_14)  # disabled
cull_duplicates_12 = CullDuplicates(Points=point_18, Tolerance=0.1, CullMode=3)  # -> Points, Indices, Valence; disabled
panel_13 = Panel("""3
2""")  # disabled

# ---- group: Theatre roof / make walls
mesh_23 = Mesh(<mesh referenced from the Rhino model>)  # disabled
mesh_24 = Mesh([<mesh referenced from the Rhino model> x2])  # disabled
mesh_25 = Mesh(<mesh referenced from the Rhino model>)  # disabled
mesh_26 = Mesh([<mesh referenced from the Rhino model> x2])  # disabled
mesh_27 = Mesh(<mesh referenced from the Rhino model>)  # disabled
mesh_naked_edges_3 = MeshNakedEdges(Mesh=mesh_27)  # -> Naked, ResultBoolean; disabled
mesh_naked_edges_4 = MeshNakedEdges(Mesh=mesh_23)  # -> Naked, ResultBoolean; disabled
mesh_naked_edges_5 = MeshNakedEdges(Mesh=mesh_25)  # -> Naked, ResultBoolean; disabled
mesh_naked_edges_6 = MeshNakedEdges(Mesh=mesh_26)  # -> Naked, ResultBoolean; disabled
mesh_naked_edges_7 = MeshNakedEdges(Mesh=mesh_24)  # -> Naked, ResultBoolean; disabled
meshcorners_15 = MeshCorners(Mesh=mesh_27, Angle=2.35619449)  # disabled
meshcorners_16 = MeshCorners(Mesh=mesh_26, Angle=2.35619449)  # disabled
meshcorners_17 = MeshCorners(Mesh=mesh_23, Angle=2.35619449)  # disabled
meshcorners_18 = MeshCorners(Mesh=mesh_25, Angle=2.35619449)  # disabled
meshcorners_19 = MeshCorners(Mesh=mesh_24, Angle=2.35619449)  # disabled
curve_closest_point_3 = CurveClosestPoint(Point=meshcorners_16, Curve=mesh_naked_edges_6.Naked)  # -> Point, Parameter, Distance; disabled
curve_closest_point_4 = CurveClosestPoint(Point=meshcorners_15, Curve=mesh_naked_edges_3.Naked)  # -> Point, Parameter, Distance; disabled
curve_closest_point_5 = CurveClosestPoint(Point=meshcorners_17, Curve=mesh_naked_edges_4.Naked)  # -> Point, Parameter, Distance; disabled
curve_closest_point_6 = CurveClosestPoint(Point=meshcorners_18, Curve=mesh_naked_edges_5.Naked)  # -> Point, Parameter, Distance; disabled
curve_closest_point_7 = CurveClosestPoint(Point=meshcorners_19, Curve=mesh_naked_edges_7.Naked)  # -> Point, Parameter, Distance; disabled
number_slider_16 = Slider(1, range=0..3)  # disabled
shatter_3 = Shatter(Curve=mesh_naked_edges_6.Naked, Parameters=curve_closest_point_3.Parameter)  # disabled
number_slider_17 = Slider(1, range=0..3)  # disabled
number_slider_18 = Slider(3, range=0..3)  # disabled
shatter_4 = Shatter(Curve=mesh_naked_edges_3.Naked, Parameters=curve_closest_point_4.Parameter)  # disabled
shatter_5 = Shatter(Curve=mesh_naked_edges_4.Naked, Parameters=curve_closest_point_5.Parameter)  # disabled
shatter_6 = Shatter(Curve=mesh_naked_edges_5.Naked, Parameters=curve_closest_point_6.Parameter)  # disabled
shatter_7 = Shatter(Curve=mesh_naked_edges_7.Naked, Parameters=curve_closest_point_7.Parameter)  # disabled
panel_14 = Panel("""1
2""")  # disabled
list_item_7 = ListItem(List=shatter_3, Index=number_slider_16, Wrap=True)  # disabled
list_item_8 = ListItem(List=shatter_4, Index=panel_13, Wrap=True)  # -> graft(Item); disabled
list_item_9 = ListItem(List=shatter_5, Index=panel_14, Wrap=True)  # -> graft(Item); disabled
list_item_10 = ListItem(List=shatter_6, Index=number_slider_17, Wrap=True)  # disabled
list_item_11 = ListItem(List=shatter_7, Index=number_slider_18, Wrap=True)  # disabled
end_points = EndPoints(Curve=list_item_7)  # -> Start, End; disabled
end_points_2 = EndPoints(Curve=list_item_11)  # -> Start, End; disabled
end_points_3 = EndPoints(Curve=list_item_10)  # -> Start, End; disabled
end_points_4 = EndPoints(Curve=list_item_9)  # -> Start, End; disabled
end_points_5 = EndPoints(Curve=list_item_8)  # -> Start, End; disabled
line_3 = Line(StartPoint=end_points.Start, EndPoint=end_points.End)  # disabled
line_4 = Line(StartPoint=end_points_2.Start, EndPoint=end_points_2.End)  # disabled
line_5 = Line(StartPoint=end_points_3.Start, EndPoint=end_points_3.End)  # disabled
line_6 = Line(StartPoint=end_points_4.Start, EndPoint=end_points_4.End)  # disabled
line_7 = Line(StartPoint=end_points_5.Start, EndPoint=end_points_5.End)  # disabled
join_curves_3 = JoinCurves(Curves=[list_item_7, line_3], Preserve=False)  # disabled
join_curves_4 = JoinCurves(Curves=[line_4, list_item_11], Preserve=False)  # disabled
join_curves_5 = JoinCurves(Curves=[line_5, list_item_10], Preserve=False)  # disabled
join_curves_6 = JoinCurves(Curves=[line_6, list_item_9], Preserve=False)  # disabled
join_curves_7 = JoinCurves(Curves=[line_7, list_item_8], Preserve=False)  # disabled
boundary_surfaces_3 = BoundarySurfaces(Edges=[join_curves_3, join_curves_4, join_curves_5, join_curves_6, join_curves_7])  # disabled

# ---- group: Theatre roof (continued)
mesh_28 = Mesh(boundary_surfaces_3)  # disabled

# ---- group: Theatre roof / supports
nakedvertices_11 = NakedVertices(Mesh=mesh_28)  # -> ClothedIndex, NakedIndex, ClothedPts, simplify(flatten(NakedPts)); disabled
deconstruct_15 = Deconstruct(Point=nakedvertices_11.NakedPts)  # -> XComponent, YComponent, ZComponent; disabled
number_slider_19 = Slider(31, range=0..100)  # disabled
sort_list_15 = SortList(Keys=deconstruct_15.ZComponent, ValuesValuesA=nakedvertices_11.NakedPts)  # -> Keys, ValuesValuesA; disabled
split_list_15 = SplitList(List=sort_list_15.ValuesValuesA, Index=number_slider_19)  # -> ListA, ListB; disabled
point_19 = Point(split_list_15.ListA)  # disabled
find_similar_member_3 = FindSimilarMember(Data=point_19, Set=cull_duplicates_12.Points)  # -> Hit, Index; disabled
cull_duplicates_13 = CullDuplicates(Points=point_19, Tolerance=0.1, CullMode=3)  # -> Points, Indices, Valence; disabled
cull_index_3 = CullIndex(List=cull_duplicates_12.Points, Indices=find_similar_member_3.Index, Wrap=True)  # disabled

# ----
# Points support
support_points = Point(flatten([cull_duplicates_9.Points, cull_duplicates_3.Points]))
support_points_2 = Point(flatten(cull_duplicates_2.Points))
support_points_3 = Point(flatten([cull_duplicates_8.Points, cull_duplicates_10.Points]))
support_points_4 = Point(flatten(cull_index_3))
support_points_5 = Point(flatten([cull_duplicates_5.Points, cull_duplicates_4.Points, cull_duplicates_6.Points, cull_duplicates_7.Points, cull_duplicates_13.Points, cull_duplicates_11.Points, cull_duplicates.Points]))
support_karamba3d = SupportKaramba3D(PosInd=support_points_3, menu=[buttons(on, off, on, off, on, on)])
support_karamba3d_2 = SupportKaramba3D(PosInd=support_points, menu=[buttons(on, on, on, on, off, on)])
support_karamba3d_3 = SupportKaramba3D(PosInd=support_points_2, menu=[buttons(on, off, off, off, off, off)])
support_karamba3d_4 = SupportKaramba3D(PosInd=support_points_4, menu=[buttons(off, off, on, off, off, off)])
support_karamba3d_5 = SupportKaramba3D(PosInd=support_points_5, menu=[buttons(on, on, on, off, off, off)])
support_karamba3d_6 = SupportKaramba3D(flatten([support_karamba3d_5, support_karamba3d_4, support_karamba3d, support_karamba3d_2, support_karamba3d_3]))

# ----
# walls
# Mesh Walls
mesh_wall_3 = Mesh(flatten([mesh_28, mesh_11, weaverbird_s_catmull_clark_subdivision, weaverbird_s_catmull_clark_subdivision_2, mesh_3]))
cross_section_karamba3d_3 = CrossSectionKaramba3D(
    FamilyNameOfCrossSection="DefaultCroSec",
    ElementIdentifier="exterior walls",
    Material=material_properties_karamba3d,
    Height_cm=Slider(42, range=0..100),
    mode="Shell - Const")
mesh_to_shell_karamba3d_3 = MeshToShellKaramba3D(Mesh=mesh_wall_3, Identifier="exterior walls", CrossSection=cross_section_karamba3d_3, LimitDistance_m=0.005)  # -> Element, Points, Info

# ----
# Shell
# Mesh shell
mesh_29 = Mesh([mesh_17, mesh_15, mesh_19, mesh_12, rebuild_mesh_6, rebuild_mesh, rebuild_mesh_5, weighted_catmull_clark_subdivision_3.A, rebuild_mesh_2, rebuild_mesh_4, rebuild_mesh_3])
# Meshes
cross_section_vault = CrossSectionKaramba3D(
    FamilyNameOfCrossSection="DefaultCroSec",
    ElementIdentifier="shell",
    Material=material_properties_karamba3d,
    Height_cm=Slider(32, range=0..100),
    mode="Shell - Const")
mesh_shell = Mesh(mesh_29)
mesh_to_shell_karamba3d_4 = MeshToShellKaramba3D(Mesh=mesh_shell, Identifier="shell", CrossSection=cross_section_vault, LimitDistance_m=0.005)  # -> Element, Points, Info

# ---- group: Slab load and sand load
number_slider_20 = Slider(-5, range=-10..2)  # disabled
multiplication = Multiplication(A=number_slider_20, B=1.2)  # disabled
unit_z = UnitZ(Factor=multiplication)  # disabled
panel_15 = Panel("0")  # disabled
loads_2 = LoadsKaramba3D(Vector=unit_z, Mesh=mesh_shell, LCase=panel_15, mode="MeshLoad -Const.", menu=[buttons(off, on, off), buttons(on, on)])  # disabled

# ---- group: Live load
number_slider_21 = Slider(-2.5, range=-10..2)  # disabled
multiplication_2 = Multiplication(A=number_slider_21, B=1.5)  # disabled
unit_z_2 = UnitZ(Factor=multiplication_2)  # disabled
loads_3 = LoadsKaramba3D(Vector=unit_z_2, Mesh=mesh_shell, LCase=panel_10, mode="MeshLoad -Const.", menu=[buttons(off, on, off), buttons(on, on)])  # disabled

# ---- group: maintanance load
# Loads
multiplication_3 = Multiplication(A=Slider(-1, range=-10..2), B=1.2)
unit_z_3 = UnitZ(Factor=multiplication_3)
panel_16 = Panel("0")
loads_4 = LoadsKaramba3D(Vectors=unit_z_3, Mesh=mesh_shell, LCase=0, mode="MeshLoad -Variable", menu=[buttons(off, on, off), buttons(on, on)])

# ----
load_karamba3d = LoadKaramba3D(flatten([loads_4, loads, loads_3, loads_2]))

# ---- group: Just ro
assemble_model_karamba3d = AssembleModelKaramba3D(
    Elem=flatten([mesh_to_shell_karamba3d_4.Element, mesh_to_shell_karamba3d_2.Element, mesh_to_shell_karamba3d_3.Element, mesh_to_shell_karamba3d.Element]),
    Support=flatten(support_karamba3d_6),
    Load=flatten(load_karamba3d),
    Material=material_properties_karamba3d,
    LimitDistance_m=0.005)  # -> Model, Info, Mass_kg, CenterOfGravity
analyze_karamba3d = AnalyzeKaramba3D(Model=assemble_model_karamba3d.Model)  # -> CalculatedModel, MaximumDisplacement_cm, ResultingForceOfGravity_kN, ElasticEnergy_kNm
model_view_karamba3d = ModelViewKaramba3D(Model=analyze_karamba3d.CalculatedModel, ResultFactors=1, ResultCase=-1)  # -> Model, DeformedMesh, DeformedAxes, DeformedModel
shell_view_karamba3d = ShellViewKaramba3D(Model=model_view_karamba3d.Model, IndexOfLayer=0)  # -> Model, MeshesOfRenderedShells, LegendColors, LegendTags
shell_view_karamba3d_2 = ShellViewKaramba3D(Model=model_view_karamba3d.Model, IndexOfLayer=0)  # -> Model, MeshesOfRenderedShells, LegendColors, LegendTags
legend = Legend(Colour=shell_view_karamba3d.LegendColors, Tags=shell_view_karamba3d.LegendTags, LegendType=1)
number = Number(flatten([shell_view_karamba3d_2.LegendTags, shell_view_karamba3d.LegendTags]))
highest_lowest_numbers = HighestLowestNumbers(Numbers=number)  # -> expr("x*10", Highest), expr("x*10", Lowest)
deformation_cm = Panel(analyze_karamba3d.MaximumDisplacement_cm)
tension_mpa = Panel(highest_lowest_numbers.Highest)
compression_mpa = Panel(highest_lowest_numbers.Lowest)

# ----
panel_17 = Panel(assemble_model_karamba3d.Mass_kg)
result_vectors_on_shells_karamba3d = ResultVectorsOnShellsKaramba3D(AnalyzedModel=shell_view_karamba3d.Model, LayerPosition=0, mode="PrincStress")  # -> AnalyzedModel, Points, FirstPrincipalStressVector_kN_cm2, SecondPrincipalStressVector_kN_cm2, FirstPrincipalStressValue_kN_cm2, SecondPrincipalStressValue_kN_cm2
number_2 = Number(flatten([result_vectors_on_shells_karamba3d.FirstPrincipalStressValue_kN_cm2, result_vectors_on_shells_karamba3d.SecondPrincipalStressValue_kN_cm2]))
highest_lowest_numbers_2 = HighestLowestNumbers(Numbers=number_2)  # -> expr("x*10", Highest), expr("x*10", Lowest)
tension_mpa_2 = Panel(highest_lowest_numbers_2.Highest)
compression_mpa_2 = Panel(highest_lowest_numbers_2.Lowest)
