# Grasshopper definition Rib configuration and sequence.gh (Grasshopper 1.0.7)
# plug-ins: Anemone, Pufferfish

# Input curve
curve = Curve(<curve referenced from the Rhino model>)
shatter = Shatter(Curve=reparameterize(curve), Parameters=Slider(0.5, range=0..1))
list_item = ListItem(List=shatter, Index=0, Wrap=True)

# ---- group: Input / inputs blocks
angle_wedge = Slider(5, range=0..30)
block_hight = Slider(0.32, range=0..1)
block_width = Slider(0.16, range=0..1)
block_thickness = Slider(0.08, range=0..1)
amount_of_blocks_per_side = Slider(5, range=0..20)

# ---- group: Input
# Half catenary line
curve_2 = Curve(list_item)

# ---- group: Input / inputs catenary line
button = Button()
number_slider = Slider(0.04, range=0..1)
number_slider_2 = Slider(0.932, range=0..1)
number_slider_3 = Slider(0.028, range=0..1)

# ---- group: Initial rectangle
perp_frame = PerpFrame(Curve=reparameterize(curve_2), Parameter=Slider(0, range=0..1))
unit_z = UnitZ(Factor=1)
deconstruct_plane = DeconstructPlane(Plane=perp_frame)  # -> Origin, XAxis, YAxis, ZAxis
cross_product = CrossProduct(VectorA=deconstruct_plane.ZAxis, VectorB=unit_z, Unitize=False)  # -> Vector, Length
cross_product_2 = CrossProduct(VectorA=deconstruct_plane.ZAxis, VectorB=cross_product.Vector, Unitize=False)  # -> Vector, Length
construct_plane = ConstructPlane(Origin=deconstruct_plane.Origin, XAxis=expr("x*-1", cross_product_2.Vector), YAxis=cross_product.Vector)
rectangle = Rectangle(Plane=construct_plane, XSize=block_hight, YSize=block_width, Radius=0)  # -> Rectangle, Length
end_points = EndPoints(Curve=curve_2)  # -> Start, End
brep_edges = BrepEdges(Brep=rectangle.Rectangle)  # -> Naked, Interior, NonManifold
list_item_2 = ListItem(List=brep_edges.Naked, Index=3, Wrap=True)
point_on_curve = PointOnCurve(list_item_2, parameter=0.5)
vector_2pt = Vector2Pt(PointA=point_on_curve, PointB=end_points.Start, Unitize=False)  # -> Vector, Length
move = Move(Geometry=rectangle.Rectangle, Motion=vector_2pt.Vector)  # -> Geometry, Transform
boundary_surfaces = BoundarySurfaces(Edges=move.Geometry)

# ---- group: initial angle
xy_plane = XYPlane(Origin=Point(0, 0, 0))
deconstruct_plane_2 = DeconstructPlane(Plane=xy_plane)  # -> Origin, XAxis, YAxis, ZAxis
deconstruct_plane_3 = DeconstructPlane(Plane=construct_plane)  # -> Origin, XAxis, YAxis, ZAxis
angle = Angle(VectorA=deconstruct_plane_2.XAxis, VectorB=deconstruct_plane_3.YAxis)  # -> Angle, Reflex
degrees = Degrees(Radians=angle.Angle)  # -> expr("180-x", flatten(Degrees))

# ---- group: Loop for tower of bricks
fast_loop_start = FastLoopStart(Iterations=amount_of_blocks_per_side, Data=boundary_surfaces)  # -> port, Counter, Data

# ---- group: Loop for tower of bricks / Extrusion/how far
area = Area(Geometry=fast_loop_start.Data)  # -> Area, Centroid
evaluate_surface = EvaluateSurface(Surface=fast_loop_start.Data, Point=area.Centroid)  # -> Point, Normal, UDirection, VDirection, Frame
deconstruct_brep = DeconstructBrep(Brep=fast_loop_start.Data)  # -> Faces, Edges, Vertices
multiplication = Multiplication(A=evaluate_surface.Normal, B=100)
extrude = Extrude(Base=fast_loop_start.Data, Direction=multiplication)
list_item_3 = ListItem(List=deconstruct_brep.Edges, Index="3", Wrap=False)
curve_middle = CurveMiddle(Curve=list_item_3)
brep_curve = BrepCurve(Brep=extrude, Curve=curve_2)  # -> Curves, Points
series = Series(Start="0", Step=block_thickness, Count="100")  # -> reverse(Series)
list_item_4 = ListItem(List=brep_curve.Points, Index="1", Wrap=False)
distance = Distance(PointA=list_item_4, PointB=curve_middle)
replace_nulls = ReplaceNulls(Items=distance, Replacements="0")  # -> Items, Count
panel = Panel(series)
insert_items = InsertItems(List=series, Item="0", Indices="100", Wrap=True)
number = Number(replace_nulls.Items)
number_2 = Number(panel)
item_index = ItemIndex(List=insert_items, Item="0")
find_similar_member = FindSimilarMember(Data=number, Set=number_2)  # -> Hit, Index
addition = Addition(A=find_similar_member.Index, B=1)
replace_items = ReplaceItems(List=insert_items, Item="0.001", Indices=item_index, Wrap=False)
list_item_5 = ListItem(List=replace_items, Index=addition, Wrap=False)
replace_nulls_2 = ReplaceNulls(Items=list_item_5, Replacements="0.001")  # -> Items, Count
vector = Vector(evaluate_surface.Normal)
multiplication_2 = Multiplication(A=vector, B=replace_nulls_2.Items)
division = Division(A=replace_nulls_2.Items, B=block_thickness)
multiplication_3 = Multiplication(A=vector, B=block_thickness)
extrude_2 = Extrude(Base=fast_loop_start.Data, Direction=multiplication_2)
linear_array = LinearArray(Geometry=fast_loop_start.Data, Direction=multiplication_3, Count=division)  # -> Geometry, Transform
extrude_3 = Extrude(Base=linear_array.Geometry, Direction=multiplication_3)

# ---- group: Loop for tower of bricks / Making wedge
deconstruct_brep_2 = DeconstructBrep(Brep=extrude_2)  # -> Faces, Edges, Vertices
list_item_6 = ListItem(List=deconstruct_brep_2.Vertices, Index=Slider(4, range=0..10), Wrap=False)
list_item_7 = ListItem(List=deconstruct_brep_2.Faces, Index="5", Wrap=False)
area_2 = Area(Geometry=list_item_7)  # -> Area, Centroid
evaluate_surface_2 = EvaluateSurface(Surface=list_item_7, Point=area_2.Centroid)  # -> Point, Normal, UDirection, VDirection, Frame
deconstruct_plane_4 = DeconstructPlane(Plane=evaluate_surface_2.Frame)  # -> Origin, XAxis, YAxis, ZAxis
unit_z_2 = UnitZ(Factor=1)
construct_plane_2 = ConstructPlane(Origin=list_item_6, XAxis=unit_z_2, YAxis=deconstruct_plane_4.ZAxis)
rotate = Rotate(Geometry=list_item_7, Angle=degrees(angle_wedge), Plane=construct_plane_2)  # -> Geometry, Transform
loft = Loft(
    Curves=[rotate.Geometry, list_item_7],
    Options={Adjust=False, Closed=False, LoftEnds=0, LoftSimp=0, LoftType=0, Rebuild=10, Refit=0.01})

# ---- group: Loop for tower of bricks (continued)
fast_loop_end = FastLoopEnd(port=fast_loop_start.port, Exit=False, Data=rotate.Geometry, RecordData=True, TimeOutVal=0)  # -> simplify(Data)

# ---- group: Extrusion/how far
area_3 = Area(Geometry=fast_loop_end)  # -> Area, Centroid
evaluate_surface_3 = EvaluateSurface(Surface=fast_loop_end, Point=area_3.Centroid)  # -> Point, Normal, UDirection, VDirection, Frame
deconstruct_brep_3 = DeconstructBrep(Brep=fast_loop_end)  # -> Faces, Edges, Vertices
multiplication_4 = Multiplication(A=evaluate_surface_3.Normal, B=100)
extrude_4 = Extrude(Base=fast_loop_end, Direction=multiplication_4)
list_item_8 = ListItem(List=deconstruct_brep_3.Edges, Index="3", Wrap=False)
curve_middle_2 = CurveMiddle(Curve=list_item_8)
brep_curve_2 = BrepCurve(Brep=extrude_4, Curve=curve_2)  # -> Curves, Points
series_2 = Series(Start="0", Step=block_thickness, Count="100")  # -> reverse(Series)
list_item_9 = ListItem(List=brep_curve_2.Points, Index="1", Wrap=False)
distance_2 = Distance(PointA=list_item_9, PointB=curve_middle_2)
replace_nulls_3 = ReplaceNulls(Items=distance_2, Replacements="0")  # -> Items, Count
panel_2 = Panel(series_2)
number_3 = Number(replace_nulls_3.Items)
number_4 = Number(panel_2)
find_similar_member_2 = FindSimilarMember(Data=number_3, Set=number_4)  # -> Hit, Index
addition_2 = Addition(A=find_similar_member_2.Index, B=1)
vector_2 = Vector(evaluate_surface_3.Normal)
multiplication_5 = Multiplication(A=vector_2, B=block_thickness)

# ----
panel_3 = Panel(extrude_4)
point = Point(brep_curve_2.Points)
insert_items_2 = InsertItems(List=series_2, Item="0", Indices="100", Wrap=True)

# ---- group: Extrusion/how far (continued)
list_item_10 = ListItem(List=insert_items_2, Index=addition_2, Wrap=False)
replace_nulls_4 = ReplaceNulls(Items=list_item_10, Replacements="0.001")  # -> Items, Count
division_2 = Division(A=replace_nulls_4.Items, B=block_thickness)
linear_array_2 = LinearArray(Geometry=fast_loop_end, Direction=multiplication_5, Count=division_2)  # -> Geometry, Transform
extrude_5 = Extrude(Base=linear_array_2.Geometry, Direction=multiplication_5)

# ----
panel_4 = Panel(vector_2)

# ---- group: Wedges
last_index = LastIndex(List=extrude_5)
list_item_11 = ListItem(List=extrude_5, Index=last_index, Wrap=True)
deconstruct_brep_4 = DeconstructBrep(Brep=list_item_11)  # -> Faces, Edges, Vertices
geometry = Geometry(flatten(fast_loop_end))
list_item_12 = ListItem(List=deconstruct_brep_4.Faces, Index=Slider(5, range=0..10), Wrap=True)  # -> flatten(Item)
last_index_2 = LastIndex(List=list_item_12)
cull_index = CullIndex(List=geometry, Indices=0, Wrap=True)  # -> simplify(flatten(List))
cull_index_2 = CullIndex(List=list_item_12, Indices=last_index_2, Wrap=True)  # -> flatten(List)
geometry_2 = Geometry(graft(cull_index_2))
geometry_3 = Geometry(graft(cull_index))
loft_2 = Loft(
    Curves=[geometry_3, geometry_2],
    Options={Adjust=False, Closed=False, LoftEnds=0, LoftSimp=0, LoftType=0, Rebuild=10, Refit=0.01})

# ---- group: mirror
perp_frame_2 = PerpFrame(Curve=reparameterize(curve_2), Parameter=Slider(1, range=0..1))
unit_z_3 = UnitZ(Factor=1)
deconstruct_plane_5 = DeconstructPlane(Plane=perp_frame_2)  # -> Origin, XAxis, YAxis, ZAxis
cross_product_3 = CrossProduct(VectorA=deconstruct_plane_5.ZAxis, VectorB=unit_z_3, Unitize=False)  # -> Vector, Length
construct_plane_3 = ConstructPlane(Origin=deconstruct_plane_5.Origin, XAxis=cross_product_3.Vector, YAxis=unit_z_3)
mirror = Mirror(Geometry=flatten([extrude_5, extrude_3, loft_2, loft]), Plane=construct_plane_3)  # -> Geometry, Transform

# ---- group: text building sequence
insert_items_3 = InsertItems(List=flatten(replace_nulls_4.Items), Item=list_item_5, Indices="0", Wrap=True)
division_3 = Division(A=flatten(insert_items_3), B=block_thickness)
last_index_3 = LastIndex(List=division_3)
list_item_13 = ListItem(List=division_3, Index=last_index_3, Wrap=True)
cull_index_3 = CullIndex(List=division_3, Indices=last_index_3, Wrap=True)
expression = Expression(x=list_item_13, Expression="Format(\"{0} blocks, keystone\", x)")
expression_2 = Expression(x=cull_index_3, Expression="Format(\"{0} blocks, wedge\", x)")
insert_items_4 = InsertItems(List=expression_2, Item=expression, Indices=last_index_3, Wrap=True)

# ----
panel_5 = Panel(geometry_2)
panel_6 = Panel(loft_2)
# Final geometry
geometry_4 = Geometry([mirror.Geometry, loft_2, extrude_5, loft])

# ---- group: output
# building procedure per side
panel_7 = Panel(insert_items_4)
angle_start_degrees = Panel(degrees)
