# Grasshopper definition keystone script.gh (Grasshopper 1.0.7)
# plug-ins: Weaverbird

number_slider = Slider(0.5, range=0..1)  # disabled
number_slider_2 = Slider(0, range=0..1)  # disabled
number_slider_3 = Slider(0, range=0..1)  # disabled
number_slider_4 = Slider(0, range=0..1)  # disabled

# ---- group: Tests
number_slider_5 = Slider(0.5, range=0..1)  # disabled
number_slider_6 = Slider(0.5, range=0..1)  # disabled
number_slider_7 = Slider(0, range=0..1)  # disabled
number_slider_8 = Slider(0, range=0..1)  # disabled
number_slider_9 = Slider(0, range=0..1)  # disabled
number_slider_10 = Slider(0, range=0..1)  # disabled
number_slider_11 = Slider(0, range=0..1)  # disabled
number_slider_12 = Slider(0, range=0..1)  # disabled
curve = Curve(<curve referenced from the Rhino model>)  # disabled
curve_2 = Curve(<curve referenced from the Rhino model>)  # disabled
curve_3 = Curve(<curve referenced from the Rhino model>)  # disabled
curve_4 = Curve(<curve referenced from the Rhino model>)  # disabled
curve_5 = Curve(<curve referenced from the Rhino model>)  # disabled
curve_6 = Curve(<curve referenced from the Rhino model>)  # disabled
construct_domain = ConstructDomain(DomainStart=expr("x*-1", number_slider_5), DomainEnd=number_slider_5)  # disabled
number_slider_13 = Slider(0.16, range=0..1)  # disabled
construct_domain_2 = ConstructDomain(DomainStart=expr("x*-1", number_slider_6), DomainEnd=number_slider_6)  # disabled
construct_domain_3 = ConstructDomain(DomainStart=0, DomainEnd=expr("x*2", number_slider_5))  # disabled
construct_domain_4 = ConstructDomain(DomainStart=0, DomainEnd=expr("x*2", number_slider_6))  # disabled
number_slider_14 = Slider(0.32, range=0..1)  # disabled
perp_frame = PerpFrame(Curve=reparameterize(curve_3), Parameter=number_slider_11)  # disabled
perp_frame_2 = PerpFrame(Curve=reparameterize(curve), Parameter=number_slider_9)  # disabled
perp_frame_3 = PerpFrame(Curve=reparameterize(curve_5), Parameter=number_slider_12)  # disabled
perp_frame_4 = PerpFrame(Curve=reparameterize(curve_2), Parameter=number_slider_10)  # disabled
perp_frame_5 = PerpFrame(Curve=reparameterize(curve_4), Parameter=number_slider_7)  # disabled
perp_frame_6 = PerpFrame(Curve=reparameterize(curve_6), Parameter=number_slider_8)  # disabled
number_slider_15 = Slider(0, range=0..1)  # disabled
curve_7 = Curve(<curve referenced from the Rhino model>)  # disabled
number_slider_16 = Slider(0, range=0..1)  # disabled
curve_8 = Curve(<curve referenced from the Rhino model>)  # disabled
number_slider_17 = Slider(0, range=0..1)  # disabled
curve_9 = Curve(<curve referenced from the Rhino model>)  # disabled
construct_domain_5 = ConstructDomain(DomainStart=expr("x*-0.5", number_slider_13), DomainEnd=expr("x*0.5", number_slider_13))  # disabled
perp_frame_7 = PerpFrame(Curve=reparameterize(curve_7), Parameter=number_slider_16)  # disabled
perp_frame_8 = PerpFrame(Curve=reparameterize(curve_8), Parameter=number_slider_17)  # disabled
construct_domain_6 = ConstructDomain(DomainStart=0, DomainEnd=number_slider_14)  # disabled
perp_frame_9 = PerpFrame(Curve=reparameterize(curve_9), Parameter=number_slider_15)  # disabled
cluster = Cluster(plane=perp_frame)  # disabled
cluster_2 = Cluster(plane=perp_frame_3)  # disabled
cluster_3 = Cluster(plane=perp_frame_2)  # disabled
cluster_4 = Cluster(plane=perp_frame_4)  # disabled
cluster_5 = Cluster(plane=perp_frame_5)  # disabled
cluster_6 = Cluster(plane=perp_frame_6)  # disabled
cluster_7 = Cluster(plane=perp_frame_9)  # disabled
cluster_8 = Cluster(plane=perp_frame_7)  # disabled
cluster_9 = Cluster(plane=perp_frame_8)  # disabled
rectangle = Rectangle(Plane=cluster, XSize=construct_domain_3, YSize=construct_domain, Radius=0)  # -> Rectangle, Length; disabled
rectangle_2 = Rectangle(Plane=cluster_5, XSize=construct_domain_3, YSize=construct_domain, Radius=0)  # -> Rectangle, Length; disabled
rectangle_3 = Rectangle(Plane=cluster_2, XSize=construct_domain_4, YSize=construct_domain_2, Radius=0)  # -> Rectangle, Length; disabled
rectangle_4 = Rectangle(Plane=cluster_6, XSize=construct_domain_4, YSize=construct_domain_2, Radius=0)  # -> Rectangle, Length; disabled
rectangle_5 = Rectangle(Plane=cluster_3, XSize=construct_domain_3, YSize=construct_domain, Radius=0)  # -> Rectangle, Length; disabled
rectangle_6 = Rectangle(Plane=cluster_4, XSize=construct_domain_4, YSize=construct_domain_2, Radius=0)  # -> Rectangle, Length; disabled
rectangle_7 = Rectangle(Plane=cluster_9, XSize=construct_domain_6, YSize=construct_domain_5, Radius=0)  # -> Rectangle, Length; disabled
rectangle_8 = Rectangle(Plane=cluster_7, XSize=construct_domain_6, YSize=construct_domain_5, Radius=0)  # -> Rectangle, Length; disabled
rectangle_9 = Rectangle(Plane=cluster_8, XSize=construct_domain_6, YSize=construct_domain_5, Radius=0)  # -> Rectangle, Length; disabled
end_points = EndPoints(Curve=curve_3)  # -> Start, End; disabled
end_points_2 = EndPoints(Curve=curve_4)  # -> Start, End; disabled
end_points_3 = EndPoints(Curve=curve_5)  # -> Start, End; disabled
end_points_4 = EndPoints(Curve=curve_6)  # -> Start, End; disabled
end_points_5 = EndPoints(Curve=curve)  # -> Start, End; disabled
deconstruct_plane = DeconstructPlane(Plane=perp_frame)  # -> Origin, XAxis, YAxis, ZAxis; disabled
end_points_6 = EndPoints(Curve=curve_2)  # -> Start, End; disabled
deconstruct_plane_2 = DeconstructPlane(Plane=perp_frame_5)  # -> Origin, XAxis, YAxis, ZAxis; disabled
deconstruct_plane_3 = DeconstructPlane(Plane=perp_frame_3)  # -> Origin, XAxis, YAxis, ZAxis; disabled
deconstruct_plane_4 = DeconstructPlane(Plane=perp_frame_6)  # -> Origin, XAxis, YAxis, ZAxis; disabled
deconstruct_plane_5 = DeconstructPlane(Plane=perp_frame_2)  # -> Origin, XAxis, YAxis, ZAxis; disabled
deconstruct_plane_6 = DeconstructPlane(Plane=perp_frame_4)  # -> Origin, XAxis, YAxis, ZAxis; disabled
distance = Distance(PointA=end_points.Start, PointB=end_points.End)  # disabled
distance_2 = Distance(PointA=end_points_2.Start, PointB=end_points_2.End)  # disabled
distance_3 = Distance(PointA=end_points_3.Start, PointB=end_points_3.End)  # disabled
distance_4 = Distance(PointA=end_points_4.Start, PointB=end_points_4.End)  # disabled
distance_5 = Distance(PointA=end_points_5.Start, PointB=end_points_5.End)  # disabled
distance_6 = Distance(PointA=end_points_6.Start, PointB=end_points_6.End)  # disabled
end_points_7 = EndPoints(Curve=curve_9)  # -> Start, End; disabled
deconstruct_plane_7 = DeconstructPlane(Plane=perp_frame_9)  # -> Origin, XAxis, YAxis, ZAxis; disabled
end_points_8 = EndPoints(Curve=curve_7)  # -> Start, End; disabled
deconstruct_plane_8 = DeconstructPlane(Plane=perp_frame_7)  # -> Origin, XAxis, YAxis, ZAxis; disabled
end_points_9 = EndPoints(Curve=curve_8)  # -> Start, End; disabled
deconstruct_plane_9 = DeconstructPlane(Plane=perp_frame_8)  # -> Origin, XAxis, YAxis, ZAxis; disabled
multiplication = Multiplication(A=deconstruct_plane.ZAxis, B=distance)  # disabled
multiplication_2 = Multiplication(A=deconstruct_plane_2.ZAxis, B=distance_2)  # disabled
multiplication_3 = Multiplication(A=deconstruct_plane_3.ZAxis, B=distance_3)  # disabled
multiplication_4 = Multiplication(A=deconstruct_plane_4.ZAxis, B=distance_4)  # disabled
multiplication_5 = Multiplication(A=deconstruct_plane_5.ZAxis, B=distance_5)  # disabled
multiplication_6 = Multiplication(A=deconstruct_plane_6.ZAxis, B=distance_6)  # disabled
distance_7 = Distance(PointA=end_points_7.Start, PointB=end_points_7.End)  # disabled
distance_8 = Distance(PointA=end_points_8.Start, PointB=end_points_8.End)  # disabled
distance_9 = Distance(PointA=end_points_9.Start, PointB=end_points_9.End)  # disabled
extrude = Extrude(Base=rectangle.Rectangle, Direction=multiplication)  # disabled
extrude_2 = Extrude(Base=rectangle_2.Rectangle, Direction=multiplication_2)  # disabled
extrude_3 = Extrude(Base=rectangle_3.Rectangle, Direction=multiplication_3)  # disabled
extrude_4 = Extrude(Base=rectangle_4.Rectangle, Direction=multiplication_4)  # disabled
extrude_5 = Extrude(Base=rectangle_5.Rectangle, Direction=multiplication_5)  # disabled
extrude_6 = Extrude(Base=rectangle_6.Rectangle, Direction=multiplication_6)  # disabled
multiplication_7 = Multiplication(A=deconstruct_plane_7.ZAxis, B=distance_7)  # disabled
multiplication_8 = Multiplication(A=deconstruct_plane_8.ZAxis, B=distance_8)  # disabled
multiplication_9 = Multiplication(A=deconstruct_plane_9.ZAxis, B=distance_9)  # disabled
cap_holes = CapHoles(Brep=extrude)  # disabled
cap_holes_2 = CapHoles(Brep=extrude_3)  # disabled
cap_holes_3 = CapHoles(Brep=extrude_2)  # disabled
cap_holes_4 = CapHoles(Brep=extrude_4)  # disabled
cap_holes_5 = CapHoles(Brep=extrude_5)  # disabled
cap_holes_6 = CapHoles(Brep=extrude_6)  # disabled
extrude_7 = Extrude(Base=rectangle_8.Rectangle, Direction=multiplication_7)  # disabled
extrude_8 = Extrude(Base=rectangle_9.Rectangle, Direction=multiplication_8)  # disabled
extrude_9 = Extrude(Base=rectangle_7.Rectangle, Direction=multiplication_9)  # disabled
deconstruct_brep = DeconstructBrep(Brep=cap_holes_4)  # -> Faces, Edges, Vertices; disabled
deconstruct_brep_2 = DeconstructBrep(Brep=cap_holes_2)  # -> Faces, Edges, Vertices; disabled
deconstruct_brep_3 = DeconstructBrep(Brep=cap_holes_6)  # -> Faces, Edges, Vertices; disabled
cap_holes_7 = CapHoles(Brep=extrude_7)  # disabled
cap_holes_8 = CapHoles(Brep=extrude_8)  # disabled
cap_holes_9 = CapHoles(Brep=extrude_9)  # disabled
number_slider_18 = Slider(7, range=0..10)  # disabled
number_slider_19 = Slider(5, range=0..10)  # disabled
number_slider_20 = Slider(2, range=0..10)  # disabled
number_slider_21 = Slider(6, range=0..10)  # disabled
number_slider_22 = Slider(7, range=0..10)  # disabled
solid_union = SolidUnion(Breps=[cap_holes, cap_holes_3, cap_holes_5])  # disabled
deconstruct_brep_4 = DeconstructBrep(Brep=cap_holes_7)  # -> Faces, Edges, Vertices; disabled
deconstruct_brep_5 = DeconstructBrep(Brep=cap_holes_8)  # -> Faces, Edges, Vertices; disabled
deconstruct_brep_6 = DeconstructBrep(Brep=cap_holes_9)  # -> Faces, Edges, Vertices; disabled
entwine = Entwine(
    Branch00=deconstruct_brep.Edges,
    Branch01=deconstruct_brep_2.Edges,
    Branch02=deconstruct_brep_3.Edges,
    FlattenInputs=True)  # disabled
entwine_2 = Entwine(
    Branch00=deconstruct_brep.Vertices,
    Branch01=deconstruct_brep_2.Vertices,
    Branch02=deconstruct_brep_3.Vertices,
    FlattenInputs=True)  # disabled
entwine_3 = Entwine(
    Branch00=deconstruct_brep.Edges,
    Branch01=deconstruct_brep_2.Edges,
    Branch02=deconstruct_brep_3.Edges,
    FlattenInputs=True)  # disabled
entwine_4 = Entwine(
    Branch00=deconstruct_brep.Vertices,
    Branch01=deconstruct_brep_2.Vertices,
    Branch02=deconstruct_brep_3.Vertices,
    FlattenInputs=True)  # disabled
list_item = ListItem(List=entwine_2, Index=0, Wrap=True)  # -> flatten(Item); disabled
list_item_2 = ListItem(List=entwine_2, Index=number_slider_18, Wrap=True)  # -> flatten(Item); disabled
list_item_3 = ListItem(List=entwine, Index=number_slider_20, Wrap=True)  # -> flatten(Item); disabled
list_item_4 = ListItem(List=entwine_4, Index=number_slider_19, Wrap=True)  # -> flatten(Item); disabled
list_item_5 = ListItem(List=entwine_4, Index=number_slider_21, Wrap=True)  # -> flatten(Item); disabled
list_item_6 = ListItem(List=entwine_3, Index=number_slider_22, Wrap=True)  # -> flatten(Item); disabled
number_slider_23 = Slider(2, range=0..10)  # disabled
number_slider_24 = Slider(7, range=0..10)  # disabled
number_slider_25 = Slider(7, range=0..10)  # disabled
number_slider_26 = Slider(5, range=0..10)  # disabled
number_slider_27 = Slider(6, range=0..10)  # disabled
entwine_5 = Entwine(
    Branch00=deconstruct_brep_4.Edges,
    Branch01=deconstruct_brep_5.Edges,
    Branch02=deconstruct_brep_6.Edges,
    FlattenInputs=True)  # disabled
entwine_6 = Entwine(
    Branch00=deconstruct_brep_4.Vertices,
    Branch01=deconstruct_brep_5.Vertices,
    Branch02=deconstruct_brep_6.Vertices,
    FlattenInputs=True)  # disabled
entwine_7 = Entwine(
    Branch00=deconstruct_brep_4.Edges,
    Branch01=deconstruct_brep_5.Edges,
    Branch02=deconstruct_brep_6.Edges,
    FlattenInputs=True)  # disabled
entwine_8 = Entwine(
    Branch00=deconstruct_brep_4.Vertices,
    Branch01=deconstruct_brep_5.Vertices,
    Branch02=deconstruct_brep_6.Vertices,
    FlattenInputs=True)  # disabled
shift_list = ShiftList(List=list_item_2, Shift=1, Wrap=True)  # disabled
shift_list_2 = ShiftList(List=list_item_5, Shift=1, Wrap=True)  # disabled
line = Line(StartPoint=list_item, EndPoint=shift_list)  # -> flatten(Line); disabled
list_item_7 = ListItem(List=entwine_5, Index=number_slider_23, Wrap=True)  # -> flatten(Item); disabled
list_item_8 = ListItem(List=entwine_6, Index=number_slider_24, Wrap=True)  # -> flatten(Item); disabled
list_item_9 = ListItem(List=entwine_7, Index=number_slider_25, Wrap=True)  # -> flatten(Item); disabled
list_item_10 = ListItem(List=entwine_8, Index=number_slider_26, Wrap=True)  # -> flatten(Item); disabled
list_item_11 = ListItem(List=entwine_8, Index=number_slider_27, Wrap=True)  # -> flatten(Item); disabled
line_2 = Line(StartPoint=list_item_4, EndPoint=shift_list_2)  # -> flatten(Line); disabled
list_item_12 = ListItem(List=entwine_6, Index=0, Wrap=True)  # -> flatten(Item); disabled
shift_list_3 = ShiftList(List=list_item_8, Shift=1, Wrap=True)  # disabled
shift_list_4 = ShiftList(List=list_item_11, Shift=1, Wrap=True)  # disabled
join_curves = JoinCurves(Curves=[line, list_item_3], Preserve=False)  # disabled
join_curves_2 = JoinCurves(Curves=[line_2, list_item_6], Preserve=False)  # disabled
line_3 = Line(StartPoint=list_item_12, EndPoint=shift_list_3)  # -> flatten(Line); disabled
line_4 = Line(StartPoint=list_item_10, EndPoint=shift_list_4)  # -> flatten(Line); disabled
fragment_patch = FragmentPatch(Boundary=join_curves)  # disabled
fragment_patch_2 = FragmentPatch(Boundary=join_curves_2)  # disabled
join_curves_3 = JoinCurves(Curves=[line_3, list_item_7], Preserve=False)  # disabled
join_curves_4 = JoinCurves(Curves=[line_4, list_item_9], Preserve=False)  # disabled
number_slider_28 = Slider(3, range=0..10)  # disabled
number_slider_29 = Slider(3, range=0..10)  # disabled
mesh_brep = MeshBrep(
    Brep=fragment_patch_2,
    Settings={GridMaxCount=0, GridMinCount=16, JaggedSeams=False, MaxEdgeLength=0, MinEdgeLength=0.0001, MinTolerance=0, Refine=True, RefineAngle=0, RelativeTolerance=0.65, SimplePlanes=True, Tolerance=0})  # disabled
mesh_brep_2 = MeshBrep(
    Brep=fragment_patch,
    Settings={GridMaxCount=0, GridMinCount=16, JaggedSeams=False, MaxEdgeLength=0, MinEdgeLength=0.0001, MinTolerance=0, Refine=True, RefineAngle=0, RelativeTolerance=0.65, SimplePlanes=True, Tolerance=0})  # disabled
fragment_patch_3 = FragmentPatch(Boundary=join_curves_3)  # disabled
fragment_patch_4 = FragmentPatch(Boundary=join_curves_4)  # disabled
weaverbird_s_catmull_clark_subdivision = WeaverbirdsCatmullClarkSubdivision(MeshCurves=mesh_brep, Level=number_slider_28, SmoothNakedEdges=0)  # disabled
weaverbird_s_catmull_clark_subdivision_2 = WeaverbirdsCatmullClarkSubdivision(MeshCurves=mesh_brep_2, Level=number_slider_29, SmoothNakedEdges=0)  # disabled
mesh_brep_3 = MeshBrep(
    Brep=fragment_patch_3,
    Settings={GridMaxCount=0, GridMinCount=16, JaggedSeams=False, MaxEdgeLength=0, MinEdgeLength=0.0001, MinTolerance=0, Refine=True, RefineAngle=0, RelativeTolerance=0.65, SimplePlanes=True, Tolerance=0})  # disabled
mesh_brep_4 = MeshBrep(
    Brep=fragment_patch_4,
    Settings={GridMaxCount=0, GridMinCount=16, JaggedSeams=False, MaxEdgeLength=0, MinEdgeLength=0.0001, MinTolerance=0, Refine=True, RefineAngle=0, RelativeTolerance=0.65, SimplePlanes=True, Tolerance=0})  # disabled
number_slider_30 = Slider(3, range=0..10)  # disabled
number_slider_31 = Slider(3, range=0..10)  # disabled
loft = Loft(
    Curves=[fragment_patch, fragment_patch_2],
    Options={Adjust=True, Closed=False, LoftEnds=0, LoftSimp=0, LoftType=0, Rebuild=10, Refit=0.01})  # disabled
mesh_brep_5 = MeshBrep(
    Brep=loft,
    Settings={GridMaxCount=0, GridMinCount=16, JaggedSeams=False, MaxEdgeLength=0, MinEdgeLength=0.0001, MinTolerance=0, Refine=True, RefineAngle=0, RelativeTolerance=0.65, SimplePlanes=True, Tolerance=0})  # disabled
weaverbird_s_catmull_clark_subdivision_3 = WeaverbirdsCatmullClarkSubdivision(MeshCurves=mesh_brep_3, Level=number_slider_30, SmoothNakedEdges=0)  # disabled
weaverbird_s_catmull_clark_subdivision_4 = WeaverbirdsCatmullClarkSubdivision(MeshCurves=mesh_brep_4, Level=number_slider_31, SmoothNakedEdges=0)  # disabled
mesh_join = MeshJoin(Meshes=flatten([mesh_brep_5, weaverbird_s_catmull_clark_subdivision_2, weaverbird_s_catmull_clark_subdivision]))  # disabled
loft_2 = Loft(
    Curves=[fragment_patch_3, fragment_patch_4],
    Options={Adjust=True, Closed=False, LoftEnds=0, LoftSimp=0, LoftType=0, Rebuild=10, Refit=0.01})  # disabled
mesh_brep_6 = MeshBrep(
    Brep=loft_2,
    Settings={GridMaxCount=0, GridMinCount=16, JaggedSeams=False, MaxEdgeLength=0, MinEdgeLength=0.0001, MinTolerance=0, Refine=True, RefineAngle=0, RelativeTolerance=0.65, SimplePlanes=True, Tolerance=0})  # disabled
mesh_join_2 = MeshJoin(Meshes=flatten([mesh_brep_6, weaverbird_s_catmull_clark_subdivision_3, weaverbird_s_catmull_clark_subdivision_4]))  # disabled

# ----
curve_10 = Curve(<curve referenced from the Rhino model>)  # disabled
curve_11 = Curve(<curve referenced from the Rhino model>)  # disabled
curve_12 = Curve(<curve referenced from the Rhino model>)  # disabled
construct_domain_7 = ConstructDomain(DomainStart=expr("x*-1", number_slider), DomainEnd=number_slider)  # disabled
perp_frame_10 = PerpFrame(Curve=reparameterize(curve_11), Parameter=number_slider_4)  # disabled
perp_frame_11 = PerpFrame(Curve=reparameterize(curve_10), Parameter=number_slider_3)  # disabled
perp_frame_12 = PerpFrame(Curve=reparameterize(curve_12), Parameter=number_slider_2)  # disabled

# ---- group: Final 3 arches
# Brick dimensions
number_slider_32 = Slider(0.32, range=0..1)
# Input curves arches
# (clockwise)
number_slider_33 = Slider(0.16, range=0..1)
curve_13 = Curve(<curve referenced from the Rhino model>)
curve_14 = Curve(<curve referenced from the Rhino model>)
curve_15 = Curve(<curve referenced from the Rhino model>)
construct_domain_8 = ConstructDomain(DomainStart=expr("x*-0.5", number_slider_33), DomainEnd=expr("x*0.5", number_slider_33))
perp_frame_13 = PerpFrame(Curve=reparameterize(curve_14), Parameter=Slider(0, range=0..1))
perp_frame_14 = PerpFrame(Curve=reparameterize(curve_15), Parameter=Slider(0, range=0..1))
construct_domain_9 = ConstructDomain(DomainStart=0, DomainEnd=number_slider_32)
perp_frame_15 = PerpFrame(Curve=reparameterize(curve_13), Parameter=Slider(0, range=0..1))
cluster_10 = Cluster(plane=perp_frame_15)
cluster_11 = Cluster(plane=perp_frame_13)
cluster_12 = Cluster(plane=perp_frame_14)
rectangle_10 = Rectangle(Plane=cluster_12, XSize=construct_domain_9, YSize=construct_domain_8, Radius=0)  # -> Rectangle, Length
rectangle_11 = Rectangle(Plane=cluster_10, XSize=construct_domain_9, YSize=construct_domain_8, Radius=0)  # -> Rectangle, Length
rectangle_12 = Rectangle(Plane=cluster_11, XSize=construct_domain_9, YSize=construct_domain_8, Radius=0)  # -> Rectangle, Length
end_points_10 = EndPoints(Curve=curve_13)  # -> Start, End
deconstruct_plane_10 = DeconstructPlane(Plane=perp_frame_15)  # -> Origin, XAxis, YAxis, ZAxis
end_points_11 = EndPoints(Curve=curve_14)  # -> Start, End
deconstruct_plane_11 = DeconstructPlane(Plane=perp_frame_13)  # -> Origin, XAxis, YAxis, ZAxis
end_points_12 = EndPoints(Curve=curve_15)  # -> Start, End
deconstruct_plane_12 = DeconstructPlane(Plane=perp_frame_14)  # -> Origin, XAxis, YAxis, ZAxis
distance_10 = Distance(PointA=end_points_10.Start, PointB=end_points_10.End)
distance_11 = Distance(PointA=end_points_11.Start, PointB=end_points_11.End)
distance_12 = Distance(PointA=end_points_12.Start, PointB=end_points_12.End)
multiplication_10 = Multiplication(A=deconstruct_plane_10.ZAxis, B=distance_10)
multiplication_11 = Multiplication(A=deconstruct_plane_11.ZAxis, B=distance_11)
multiplication_12 = Multiplication(A=deconstruct_plane_12.ZAxis, B=distance_12)
extrude_10 = Extrude(Base=rectangle_11.Rectangle, Direction=multiplication_10)
extrude_11 = Extrude(Base=rectangle_12.Rectangle, Direction=multiplication_11)
extrude_12 = Extrude(Base=rectangle_10.Rectangle, Direction=multiplication_12)
cap_holes_10 = CapHoles(Brep=extrude_10)
cap_holes_11 = CapHoles(Brep=extrude_11)
cap_holes_12 = CapHoles(Brep=extrude_12)
deconstruct_brep_7 = DeconstructBrep(Brep=cap_holes_10)  # -> Faces, Edges, Vertices
deconstruct_brep_8 = DeconstructBrep(Brep=cap_holes_11)  # -> Faces, Edges, Vertices
deconstruct_brep_9 = DeconstructBrep(Brep=cap_holes_12)  # -> Faces, Edges, Vertices
entwine_9 = Entwine(
    Branch00=deconstruct_brep_7.Edges,
    Branch01=deconstruct_brep_8.Edges,
    Branch02=deconstruct_brep_9.Edges,
    FlattenInputs=True)
entwine_10 = Entwine(
    Branch00=deconstruct_brep_7.Vertices,
    Branch01=deconstruct_brep_8.Vertices,
    Branch02=deconstruct_brep_9.Vertices,
    FlattenInputs=True)
entwine_11 = Entwine(
    Branch00=deconstruct_brep_7.Edges,
    Branch01=deconstruct_brep_8.Edges,
    Branch02=deconstruct_brep_9.Edges,
    FlattenInputs=True)
entwine_12 = Entwine(
    Branch00=deconstruct_brep_7.Vertices,
    Branch01=deconstruct_brep_8.Vertices,
    Branch02=deconstruct_brep_9.Vertices,
    FlattenInputs=True)
list_item_13 = ListItem(List=entwine_9, Index=Slider(2, range=0..10), Wrap=True)  # -> flatten(Item)
list_item_14 = ListItem(List=entwine_10, Index=Slider(7, range=0..10), Wrap=True)  # -> flatten(Item)
list_item_15 = ListItem(List=entwine_11, Index=Slider(7, range=0..10), Wrap=True)  # -> flatten(Item)
list_item_16 = ListItem(List=entwine_12, Index=Slider(5, range=0..10), Wrap=True)  # -> flatten(Item)
list_item_17 = ListItem(List=entwine_12, Index=Slider(6, range=0..10), Wrap=True)  # -> flatten(Item)
list_item_18 = ListItem(List=entwine_10, Index=0, Wrap=True)  # -> flatten(Item)
shift_list_5 = ShiftList(List=list_item_14, Shift=1, Wrap=True)
shift_list_6 = ShiftList(List=list_item_17, Shift=1, Wrap=True)
line_5 = Line(StartPoint=list_item_18, EndPoint=shift_list_5)  # -> flatten(Line)
line_6 = Line(StartPoint=list_item_16, EndPoint=shift_list_6)  # -> flatten(Line)
join_curves_5 = JoinCurves(Curves=[line_5, list_item_13], Preserve=False)
join_curves_6 = JoinCurves(Curves=[line_6, list_item_15], Preserve=False)
fragment_patch_5 = FragmentPatch(Boundary=join_curves_5)
fragment_patch_6 = FragmentPatch(Boundary=join_curves_6)
mesh_brep_7 = MeshBrep(
    Brep=fragment_patch_5,
    Settings={GridMaxCount=0, GridMinCount=16, JaggedSeams=False, MaxEdgeLength=0, MinEdgeLength=0.0001, MinTolerance=0, Refine=True, RefineAngle=0, RelativeTolerance=0.65, SimplePlanes=True, Tolerance=0})
mesh_brep_8 = MeshBrep(
    Brep=fragment_patch_6,
    Settings={GridMaxCount=0, GridMinCount=16, JaggedSeams=False, MaxEdgeLength=0, MinEdgeLength=0.0001, MinTolerance=0, Refine=True, RefineAngle=0, RelativeTolerance=0.65, SimplePlanes=True, Tolerance=0})
weaverbird_s_catmull_clark_subdivision_5 = WeaverbirdsCatmullClarkSubdivision(MeshCurves=mesh_brep_7, Level=Slider(3, range=0..10), SmoothNakedEdges=0)
weaverbird_s_catmull_clark_subdivision_6 = WeaverbirdsCatmullClarkSubdivision(MeshCurves=mesh_brep_8, Level=Slider(3, range=0..10), SmoothNakedEdges=0)
loft_3 = Loft(
    Curves=[fragment_patch_5, fragment_patch_6],
    Options={Adjust=True, Closed=False, LoftEnds=0, LoftSimp=0, LoftType=0, Rebuild=10, Refit=0.01})
mesh_brep_9 = MeshBrep(
    Brep=loft_3,
    Settings={GridMaxCount=0, GridMinCount=16, JaggedSeams=False, MaxEdgeLength=0, MinEdgeLength=0.0001, MinTolerance=0, Refine=True, RefineAngle=0, RelativeTolerance=0.65, SimplePlanes=True, Tolerance=0})
mesh_join_3 = MeshJoin(Meshes=flatten([mesh_brep_9, weaverbird_s_catmull_clark_subdivision_5, weaverbird_s_catmull_clark_subdivision_6]))

# ----
rectangle_13 = Rectangle(Plane=perp_frame_10, XSize=construct_domain_7, YSize=construct_domain_7, Radius=0)  # -> Rectangle, Length; disabled
rectangle_14 = Rectangle(Plane=perp_frame_12, XSize=construct_domain_7, YSize=construct_domain_7, Radius=0)  # -> Rectangle, Length; disabled
rectangle_15 = Rectangle(Plane=perp_frame_11, XSize=construct_domain_7, YSize=construct_domain_7, Radius=0)  # -> Rectangle, Length; disabled
end_points_13 = EndPoints(Curve=curve_11)  # -> Start, End; disabled
end_points_14 = EndPoints(Curve=curve_12)  # -> Start, End; disabled
end_points_15 = EndPoints(Curve=curve_10)  # -> Start, End; disabled
deconstruct_plane_13 = DeconstructPlane(Plane=perp_frame_10)  # -> Origin, XAxis, YAxis, ZAxis; disabled
deconstruct_plane_14 = DeconstructPlane(Plane=perp_frame_12)  # -> Origin, XAxis, YAxis, ZAxis; disabled
deconstruct_plane_15 = DeconstructPlane(Plane=perp_frame_11)  # -> Origin, XAxis, YAxis, ZAxis; disabled
distance_13 = Distance(PointA=end_points_13.Start, PointB=end_points_13.End)  # disabled
distance_14 = Distance(PointA=end_points_14.Start, PointB=end_points_14.End)  # disabled
distance_15 = Distance(PointA=end_points_15.Start, PointB=end_points_15.End)  # disabled
multiplication_13 = Multiplication(A=deconstruct_plane_13.ZAxis, B=distance_13)  # disabled
multiplication_14 = Multiplication(A=deconstruct_plane_14.ZAxis, B=distance_14)  # disabled
multiplication_15 = Multiplication(A=deconstruct_plane_15.ZAxis, B=distance_15)  # disabled
extrude_13 = Extrude(Base=rectangle_13.Rectangle, Direction=multiplication_13)  # disabled
extrude_14 = Extrude(Base=rectangle_14.Rectangle, Direction=multiplication_14)  # disabled
extrude_15 = Extrude(Base=rectangle_15.Rectangle, Direction=multiplication_15)  # disabled
cap_holes_13 = CapHoles(Brep=extrude_13)  # disabled
cap_holes_14 = CapHoles(Brep=extrude_14)  # disabled
cap_holes_15 = CapHoles(Brep=extrude_15)  # disabled
solid_union_2 = SolidUnion(Breps=[cap_holes_13, cap_holes_14, cap_holes_15])  # disabled

# ---- group: tests
curve_16 = Curve(<curve referenced from the Rhino model>)
surface = Surface(<surface referenced from the Rhino model>)
curve_17 = Curve(<curve referenced from the Rhino model>)
surface_2 = Surface(<surface referenced from the Rhino model>)
curve_18 = Curve(<curve referenced from the Rhino model>)
surface_3 = Surface(<surface referenced from the Rhino model>)
curve_19 = Curve(<curve referenced from the Rhino model>)
surface_4 = Surface(<surface referenced from the Rhino model>)
curve_20 = Curve(<curve referenced from the Rhino model>)  # disabled
surface_5 = Surface(<surface referenced from the Rhino model>)  # disabled
curve_21 = Curve(<curve referenced from the Rhino model>)  # disabled
surface_6 = Surface(<surface referenced from the Rhino model>)  # disabled
curve_22 = Curve(<curve referenced from the Rhino model>)  # disabled
surface_7 = Surface(<surface referenced from the Rhino model>)  # disabled
curve_23 = Curve(<curve referenced from the Rhino model>)  # disabled
surface_8 = Surface(<surface referenced from the Rhino model>)  # disabled
cluster_13 = Cluster_2(
    surface=surface,
    base=surface,
    geometry=surface,
    curve_3=curve_16,
    curve_a=curve_16,
    curve=curve_16,
    curve_2=curve_16,
    brep=surface)  # -> extrusion, i
cluster_14 = Cluster_2(
    surface=surface_2,
    base=surface_2,
    geometry=surface_2,
    curve_3=curve_17,
    curve_a=curve_17,
    curve=curve_17,
    curve_2=curve_17,
    brep=surface_2)  # -> extrusion, i
cluster_15 = Cluster_2(
    surface=surface_3,
    base=surface_3,
    geometry=surface_3,
    curve_3=curve_18,
    curve_a=curve_18,
    curve=curve_18,
    curve_2=curve_18,
    brep=surface_3)  # -> extrusion, i
cluster_16 = Cluster_2(
    surface=surface_4,
    base=surface_4,
    geometry=surface_4,
    curve_3=curve_19,
    curve_a=curve_19,
    curve=curve_19,
    curve_2=curve_19,
    brep=surface_4)  # -> extrusion, i
cluster_17 = Cluster_2(
    surface=surface_5,
    base=surface_5,
    geometry=surface_5,
    curve_3=curve_20,
    curve_a=curve_20,
    curve=curve_20,
    curve_2=curve_20,
    brep=surface_5)  # -> extrusion, i; disabled
cluster_18 = Cluster_2(
    surface=surface_6,
    base=surface_6,
    geometry=surface_6,
    curve_3=curve_21,
    curve_a=curve_21,
    curve=curve_21,
    curve_2=curve_21,
    brep=surface_6)  # -> extrusion, i; disabled
cluster_19 = Cluster_2(
    surface=surface_7,
    base=surface_7,
    geometry=surface_7,
    curve_3=curve_22,
    curve_a=curve_22,
    curve=curve_22,
    curve_2=curve_22,
    brep=surface_7)  # -> extrusion, i; disabled
cluster_20 = Cluster_2(
    surface=surface_8,
    base=surface_8,
    geometry=surface_8,
    curve_3=curve_23,
    curve_a=curve_23,
    curve=curve_23,
    curve_2=curve_23,
    brep=surface_8)  # -> extrusion, i; disabled
brep = Brep(cluster_13.extrusion)
curve_24 = Curve(cluster_13.i)
brep_2 = Brep(cluster_14.extrusion)
curve_25 = Curve(cluster_14.i)
brep_3 = Brep(cluster_15.extrusion)
curve_26 = Curve(cluster_15.i)
brep_4 = Brep(cluster_16.extrusion)
curve_27 = Curve(cluster_16.i)
brep_5 = Brep(cluster_17.extrusion)  # disabled
curve_28 = Curve(cluster_17.i)  # disabled
brep_6 = Brep(cluster_18.extrusion)  # disabled
curve_29 = Curve(cluster_18.i)  # disabled
brep_7 = Brep(cluster_19.extrusion)  # disabled
curve_30 = Curve(cluster_19.i)  # disabled
brep_8 = Brep(cluster_20.extrusion)  # disabled
curve_31 = Curve(cluster_20.i)  # disabled
cluster_21 = Cluster_5(brep=surface)  # -> i, i_2
cluster1 = Cluster1(brep=surface)  # -> curve_4, curve_3, i_4, i_3, i_2, i
cluster_22 = Cluster_4(brep=surface_2)  # -> i_2, i
cluster_23 = Cluster_6(brep=surface_2)  # -> curve_4, curve_3, i_4, i_3, i_2, i
cluster_24 = Cluster_3(brep=surface_3)  # -> i, i_2
cluster_25 = Cluster_6(brep=surface_3)  # -> curve_4, curve_3, i_4, i_3, i_2, i
cluster1_2 = Cluster1(brep=surface_4)  # -> curve_4, curve_3, i_4, i_3, i_2, i
cluster_26 = Cluster_5(brep=surface_5)  # -> i, i_2; disabled
cluster1_3 = Cluster1(brep=surface_5)  # -> curve_4, curve_3, i_4, i_3, i_2, i; disabled
cluster_27 = Cluster_4(brep=surface_6)  # -> i_2, i; disabled
cluster_28 = Cluster_6(brep=surface_6)  # -> curve_4, curve_3, i_4, i_3, i_2, i; disabled
cluster_29 = Cluster_3(brep=surface_7)  # -> i, i_2; disabled
cluster_30 = Cluster_6(brep=surface_7)  # -> curve_4, curve_3, i_4, i_3, i_2, i; disabled
cluster1_4 = Cluster1(brep=surface_8)  # -> curve_4, curve_3, i_4, i_3, i_2, i; disabled
point = Point(cluster1_2.i_3)
point_2 = Point(cluster1.i_4)
point_3 = Point(cluster1.i_3)
point_4 = Point(cluster1.i_2)
point_5 = Point(cluster1.i)
point_6 = Point(cluster_23.i_4)
point_7 = Point(cluster_23.i_3)
point_8 = Point(cluster_23.i_2)
point_9 = Point(cluster_23.i)
point_10 = Point(cluster_25.i_4)
point_11 = Point(cluster_25.i_3)
point_12 = Point(cluster_25.i_2)
point_13 = Point(cluster_25.i)
point_14 = Point(cluster1_2.i_4)
point_15 = Point(cluster1_2.i_2)
point_16 = Point(cluster1_2.i)
point_17 = Point(cluster1_4.i_3)  # disabled
point_18 = Point(cluster1_3.i_4)  # disabled
point_19 = Point(cluster1_3.i_3)  # disabled
point_20 = Point(cluster1_3.i_2)  # disabled
point_21 = Point(cluster1_3.i)  # disabled
point_22 = Point(cluster_28.i_4)  # disabled
point_23 = Point(cluster_28.i_3)  # disabled
point_24 = Point(cluster_28.i_2)  # disabled
point_25 = Point(cluster_28.i)  # disabled
point_26 = Point(cluster_30.i_4)  # disabled
point_27 = Point(cluster_30.i_3)  # disabled
point_28 = Point(cluster_30.i_2)  # disabled
point_29 = Point(cluster_30.i)  # disabled
point_30 = Point(cluster1_4.i_4)  # disabled
point_31 = Point(cluster1_4.i_2)  # disabled
point_32 = Point(cluster1_4.i)  # disabled
entwine_13 = Entwine(Branch00=point_2, Branch01=point_6, Branch02=point_10, Branch03=point_14, FlattenInputs=True)
entwine_14 = Entwine(Branch00=point_7, Branch01=point_11, Branch02=point, Branch03=point_3, FlattenInputs=True)
entwine_15 = Entwine(Branch00=point_4, Branch01=point_8, Branch02=point_12, Branch03=point_15, FlattenInputs=True)
entwine_16 = Entwine(Branch00=point_9, Branch01=point_13, Branch02=point_16, Branch03=point_5, FlattenInputs=True)
entwine_17 = Entwine(Branch00=point_18, Branch01=point_22, Branch02=point_26, Branch03=point_30, FlattenInputs=True)  # disabled
entwine_18 = Entwine(Branch00=point_23, Branch01=point_27, Branch02=point_17, Branch03=point_19, FlattenInputs=True)  # disabled
entwine_19 = Entwine(Branch00=point_20, Branch01=point_24, Branch02=point_28, Branch03=point_31, FlattenInputs=True)  # disabled
entwine_20 = Entwine(Branch00=point_25, Branch01=point_29, Branch02=point_32, Branch03=point_21, FlattenInputs=True)  # disabled
line_7 = Line(StartPoint=entwine_13, EndPoint=entwine_14)
line_8 = Line(StartPoint=entwine_15, EndPoint=entwine_16)
line_9 = Line(StartPoint=entwine_17, EndPoint=entwine_18)  # disabled
line_10 = Line(StartPoint=entwine_19, EndPoint=entwine_20)  # disabled
join_curves_7 = JoinCurves(Curves=flatten([line_9, cluster1_3.curve_3, cluster_28.curve_3, cluster_30.curve_3, cluster1_4.curve_3]), Preserve=False)  # disabled
join_curves_8 = JoinCurves(Curves=flatten([cluster1_2.curve_4, line_8, cluster_25.curve_4, cluster_23.curve_4, cluster1.curve_4]), Preserve=False)
join_curves_9 = JoinCurves(Curves=flatten([line_7, cluster1.curve_3, cluster_23.curve_3, cluster_25.curve_3, cluster1_2.curve_3]), Preserve=False)
join_curves_10 = JoinCurves(
    Curves=flatten([cluster1_4.curve_4, line_10, cluster_30.curve_4, cluster_28.curve_4, cluster1_3.curve_4]),
    Preserve=False)  # disabled
boundary_surfaces = BoundarySurfaces(Edges=join_curves_9)
loft_4 = Loft(
    Curves=[join_curves_9, join_curves_8],
    Options={Adjust=True, Closed=False, LoftEnds=0, LoftSimp=0, LoftType=3, Rebuild=10, Refit=0.01})
boundary_surfaces_2 = BoundarySurfaces(Edges=join_curves_10)  # disabled
boundary_surfaces_3 = BoundarySurfaces(Edges=join_curves_7)  # disabled
loft_5 = Loft(
    Curves=[join_curves_7, join_curves_10],
    Options={Adjust=True, Closed=False, LoftEnds=0, LoftSimp=0, LoftType=3, Rebuild=10, Refit=0.01})  # disabled
boundary_surfaces_4 = BoundarySurfaces(Edges=join_curves_8)
mesh_brep_10 = MeshBrep(
    Brep=[loft_4, boundary_surfaces, boundary_surfaces_4],
    Settings={GridMaxCount=0, GridMinCount=16, JaggedSeams=False, MaxEdgeLength=0, MinEdgeLength=0.0001, MinTolerance=0, Refine=True, RefineAngle=0, RelativeTolerance=0.65, SimplePlanes=True, Tolerance=0})
mesh_brep_11 = MeshBrep(
    Brep=[loft_5, boundary_surfaces_3, boundary_surfaces_2],
    Settings={GridMaxCount=0, GridMinCount=16, JaggedSeams=False, MaxEdgeLength=0, MinEdgeLength=0.0001, MinTolerance=0, Refine=True, RefineAngle=0, RelativeTolerance=0.65, SimplePlanes=True, Tolerance=0})  # disabled
mesh_join_4 = MeshJoin(Meshes=mesh_brep_10)
mesh_join_5 = MeshJoin(Meshes=mesh_brep_11)  # disabled
curve_32 = Curve(<curve referenced from the Rhino model>)
curve_33 = Curve(<curve referenced from the Rhino model>)
end_points_16 = EndPoints(Curve=curve_32)  # -> Start, End
end_points_17 = EndPoints(Curve=curve_33)  # -> Start, End
point_33 = Point(end_points_16.End)
point_34 = Point(end_points_17.End)
deconstruct = Deconstruct(Point=point_33)  # -> XComponent, YComponent, ZComponent
deconstruct_2 = Deconstruct(Point=point_34)  # -> XComponent, YComponent, ZComponent
surface_9 = Surface(<surface referenced from the Rhino model>)
surface_10 = Surface(<surface referenced from the Rhino model>)
surface_11 = Surface(<surface referenced from the Rhino model>)
addition = Addition(A="0.08", B=deconstruct.YComponent)
addition_2 = Addition(A="0.09", B=deconstruct_2.XComponent)
construct_point = ConstructPoint(XCoordinate=deconstruct.XComponent, YCoordinate=addition, ZCoordinate=deconstruct.ZComponent)
construct_point_2 = ConstructPoint(XCoordinate=addition_2, YCoordinate=deconstruct_2.YComponent, ZCoordinate=deconstruct_2.ZComponent)
area = Area(Geometry=surface_9)  # -> Area, Centroid
area_2 = Area(Geometry=surface_10)  # -> Area, Centroid
area_3 = Area(Geometry=surface_11)  # -> Area, Centroid
construct_domain_10 = ConstructDomain(DomainStart="-10", DomainEnd="10")
xz_plane = XZPlane(Origin=construct_point)
yz_plane = YZPlane(Origin=construct_point_2)
construct_domain_11 = ConstructDomain(DomainStart="-10", DomainEnd="10")
evaluate_surface = EvaluateSurface(Surface=surface_9, Point=area.Centroid)  # -> Point, Normal, UDirection, VDirection, Frame
evaluate_surface_2 = EvaluateSurface(Surface=surface_10, Point=area_2.Centroid)  # -> Point, Normal, UDirection, VDirection, Frame
evaluate_surface_3 = EvaluateSurface(Surface=surface_11, Point=area_3.Centroid)  # -> Point, Normal, UDirection, VDirection, Frame
rectangle_16 = Rectangle(Plane=xz_plane, XSize=construct_domain_10, YSize=construct_domain_10, Radius=0)  # -> Rectangle, Length
rectangle_17 = Rectangle(Plane=yz_plane, XSize=construct_domain_11, YSize=construct_domain_11, Radius=0)  # -> Rectangle, Length
multiplication_16 = Multiplication(A=evaluate_surface_3.Normal, B=Slider(1, range=0..1))
multiplication_17 = Multiplication(A=evaluate_surface_2.Normal, B=Slider(1, range=0..1))
multiplication_18 = Multiplication(A=evaluate_surface.Normal, B=Slider(1, range=0..1))
boundary_surfaces_5 = BoundarySurfaces(Edges=rectangle_16.Rectangle)
boundary_surfaces_6 = BoundarySurfaces(Edges=rectangle_17.Rectangle)
extrude_16 = Extrude(Base=surface_11, Direction=multiplication_16)
extrude_17 = Extrude(Base=surface_9, Direction=multiplication_18)
extrude_18 = Extrude(Base=surface_10, Direction=multiplication_17)
cap_holes_16 = CapHoles(Brep=[extrude_17, extrude_18, extrude_16])
split_brep = SplitBrep(Brep=cap_holes_16, Cutter=boundary_surfaces_5)
list_item_19 = ListItem(List=split_brep, Index=Slider(0, range=0..1), Wrap=True)  # -> flatten(Item)
solid_union_3 = SolidUnion(Breps=list_item_19)
split_brep_2 = SplitBrep(Brep=solid_union_3, Cutter=boundary_surfaces_6)
list_item_20 = ListItem(List=split_brep_2, Index=Slider(0, range=0..1), Wrap=True)  # -> flatten(Item)
solid_union_4 = SolidUnion(Breps=list_item_20)

# ---- group: Final 4 arches
number_slider_34 = Slider(0.16, range=0..1)
curve_34 = Curve(<curve referenced from the Rhino model>)
curve_35 = Curve(<curve referenced from the Rhino model>)
curve_36 = Curve(<curve referenced from the Rhino model>)
curve_37 = Curve(<curve referenced from the Rhino model>)
construct_domain_12 = ConstructDomain(DomainStart=expr("x*-0.5", number_slider_34), DomainEnd=expr("x*0.5", number_slider_34))
perp_frame_16 = PerpFrame(Curve=reparameterize(curve_35), Parameter=Slider(0, range=0..1))
perp_frame_17 = PerpFrame(Curve=reparameterize(curve_36), Parameter=Slider(0, range=0..1))
perp_frame_18 = PerpFrame(Curve=reparameterize(curve_34), Parameter=Slider(0, range=0..1))
perp_frame_19 = PerpFrame(Curve=reparameterize(curve_37), Parameter=Slider(0, range=0..1))
construct_domain_13 = ConstructDomain(DomainStart=0, DomainEnd=Slider(0.32, range=0..1))
end_points_18 = EndPoints(Curve=curve_37)  # -> Start, End
deconstruct_plane_16 = DeconstructPlane(Plane=perp_frame_19)  # -> Origin, XAxis, YAxis, ZAxis
end_points_19 = EndPoints(Curve=curve_34)  # -> Start, End
deconstruct_plane_17 = DeconstructPlane(Plane=perp_frame_18)  # -> Origin, XAxis, YAxis, ZAxis
end_points_20 = EndPoints(Curve=curve_35)  # -> Start, End
deconstruct_plane_18 = DeconstructPlane(Plane=perp_frame_16)  # -> Origin, XAxis, YAxis, ZAxis
end_points_21 = EndPoints(Curve=curve_36)  # -> Start, End
deconstruct_plane_19 = DeconstructPlane(Plane=perp_frame_17)  # -> Origin, XAxis, YAxis, ZAxis
distance_16 = Distance(PointA=end_points_18.Start, PointB=end_points_18.End)
distance_17 = Distance(PointA=end_points_19.Start, PointB=end_points_19.End)
distance_18 = Distance(PointA=end_points_20.Start, PointB=end_points_20.End)
distance_19 = Distance(PointA=end_points_21.Start, PointB=end_points_21.End)
multiplication_19 = Multiplication(A=deconstruct_plane_16.ZAxis, B=distance_16)
multiplication_20 = Multiplication(A=deconstruct_plane_17.ZAxis, B=distance_17)
multiplication_21 = Multiplication(A=deconstruct_plane_18.ZAxis, B=distance_18)
multiplication_22 = Multiplication(A=deconstruct_plane_19.ZAxis, B=distance_19)

# ---- group: Final 4 arches / Create planes that are well oriented
cluster_31 = Cluster(plane=perp_frame_19)
cluster_32 = Cluster(plane=perp_frame_18)
cluster_33 = Cluster(plane=perp_frame_16)
cluster_34 = Cluster(plane=perp_frame_17)

# ---- group: Final 4 arches (continued)
rectangle_18 = Rectangle(Plane=cluster_34, XSize=construct_domain_13, YSize=construct_domain_12, Radius=0)  # -> Rectangle, Length
rectangle_19 = Rectangle(Plane=cluster_31, XSize=construct_domain_13, YSize=construct_domain_12, Radius=0)  # -> Rectangle, Length
rectangle_20 = Rectangle(Plane=cluster_32, XSize=construct_domain_13, YSize=construct_domain_12, Radius=0)  # -> Rectangle, Length
rectangle_21 = Rectangle(Plane=cluster_33, XSize=construct_domain_13, YSize=construct_domain_12, Radius=0)  # -> Rectangle, Length
extrude_19 = Extrude(Base=rectangle_19.Rectangle, Direction=multiplication_19)
extrude_20 = Extrude(Base=rectangle_20.Rectangle, Direction=multiplication_20)
extrude_21 = Extrude(Base=rectangle_21.Rectangle, Direction=multiplication_21)
extrude_22 = Extrude(Base=rectangle_18.Rectangle, Direction=multiplication_22)
cap_holes_17 = CapHoles(Brep=extrude_19)
cap_holes_18 = CapHoles(Brep=extrude_20)
cap_holes_19 = CapHoles(Brep=extrude_21)
cap_holes_20 = CapHoles(Brep=extrude_22)
deconstruct_brep_10 = DeconstructBrep(Brep=cap_holes_17)  # -> Faces, Edges, Vertices
deconstruct_brep_11 = DeconstructBrep(Brep=cap_holes_18)  # -> Faces, Edges, Vertices
deconstruct_brep_12 = DeconstructBrep(Brep=cap_holes_19)  # -> Faces, Edges, Vertices
deconstruct_brep_13 = DeconstructBrep(Brep=cap_holes_20)  # -> Faces, Edges, Vertices
entwine_21 = Entwine(
    Branch00=deconstruct_brep_11.Vertices,
    Branch01=deconstruct_brep_12.Vertices,
    Branch02=deconstruct_brep_13.Vertices,
    Branch03=deconstruct_brep_10.Vertices,
    FlattenInputs=True)
entwine_22 = Entwine(
    Branch00=deconstruct_brep_11.Vertices,
    Branch01=deconstruct_brep_12.Vertices,
    Branch02=deconstruct_brep_13.Vertices,
    Branch03=deconstruct_brep_10.Vertices,
    FlattenInputs=True)
entwine_23 = Entwine(
    Branch00=deconstruct_brep_11.Edges,
    Branch01=deconstruct_brep_12.Edges,
    Branch02=deconstruct_brep_13.Edges,
    Branch03=deconstruct_brep_10.Edges,
    FlattenInputs=True)
entwine_24 = Entwine(
    Branch00=deconstruct_brep_11.Edges,
    Branch01=deconstruct_brep_12.Edges,
    Branch02=deconstruct_brep_13.Edges,
    Branch03=deconstruct_brep_10.Edges,
    FlattenInputs=True)
list_item_21 = ListItem(List=entwine_22, Index=Slider(7, range=0..10), Wrap=True)  # -> flatten(Item)
list_item_22 = ListItem(List=entwine_21, Index=Slider(6, range=0..10), Wrap=True)  # -> flatten(Item)
list_item_23 = ListItem(List=entwine_22, Index=0, Wrap=True)  # -> flatten(Item)
list_item_24 = ListItem(List=entwine_23, Index=Slider(7, range=0..10), Wrap=True)  # -> flatten(Item)
list_item_25 = ListItem(List=entwine_24, Index=Slider(2, range=0..10), Wrap=True)  # -> flatten(Item)
list_item_26 = ListItem(List=entwine_21, Index=Slider(5, range=0..10), Wrap=True)  # -> flatten(Item)
shift_list_7 = ShiftList(List=list_item_21, Shift=1, Wrap=True)
shift_list_8 = ShiftList(List=list_item_22, Shift=1, Wrap=True)
line_11 = Line(StartPoint=list_item_23, EndPoint=shift_list_7)  # -> flatten(Line)
line_12 = Line(StartPoint=list_item_26, EndPoint=shift_list_8)  # -> flatten(Line)
join_curves_11 = JoinCurves(Curves=[line_11, list_item_25], Preserve=False)
join_curves_12 = JoinCurves(Curves=[line_12, list_item_24], Preserve=False)
fragment_patch_7 = FragmentPatch(Boundary=join_curves_11)
fragment_patch_8 = FragmentPatch(Boundary=join_curves_12)
mesh_brep_12 = MeshBrep(
    Brep=fragment_patch_7,
    Settings={GridMaxCount=0, GridMinCount=16, JaggedSeams=False, MaxEdgeLength=0, MinEdgeLength=0.0001, MinTolerance=0, Refine=True, RefineAngle=0, RelativeTolerance=0.65, SimplePlanes=True, Tolerance=0})
mesh_brep_13 = MeshBrep(
    Brep=fragment_patch_8,
    Settings={GridMaxCount=0, GridMinCount=16, JaggedSeams=False, MaxEdgeLength=0, MinEdgeLength=0.0001, MinTolerance=0, Refine=True, RefineAngle=0, RelativeTolerance=0.65, SimplePlanes=True, Tolerance=0})
weaverbird_s_catmull_clark_subdivision_7 = WeaverbirdsCatmullClarkSubdivision(MeshCurves=mesh_brep_12, Level=Slider(3, range=0..10), SmoothNakedEdges=0)
weaverbird_s_catmull_clark_subdivision_8 = WeaverbirdsCatmullClarkSubdivision(MeshCurves=mesh_brep_13, Level=Slider(3, range=0..10), SmoothNakedEdges=0)
loft_6 = Loft(
    Curves=[fragment_patch_7, fragment_patch_8],
    Options={Adjust=True, Closed=False, LoftEnds=0, LoftSimp=0, LoftType=0, Rebuild=10, Refit=0.01})
mesh_brep_14 = MeshBrep(
    Brep=loft_6,
    Settings={GridMaxCount=0, GridMinCount=16, JaggedSeams=False, MaxEdgeLength=0, MinEdgeLength=0.0001, MinTolerance=0, Refine=True, RefineAngle=0, RelativeTolerance=0.65, SimplePlanes=True, Tolerance=0})
mesh_join_6 = MeshJoin(Meshes=flatten([mesh_brep_14, weaverbird_s_catmull_clark_subdivision_7, weaverbird_s_catmull_clark_subdivision_8]))

# Brick dimensions
# Input curves arches
# (clockwise)
number_slider_35 = Slider(0.16, range=0..1)
curve_38 = Curve(<curve referenced from the Rhino model>)
curve_39 = Curve(<curve referenced from the Rhino model>)
curve_40 = Curve()
curve_41 = Curve()
construct_domain_14 = ConstructDomain(DomainStart=expr("x*-0.5", number_slider_35), DomainEnd=expr("x*0.5", number_slider_35))
perp_frame_20 = PerpFrame(Curve=reparameterize(curve_39), Parameter=Slider(0, range=0..1))
perp_frame_21 = PerpFrame(Curve=reparameterize(curve_40), Parameter=Slider(0, range=0..1))
perp_frame_22 = PerpFrame(Curve=reparameterize(curve_38), Parameter=Slider(0, range=0..1))
perp_frame_23 = PerpFrame(Curve=reparameterize(curve_41), Parameter=Slider(0, range=0..1))
construct_domain_15 = ConstructDomain(DomainStart=0, DomainEnd=Slider(0.32, range=0..1))
end_points_22 = EndPoints(Curve=curve_41)  # -> Start, End
deconstruct_plane_20 = DeconstructPlane(Plane=perp_frame_23)  # -> Origin, XAxis, YAxis, ZAxis
end_points_23 = EndPoints(Curve=curve_38)  # -> Start, End
deconstruct_plane_21 = DeconstructPlane(Plane=perp_frame_22)  # -> Origin, XAxis, YAxis, ZAxis
end_points_24 = EndPoints(Curve=curve_39)  # -> Start, End
deconstruct_plane_22 = DeconstructPlane(Plane=perp_frame_20)  # -> Origin, XAxis, YAxis, ZAxis
end_points_25 = EndPoints(Curve=curve_40)  # -> Start, End
deconstruct_plane_23 = DeconstructPlane(Plane=perp_frame_21)  # -> Origin, XAxis, YAxis, ZAxis
distance_20 = Distance(PointA=end_points_22.Start, PointB=end_points_22.End)
distance_21 = Distance(PointA=end_points_23.Start, PointB=end_points_23.End)
distance_22 = Distance(PointA=end_points_24.Start, PointB=end_points_24.End)
distance_23 = Distance(PointA=end_points_25.Start, PointB=end_points_25.End)
multiplication_23 = Multiplication(A=deconstruct_plane_20.ZAxis, B=distance_20)
multiplication_24 = Multiplication(A=deconstruct_plane_21.ZAxis, B=distance_21)
multiplication_25 = Multiplication(A=deconstruct_plane_22.ZAxis, B=distance_22)
multiplication_26 = Multiplication(A=deconstruct_plane_23.ZAxis, B=distance_23)

# ---- group: Final 4 arches / Create planes that are well oriented
cluster_35 = Cluster(plane=perp_frame_23)
cluster_36 = Cluster(plane=perp_frame_22)
cluster_37 = Cluster(plane=perp_frame_20)
cluster_38 = Cluster(plane=perp_frame_21)

# ---- group: Final 4 arches (continued)
rectangle_22 = Rectangle(Plane=cluster_38, XSize=construct_domain_15, YSize=construct_domain_14, Radius=0)  # -> Rectangle, Length
rectangle_23 = Rectangle(Plane=cluster_35, XSize=construct_domain_15, YSize=construct_domain_14, Radius=0)  # -> Rectangle, Length
rectangle_24 = Rectangle(Plane=cluster_36, XSize=construct_domain_15, YSize=construct_domain_14, Radius=0)  # -> Rectangle, Length
rectangle_25 = Rectangle(Plane=cluster_37, XSize=construct_domain_15, YSize=construct_domain_14, Radius=0)  # -> Rectangle, Length
extrude_23 = Extrude(Base=rectangle_23.Rectangle, Direction=multiplication_23)
extrude_24 = Extrude(Base=rectangle_24.Rectangle, Direction=multiplication_24)
extrude_25 = Extrude(Base=rectangle_25.Rectangle, Direction=multiplication_25)
extrude_26 = Extrude(Base=rectangle_22.Rectangle, Direction=multiplication_26)
cap_holes_21 = CapHoles(Brep=extrude_23)
cap_holes_22 = CapHoles(Brep=extrude_24)
cap_holes_23 = CapHoles(Brep=extrude_25)
cap_holes_24 = CapHoles(Brep=extrude_26)
deconstruct_brep_14 = DeconstructBrep(Brep=cap_holes_21)  # -> Faces, Edges, Vertices
deconstruct_brep_15 = DeconstructBrep(Brep=cap_holes_22)  # -> Faces, Edges, Vertices
deconstruct_brep_16 = DeconstructBrep(Brep=cap_holes_23)  # -> Faces, Edges, Vertices
deconstruct_brep_17 = DeconstructBrep(Brep=cap_holes_24)  # -> Faces, Edges, Vertices
entwine_25 = Entwine(
    Branch00=deconstruct_brep_15.Vertices,
    Branch01=deconstruct_brep_16.Vertices,
    Branch02=deconstruct_brep_17.Vertices,
    Branch03=deconstruct_brep_14.Vertices,
    FlattenInputs=True)
entwine_26 = Entwine(
    Branch00=deconstruct_brep_15.Vertices,
    Branch01=deconstruct_brep_16.Vertices,
    Branch02=deconstruct_brep_17.Vertices,
    Branch03=deconstruct_brep_14.Vertices,
    FlattenInputs=True)
entwine_27 = Entwine(
    Branch00=deconstruct_brep_15.Edges,
    Branch01=deconstruct_brep_16.Edges,
    Branch02=deconstruct_brep_17.Edges,
    Branch03=deconstruct_brep_14.Edges,
    FlattenInputs=True)
entwine_28 = Entwine(
    Branch00=deconstruct_brep_15.Edges,
    Branch01=deconstruct_brep_16.Edges,
    Branch02=deconstruct_brep_17.Edges,
    Branch03=deconstruct_brep_14.Edges,
    FlattenInputs=True)
list_item_27 = ListItem(List=entwine_26, Index=Slider(7, range=0..10), Wrap=True)  # -> flatten(Item)
list_item_28 = ListItem(List=entwine_25, Index=Slider(6, range=0..10), Wrap=True)  # -> flatten(Item)
list_item_29 = ListItem(List=entwine_26, Index=0, Wrap=True)  # -> flatten(Item)
list_item_30 = ListItem(List=entwine_27, Index=Slider(7, range=0..10), Wrap=True)  # -> flatten(Item)
list_item_31 = ListItem(List=entwine_28, Index=Slider(2, range=0..10), Wrap=True)  # -> flatten(Item)
list_item_32 = ListItem(List=entwine_25, Index=Slider(5, range=0..10), Wrap=True)  # -> flatten(Item)
shift_list_9 = ShiftList(List=list_item_27, Shift=1, Wrap=True)
shift_list_10 = ShiftList(List=list_item_28, Shift=1, Wrap=True)
line_13 = Line(StartPoint=list_item_29, EndPoint=shift_list_9)  # -> flatten(Line)
line_14 = Line(StartPoint=list_item_32, EndPoint=shift_list_10)  # -> flatten(Line)
join_curves_13 = JoinCurves(Curves=[line_13, list_item_31], Preserve=False)
join_curves_14 = JoinCurves(Curves=[line_14, list_item_30], Preserve=False)
fragment_patch_9 = FragmentPatch(Boundary=join_curves_13)
fragment_patch_10 = FragmentPatch(Boundary=join_curves_14)
mesh_brep_15 = MeshBrep(
    Brep=fragment_patch_9,
    Settings={GridMaxCount=0, GridMinCount=16, JaggedSeams=False, MaxEdgeLength=0, MinEdgeLength=0.0001, MinTolerance=0, Refine=True, RefineAngle=0, RelativeTolerance=0.65, SimplePlanes=True, Tolerance=0})
mesh_brep_16 = MeshBrep(
    Brep=fragment_patch_10,
    Settings={GridMaxCount=0, GridMinCount=16, JaggedSeams=False, MaxEdgeLength=0, MinEdgeLength=0.0001, MinTolerance=0, Refine=True, RefineAngle=0, RelativeTolerance=0.65, SimplePlanes=True, Tolerance=0})
weaverbird_s_catmull_clark_subdivision_9 = WeaverbirdsCatmullClarkSubdivision(MeshCurves=mesh_brep_15, Level=Slider(3, range=0..10), SmoothNakedEdges=0)
weaverbird_s_catmull_clark_subdivision_10 = WeaverbirdsCatmullClarkSubdivision(MeshCurves=mesh_brep_16, Level=Slider(3, range=0..10), SmoothNakedEdges=0)
loft_7 = Loft(
    Curves=[fragment_patch_9, fragment_patch_10],
    Options={Adjust=True, Closed=False, LoftEnds=0, LoftSimp=0, LoftType=0, Rebuild=10, Refit=0.01})
mesh_brep_17 = MeshBrep(
    Brep=loft_7,
    Settings={GridMaxCount=0, GridMinCount=16, JaggedSeams=False, MaxEdgeLength=0, MinEdgeLength=0.0001, MinTolerance=0, Refine=True, RefineAngle=0, RelativeTolerance=0.65, SimplePlanes=True, Tolerance=0})
mesh_join_7 = MeshJoin(Meshes=flatten([mesh_brep_17, weaverbird_s_catmull_clark_subdivision_9, weaverbird_s_catmull_clark_subdivision_10]))

# ==== cluster Cluster
plane = ClusterInput()
unit_z = UnitZ(Factor=1)
deconstruct_plane = DeconstructPlane(Plane=plane)  # -> Origin, XAxis, YAxis, ZAxis
cross_product = CrossProduct(VectorA=deconstruct_plane.ZAxis, VectorB=unit_z, Unitize=False)  # -> Vector, Length
cross_product_2 = CrossProduct(VectorA=deconstruct_plane.ZAxis, VectorB=cross_product.Vector, Unitize=False)  # -> expr("x*-1", Vector), Length
construct_plane = ConstructPlane(Origin=deconstruct_plane.Origin, XAxis=cross_product_2.Vector, YAxis=cross_product.Vector)
plane_2 = ClusterOutput(construct_plane)

# ==== cluster Cluster_2
geometry = ClusterInput()
area = Area(Geometry=geometry)  # -> Area, Centroid
brep = ClusterInput()
surface = ClusterInput()
brep_edges = BrepEdges(Brep=brep)  # -> Naked, Interior, NonManifold
evaluate_surface = EvaluateSurface(Surface=surface, Point=area.Centroid)  # -> Point, Normal, UDirection, VDirection, Frame
list_item = ListItem(List=brep_edges.Naked, Index=Slider(3, range=0..10), Wrap=True)
curve_middle = CurveMiddle(Curve=list_item)
line_sdl = LineSDL(Start=curve_middle, Direction=evaluate_surface.Normal, Length=1)
curve_a = ClusterInput()
curve_curve = CurveCurve(CurveA=curve_a, CurveB=line_sdl)  # -> Points, ParamsA, ParamsB
distance = Distance(PointA=curve_curve.Points, PointB=curve_middle)
multiplication = Multiplication(A=evaluate_surface.Normal, B=distance)
base = ClusterInput()
extrude = Extrude(Base=base, Direction=multiplication)
curve = ClusterInput()
extrusion = ClusterOutput(extrude)
brep_curve = BrepCurve(Brep=extrude, Curve=curve)  # -> Curves, Points
curve_2 = ClusterInput()
curve_closest_point = CurveClosestPoint(Point=brep_curve.Points, Curve=curve_2)  # -> Point, Parameter, Distance
curve_3 = ClusterInput()
shatter = Shatter(Curve=curve_3, Parameters=curve_closest_point.Parameter)  # -> reverse(Segments)
list_item_2 = ListItem(List=shatter, Index=0, Wrap=True)
i = ClusterOutput(list_item_2)

# ==== cluster Cluster1
brep = ClusterInput()
deconstruct_brep = DeconstructBrep(Brep=brep)  # -> Faces, Edges, Vertices
list_item = ListItem(List=deconstruct_brep.Vertices, Index=Slider(2, range=0..3), Wrap=True)
list_item_2 = ListItem(List=deconstruct_brep.Vertices, Index=Slider(1, range=0..3), Wrap=True)
list_item_3 = ListItem(List=deconstruct_brep.Vertices, Index=Slider(3, range=0..3), Wrap=True)
list_item_4 = ListItem(List=deconstruct_brep.Vertices, Index=Slider(0, range=0..3), Wrap=True)
list_item_5 = ListItem(List=deconstruct_brep.Edges, Index=Slider(1, range=0..3), Wrap=True)
list_item_6 = ListItem(List=deconstruct_brep.Edges, Index=Slider(3, range=0..3), Wrap=True)
i = ClusterOutput(list_item)
i_2 = ClusterOutput(list_item_2)
i_3 = ClusterOutput(list_item_3)
i_4 = ClusterOutput(list_item_4)
curve = Curve(list_item_6)
curve_2 = Curve(list_item_5)
curve_3 = ClusterOutput(curve)
curve_4 = ClusterOutput(curve_2)

# ==== cluster Cluster_3
brep = ClusterInput()
deconstruct_brep = DeconstructBrep(Brep=brep)  # -> Faces, Edges, Vertices
list_item = ListItem(List=deconstruct_brep.Vertices, Index=Slider(7, range=0..10), Wrap=True)
list_item_2 = ListItem(List=deconstruct_brep.Vertices, Index=Slider(4, range=0..10), Wrap=True)
i = ClusterOutput(list_item)
i_2 = ClusterOutput(list_item_2)

# ==== cluster Cluster_4
brep = ClusterInput()
deconstruct_brep = DeconstructBrep(Brep=brep)  # -> Faces, Edges, Vertices
list_item = ListItem(List=deconstruct_brep.Vertices, Index=Slider(4, range=0..10), Wrap=True)
list_item_2 = ListItem(List=deconstruct_brep.Vertices, Index=Slider(7, range=0..10), Wrap=True)
i = ClusterOutput(list_item)
i_2 = ClusterOutput(list_item_2)

# ==== cluster Cluster_5
brep = ClusterInput()
deconstruct_brep = DeconstructBrep(Brep=brep)  # -> Faces, Edges, Vertices
list_item = ListItem(List=deconstruct_brep.Vertices, Index=Slider(4, range=0..10), Wrap=True)
list_item_2 = ListItem(List=deconstruct_brep.Vertices, Index=Slider(3, range=0..10), Wrap=True)
i = ClusterOutput(list_item)
i_2 = ClusterOutput(list_item_2)

# ==== cluster Cluster_6
brep = ClusterInput()
deconstruct_brep = DeconstructBrep(Brep=brep)  # -> Faces, Edges, Vertices
list_item = ListItem(List=deconstruct_brep.Edges, Index=Slider(1, range=0..3), Wrap=True)
list_item_2 = ListItem(List=deconstruct_brep.Edges, Index=Slider(3, range=0..3), Wrap=True)
list_item_3 = ListItem(List=deconstruct_brep.Vertices, Index=Slider(1, range=0..3), Wrap=True)
list_item_4 = ListItem(List=deconstruct_brep.Vertices, Index=Slider(2, range=0..3), Wrap=True)
list_item_5 = ListItem(List=deconstruct_brep.Vertices, Index=Slider(0, range=0..3), Wrap=True)
list_item_6 = ListItem(List=deconstruct_brep.Vertices, Index=Slider(3, range=0..3), Wrap=True)
i = ClusterOutput(list_item_3)
curve = Curve(list_item_2)
curve_2 = Curve(list_item)
i_2 = ClusterOutput(list_item_4)
i_3 = ClusterOutput(list_item_5)
i_4 = ClusterOutput(list_item_6)
curve_3 = ClusterOutput(curve)
curve_4 = ClusterOutput(curve_2)
